# Grasshopper definition CDRF_RETRACTION_v2.gh (Grasshopper 1.0.8)
# plug-ins: Pufferfish

# ----
# Print Settings
layer_height = Slider(1, range=0..2.5)
initial_layer_height = Slider(0.65, range=0..1)
bed_temp = Panel("80")
extruder_temp = Panel("250")
fan_speed = Slider(1, range=0..1)
speed_scale_factor = Slider(0.2, range=0.1..1)
extrusion_scale_factor = Slider(3.3, range=2.5..5)
printer_model = ValueList({"Bambu A1 Default": 0, "Bambu A1 Fast": 1}, selected="Bambu A1 Fast")

panel = Panel("print1")
print1 = Geometry(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)

print_2 = Geometry(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)
panel_2 = Panel("prin2")

panel_3 = Panel("print 3")
print3 = Geometry(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)

# ----
# Setup
# Base Surface
test_circle = Surface(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)
test_vase = Surface(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)

mesh_to_polysurface = MeshToPolysurface(Mesh=print_2, Triangles=False, FaceMerge=False)

# ---- group: Test Cyl
number_slider = Slider(20, range=0..1000)
xy = XYPlane(Origin=Point(0, 0, 0))
cyl = Cylinder(Base=xy, Radius=Slider(30, range=0..1000), Length=number_slider)
geo = Geometry(cyl)

# ---- group: 3 D Printer Selection
dfl_3d_printer_selector = DFL3DPrinterSelector(
    layer_height=initial_layer_height,
    printer_type=printer_model,
    extruder_temp=extruder_temp,
    bed_temp=bed_temp,
    fan_speed=fan_speed)  # -> srf_2, geometry, _3dp_start_code_2, _3dp_end_code_2, bambu_max_feed_rate_2, default_extrusion_ratio_2

# ---- group: Speed Factoring
max_printer_feed_rate = Panel(dfl_3d_printer_selector.bambu_max_feed_rate_2)
speed_scale_factor_2 = Multiplication(MaxPrinterFeedRate=max_printer_feed_rate, SpeedScaleFactor=speed_scale_factor)
adjusted_feed_rate = Panel(speed_scale_factor_2)

# ----
disk_contours = Geometry([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])
brep = Brep(mesh_to_polysurface)
deconstruct_brep = DeconstructBrep(Brep=brep)  # -> Faces, Edges, Vertices
preview = CustomPreview(Geometry=dfl_3d_printer_selector.srf_2, Material=ColourSwatch(SwatchColor=RGB(48, 48, 12)))

overide_extrusion_ratio = BooleanToggle(True)
multiplication = Multiplication(A=dfl_3d_printer_selector.default_extrusion_ratio_2, B=extrusion_scale_factor)
filter = StreamFilter(Gate=overide_extrusion_ratio, Stream0=dfl_3d_printer_selector.default_extrusion_ratio_2, Stream1=multiplication)

list_item = ListItem(List=deconstruct_brep.Faces, Index="4", Wrap=True)

# ---- group: 2 Cyls
multiplication_2 = Multiplication(A=number_slider, B=3.5)
Y = UnitY(Factor=multiplication_2)
move = Move(Geometry=geo, Motion=Y)  # -> Geometry, Transform
geo_2 = Geometry(flatten([move.Geometry, geo]))

# ----
geo_3 = Geometry(geo_2)

# ---- group: Make Contours / Plug print in here
print_object = Geometry(geo_3)

# ---- group: Make Contours
contour = Contour(Shape=geo_3, Point=Point(0, 0, 0), Direction=Vector(0, 0, 1), Distance=layer_height)

# ---- group: Move To build Plate
list_item_2 = ListItem(List=flatten(contour), Index=0, Wrap=True)
area = Area(Geometry=list_item_2)  # -> Area, Centroid
point = Point(dfl_3d_printer_selector.geometry)
move_to_point = MoveToPoint(Geometry=contour, PointA=area.Centroid, PointB=point)  # -> flatten(Moved), Vector, Transform

# ---- group: Move to base plate
orient = Orient(Geometry=brep, Source=list_item, Target=point)  # -> Geometry, Transform

# ---- group: Flip upside down
xy_plane = XYPlane(Origin=Point(0, 0, 0))
plane_normal = PlaneNormal(Origin=xy_plane, ZAxis=Vector(0, 0, 1))
mirror = Mirror(Geometry=orient.Geometry, Plane=plane_normal)  # -> Geometry, Transform

# ----
deconstruct_brep_2 = DeconstructBrep(Brep=mirror.Geometry)  # -> flatten(Faces), Edges, Vertices
panel_4 = Panel("""4
5""")

# ---- group: Remove bottom face from list
cull_index = CullIndex(List=deconstruct_brep_2.Faces, Indices=panel_4, Wrap=True)  # -> flatten(List)

# ----
list_item_3 = ListItem(List=deconstruct_brep_2.Faces, Index=panel_4, Wrap=True)
brep_join = BrepJoin(Breps=cull_index)  # -> Breps, Closed
deconstruct_brep_3 = DeconstructBrep(Brep=list_item_3)  # -> Faces, flatten(Edges), flatten(Vertices)
panel_5 = Panel("""0
1
4
5""")

# ---- group: Make a Brim (generic)
list_item_4 = ListItem(List=move_to_point.Moved, Index=0, Wrap=True)
number_slider_2 = Slider(2.9, range=0..10)
series = Series(Start=number_slider_2, Step=number_slider_2, Count=Slider(3, range=0..10))  # -> expr("x", Series)
offset_curve = OffsetCurve(Curve=list_item_4, Plane=PlaneXY(0, 0, 0), Distance=series, BothSides=0, Kinks=0, CapType=1)  # -> flatten(Offset)

# ---- group: Make Brim with Ears
list_item_5 = ListItem(List=flatten(move_to_point.Moved), Index=0, Wrap=True)
size_of_ear = Slider(8, range=5..10)
number_of_ears = Panel("4")
boundary_surfaces = BoundarySurfaces(Edges=list_item_5)
divide = DivideCurve(Curve=boundary_surfaces, Count=number_of_ears, Kinks=False)  # -> Points, Tangents, Parameters
circle = Circle(Plane=divide.Points, Radius=graft(size_of_ear))
boundary_surfaces_2 = BoundarySurfaces(Edges=circle)
runion = RegionUnion(Curves=flatten([boundary_surfaces, boundary_surfaces_2]))
join_curves = JoinCurves(Curves=runion, Preserve=False)
offset_curve_2 = OffsetCurve(Curve=join_curves, Distance=series, Corners=1)
reverse_list = ReverseList(List=flatten(offset_curve_2))

# ---- group: Contour Shape
contour_2 = Contour(Shape=brep_join.Breps, Point=Point(0, 0, 0), Direction=Vector(0, 0, 1), Distance=layer_height)

# ----
list_item_6 = ListItem(List=deconstruct_brep_3.Edges, Index=panel_5, Wrap=True)
join_curves_2 = JoinCurves(Curves=list_item_6, Preserve=False)

# ---- group: Offset bottom face/shape into contours
number_slider_3 = Slider(2.5, range=0..10)
series_2 = Series(Start=number_slider_3, Step=number_slider_3, Count=Slider(7, range=5..10))
offset_curve_3 = OffsetCurve(Curve=join_curves_2, Distance=expr("-x", series_2), Corners=1)

# ---- group: Reverse list order so that inner curve prints first
path_mapper = PathMapper(offset_curve_3, source="{0;0;A}(i)", target="{0;0; 7 - A}(i)")

# ----
brim_type = ValueList({"No Brim": 0, "Simple Brim": 1, "Brim with ears": 2}, selected="No Brim")

# ---- group: JOIN
join_curves_3 = JoinCurves(Curves=[contour_2, path_mapper], Preserve=False)  # -> flatten(Curves)

# ----
filter_2 = StreamFilter(Gate=brim_type, Stream1=offset_curve, Stream2=reverse_list)
merge = Merge(Data1=flatten(filter_2), Data2=move_to_point.Moved)

# ---- group: SEAM LOCATION
align_curve_seams = AlignCurveSeams(Curves=merge, Snap=Toggle(True), Iterative=True)  # -> Aligned, Points, ResultBoolean

# ----
seam_for_6a_e = Slider(180, range=0..1000)
number_slider_4 = Slider(3, range=0..10)
add_simple_ramps = BooleanToggle(False)
extend_curve = ExtendCurve(Curve=align_curve_seams.Aligned, Type=0, Start=expr("-x", number_slider_4), End=expr("-x", number_slider_4))
# AREA FOR TOOLPATH MANIPULATION
filter_3 = StreamFilter(Gate=add_simple_ramps, Stream0=align_curve_seams.Aligned, Stream1=extend_curve)
end = EndPoints(Curve=filter_3)  # -> Start, End
sort_by_z_height = BooleanToggle(True)
pdecon = Deconstruct(Point=end.Start)  # -> XComponent, YComponent, ZComponent
sort = SortList(Keys=pdecon.ZComponent, ValuesA=filter_3)  # -> Keys, ValuesA
filter_4 = StreamFilter(Gate=sort_by_z_height, Stream0=filter_3, Stream1=sort.ValuesA)

# ---- group: Curve Division
# SURFACE PATTERNS, WEAVING, TEXTURES, ATTRACTOR POINTS, ETC
number_slider_5 = Slider(0.01, range=0..0.01)
topoly = CurveToPolyline(Curve=filter_4, ToleranceDistance=number_slider_5, ToleranceAngle=0)  # -> Polyline, Segments
cp = ControlPoints(Curve=topoly.Polyline)  # -> simplify(Points), Weights, Knots

# ----
point_2 = Point(cp.Points)
panel_6 = Panel(point_2)

# ----
# Extrusion Ratio
# This value defines the relationship between the distance travelled and material extruded.
panel_7 = Panel(filter)

panel_8 = Panel("G91")
list_item_7 = ListItem(List=point_2, Index=0, Wrap=True)

# ---- group: G0 Move To first Point
item = ListItem(List=flatten(point_2), Index=0, Wrap=True)
deconstruct = Deconstruct(Point=flatten(item))  # -> expr("round(x,3)", XComponent), expr("round(x,3)", YComponent), expr("round(x,3)", ZComponent)
concatenate = Concatenate(
    Move_Type="G0",
    F=" F",
    Feed_Rate="1500",
    X=" X",
    X_VAL=deconstruct.XComponent,
    Y=" Y",
    Y_VAL=deconstruct.YComponent,
    Z=" Z",
    Z_VAL=deconstruct.ZComponent,
    E=" E",
    Extrusion_Val="0")

# ---- group: G1 Moves (printing)
deconstruct_2 = Deconstruct(Point=list_item_7)  # -> expr("round(x,3)", XComponent), expr("round(x,3)", YComponent), expr("round(x,3)", ZComponent)
concatenate_2 = Concatenate(Move_Type="G0", X=" X", X_VAL=deconstruct_2.XComponent, Y=" Y", Y_VAL=deconstruct_2.YComponent, F=" F30000")

# ----
panel_9 = Panel(concatenate_2)

# ---- group: Toolpath Visualisation
polyline = PolyLine(Vertices=point_2, Closed=False)  # -> flatten(Polyline)

# ----
lng = ListLength(List=polyline)
multiplication_3 = Multiplication(A=Slider(0.5613, range=0..1), B=lng)
round = Round(Number=multiplication_3)  # -> Nearest, Floor, Ceiling
split_list = SplitList(List=polyline, Index=round.Nearest)  # -> ListA, ListB

# ---- group: Toolpath Visualisation (continued)
custom_preview = CustomPreview(Geometry=split_list.ListA, Material=ColourSwatch(SwatchColor=RGB(255, 102, 158)))
custom_preview_2 = CustomPreview(Geometry=split_list.ListB, Material=ColourSwatch(SwatchColor=RGB(102, 245, 255)))

# ---- group: Extrusion Values
# Add Extrusion
polyline_2 = PolyLine(Vertices=point_2, Closed=False)
explode = Explode(Curve=polyline_2, Recursive=True)  # -> Segments, Vertices
length = Length(Curve=explode.Segments)
multiplication_4 = Multiplication(A=length, B=panel_7)
insert_items = InsertItems(List=multiplication_4, Item="0", Indices="0", Wrap=True)
num = Number(insert_items)

# ----
ma = MassAddition(Input=num)  # -> Result, PartialResults

# ---- group: Extrusion Values (continued)
expression = Expression(x=ma.PartialResults, Expression="round(x,3)")

# ----
trim = TrimTree(Tree=expression, Depth="2")
list_item_8 = ListItem(List=trim, Index=0, Wrap=True)

# ---- group: G1 Moves (printing)
deconstruct_3 = Deconstruct(Point=point_2)  # -> expr("round(x,3)", XComponent), expr("round(x,3)", YComponent), expr("round(x,3)", ZComponent)
concatenate_3 = Concatenate(
    Move_Type="G1",
    F=" F",
    Feed_Rate=adjusted_feed_rate,
    X=" X",
    X_VAL=deconstruct_3.XComponent,
    Y=" Y",
    Y_VAL=deconstruct_3.YComponent,
    Z=" Z",
    Z_VAL=deconstruct_3.ZComponent,
    E=" E",
    Extrusion_Val=trim)

# ----
# Make Gcode
start_code_from_printer_selection = Panel(dfl_3d_printer_selector._3dp_start_code_2)
end_code_from_printer_selection = Panel(dfl_3d_printer_selector._3dp_end_code_2)
replace = ReplaceItems(List=concatenate_3, Item=concatenate_2, Indices=0, Wrap=False)

# ---- group: Retract Lift
panel_10 = Panel("""G92 E0 
G1 E-0.8 F2400 ; retract 
G91 
G0 Z1 F7200 ; fast lift 
G90""")
ins = InsertItems(List=replace, Item=panel_10, Indices=0, Wrap=True)

# ---- group: Unretract + purge
panel_11 = Panel("""G91 
G0 Z-1 F7200 ; fast drop 
G90 
G92 E0 
G1 E0.6 F2400 ; prime (slightly less than retract to avoid blob) 
G92 E0""")
ins_2 = InsertItems(List=ins, Item=panel_11, Indices=5, Wrap=True)

# ----
lng_2 = ListLength(List=[panel_11, panel_10])
series_3 = Series(Start=0, Step=1, Count=expr("x+1", lng_2))
cull_i = CullIndex(List=flatten(ins_2), Indices=series_3, Wrap=True)
merge_2 = Merge(
    Data1=flatten(start_code_from_printer_selection),
    Data2=flatten(concatenate),
    Data3=flatten(cull_i),
    Data4=flatten(end_code_from_printer_selection))

# ---- group: Final Script
# BACKUP APPROACH
# 
# Copy and Paste the contents of this panel (Copy Data Only) into an empty text file. Change the file type to .gcode and load into the type of printer selected.
panel_12 = Panel(merge_2)

# ---- group: Save Multiline String to.gcode file
# Good starting point
# (default values)
# Layer Height: 0.6
# Initial Layer Height: 0.2
# Extruder Temp: 210
# Bed Temp: 60
# Fan Speed: 1
# Extrusion Ratio: 0.4
# Feed Rate: 1200
file_name = Panel("rb4")
path = FilePath("/Volumes/NO NAME/")
file_path = Panel(path)
save = Button()
optional_backup_dir = FilePath("/Users/z3528358/Desktop/")
dfl_3dp_settings_viewer = DFL3DPSettingsViewer(
    replace=layer_height,
    replace_2=initial_layer_height,
    replace_3=extruder_temp,
    replace_4=bed_temp,
    replace_5=fan_speed,
    replace_6=filter,
    replace_7=adjusted_feed_rate)
savegcode = DFLSaveAsGcode(name=file_name, lines=panel_12, directory=file_path, write=save)
errors_warnings = Panel(savegcode)
panel_13 = Panel(dfl_3dp_settings_viewer)

# ==== cluster DFL3DPrinterSelector

# ----
# bambu a1 default
bambu_a1_start_code = Panel("""; EXECUTABLE_BLOCK_START
M73 P0 R75
M201 X12000 Y12000 Z1500 E5000
M203 X500 Y500 Z30 E30
M204 P12000 R5000 T12000
M205 X9.00 Y9.00 Z3.00 E3.00 ; sets the jerk limits, mm/sec
; FEATURE: Custom
;===== machine: A1 =========================
;===== date: 20240620 =====================
G392 S0
M9833.2
;M400
;M73 P1.717

;===== start to heat heatbead&hotend==========
M1002 gcode_claim_action : 2
M1002 set_filament_type:PLA
M104 S140
M140 S65


;=====avoid end stop =================
G91
G380 S2 Z40 F1200
G380 S3 Z-15 F1200
G90

;===== reset machine status =================
;M290 X39 Y39 Z8
M204 S6000

M630 S0 P0
G91
M17 Z0.3 ; lower the z-motor current

G90
M17 X0.65 Y1.2 Z0.6 ; reset motor current to default
M960 S5 P1 ; turn on logo lamp
G90
M220 S100 ;Reset Feedrate
M221 S100 ;Reset Flowrate
M73.2   R1.0 ;Reset left time magnitude
;M211 X0 Y0 Z0 ; turn off soft endstop to prevent protential logic problem

;====== cog noise reduction=================
M982.2 S1 ; turn on cog noise reduction

M1002 gcode_claim_action : 13

G28 X
G91
G1 Z5 F1200
G90
G0 X128 F30000
G0 Y254 F3000
G91
G1 Z-5 F1200

M109 S25 H140

M17 E0.3
M83
G1 E10 F1200
G1 E-0.5 F30
M17 D

G28 Z P0 T140; home z with low precision,permit 300deg temperature
M104 S220

M1002 judge_flag build_plate_detect_flag
M622 S1
  G39.4
  G90
  G1 Z5 F1200
M623

;M400
;M73 P1.717

;===== prepare print temperature and material ==========
M1002 gcode_claim_action : 24

M400
;G392 S1
M211 X0 Y0 Z0 ;turn off soft endstop
M975 S1 ; turn on

G90
G1 X-28.5 F30000
G1 X-48.2 F3000

M620 M ;enable remap
M620 S0A   ; switch material if AMS exist
    M1002 gcode_claim_action : 4
    M400
    M1002 set_filament_type:UNKNOWN
    M109 S220
    M104 S250
    M400
    T0
    G1 X-48.2 F3000
    M400

    M620.1 E F523.843 T240
    M109 S250 ;set nozzle to common flush temp
    M106 P1 S0
    G92 E0
    G1 E50 F200
    M400
    M1002 set_filament_type:PLA
M621 S0A

M109 S240 H300
G92 E0
G1 E50 F200 ; lower extrusion speed to avoid clog
M400
M106 P1 S178
G92 E0
G1 E5 F200
M104 S220
G92 E0
G1 E-0.5 F300

G1 X-28.5 F30000
G1 X-48.2 F3000
G1 X-28.5 F30000 ;wipe and shake
G1 X-48.2 F3000
G1 X-28.5 F30000 ;wipe and shake
G1 X-48.2 F3000

;G392 S0

M400
M106 P1 S0
;===== prepare print temperature and material end =====

;M400
;M73 P1.717

;===== auto extrude cali start =========================
M975 S1
;G392 S1

G90
M83
T1000
G1 X-48.2 Y0 Z10 F10000
M400
M1002 set_filament_type:UNKNOWN

M412 S1 ;  ===turn on  filament runout detection===
M400 P10
M620.3 W1; === turn on filament tangle detection===
M400 S2

M1002 set_filament_type:PLA

;M1002 set_flag extrude_cali_flag=1
M1002 judge_flag extrude_cali_flag

M622 J1
    M1002 gcode_claim_action : 8

    M109 S220
    G1 E10 F466.248
M73 P0 R74
    M983 F7.7708 A0.3 H0.8; cali dynamic extrusion compensation

    M106 P1 S255
    M400 S5
    G1 X-28.5 F18000
M73 P1 R74
    G1 X-48.2 F3000
    G1 X-28.5 F18000 ;wipe and shake
    G1 X-48.2 F3000
    G1 X-28.5 F12000 ;wipe and shake
    G1 X-48.2 F3000
    M400
    M106 P1 S0

    M1002 judge_last_extrude_cali_success
    M622 J0
        M983 F7.7708 A0.3 H0.8; cali dynamic extrusion compensation
        M106 P1 S255
        M400 S5
        G1 X-28.5 F18000
        G1 X-48.2 F3000
        G1 X-28.5 F18000 ;wipe and shake
        G1 X-48.2 F3000
        G1 X-28.5 F12000 ;wipe and shake
        M400
        M106 P1 S0
    M623
    
    G1 X-48.2 F3000
    M400
    M984 A0.1 E1 S1 F7.7708 H0.8
    M106 P1 S178
    M400 S7
    G1 X-28.5 F18000
    G1 X-48.2 F3000
    G1 X-28.5 F18000 ;wipe and shake
    G1 X-48.2 F3000
    G1 X-28.5 F12000 ;wipe and shake
    G1 X-48.2 F3000
    M400
    M106 P1 S0
M623 ; end of "draw extrinsic para cali paint"

;G392 S0
;===== auto extrude cali end ========================

;M400
;M73 P1.717

M104 S170 ; prepare to wipe nozzle
M106 S255 ; turn on fan

;===== mech mode fast check start =====================
M1002 gcode_claim_action : 3

G1 X128 Y128 F20000
G1 Z5 F1200
M400 P200
M970.3 Q1 A5 K0 O3
M974 Q1 S2 P0

M970.2 Q1 K1 W58 Z0.1
M974 S2

G1 X128 Y128 F20000
G1 Z5 F1200
M400 P200
M970.3 Q0 A10 K0 O1
M974 Q0 S2 P0

M970.2 Q0 K1 W78 Z0.1
M974 S2

M975 S1
G1 F30000
G1 X0 Y5
G28 X ; re-home XY

G1 Z4 F1200

;===== mech mode fast check end =======================

;M400
;M73 P1.717

;===== wipe nozzle ===============================
M1002 gcode_claim_action : 14

M975 S1
M106 S255 ; turn on fan (G28 has turn off fan)
M211 S; push soft endstop status
M211 X0 Y0 Z0 ;turn off Z axis endstop

;===== remove waste by touching start =====

M104 S170 ; set temp down to heatbed acceptable

M83
G1 E-1 F500
M73 P7 R70
G90
M82 ; Extruder moves are absolute
G92 E0
M109 S{ExtruderTemp}
M190 S{BedTemp}
;===================== END START CODE =====================""")
bambu_a1_end_code = Panel(""";===================== START END CODE =====================

; don't support timelapse gcode in spiral_mode and by object sequence for I3 structure printer
M622.1 S1 ; for prev firware, default turned on
M1002 judge_flag timelapse_record_flag
M622 J1
G92 E0
G17
G2 Z90 I0.86 J0.86 P1 F20000 ; spiral lift a little
G1 Z90
G1 X0 Y128 F18000 ; move to safe pos
G1 X-48.2 F3000 ; move to safe pos
M400 P300
M971 S11 C11 O0
G92 E0
G1 X0 F18000
M623

M622.1 S1
M1002 judge_flag g39_3rd_layer_detect_flag
M622 J1
    ; enable nozzle clog detect at 3rd layer
    


    M622.1 S1
    M1002 judge_flag g39_detection_flag
    M622 J1
      
        M622.1 S0
        M1002 judge_flag g39_mass_exceed_flag
        M622 J1
        
            G392 S0
            M400
            G90
            M83
            M204 S5000
            G0 Z90 F4000
            G39.3 S1
            G0 Z90 F4000
            G392 S0
          
        M623
    
    M623
M623


; close powerlost recovery
M1003 S0
M106 S0
M981 S0 P20000 ; close spaghetti detector
; FEATURE: Custom
; filament end gcode 
M106 P3 S0
;===== date: 20231229 =====================
G392 S0 ;turn off nozzle clog detect

M400 ; wait for buffer to clear
G92 E0 ; zero the extruder
G1 E-0.8 F1800 ; retract
G1 Z90.1 F900 ; lower z a little
G1 X0 Y128 F18000 ; move to safe pos
G1 X-13.0 F3000 ; move to safe pos

M1002 judge_flag timelapse_record_flag
M622 J1
M400 P100
M971 S11 C11 O0
M400 P100
M971 S11 C11 O0
M400 P100
M971 S11 C11 O0
M400 P100
M971 S11 C11 O0
M400 P100
M971 S11 C11 O0
M400 P100
M971 S11 C11 O0
M400 P100
M971 S11 C11 O0
M400 P100
M971 S11 C11 O0
M400 P100
M971 S11 C11 O0
M400 P100
M971 S11 C11 O0
M400 P100
M971 S11 C11 O0
M400 P100
M971 S11 C11 O0
M400 P100
M971 S11 C11 O0
M400 P100
M971 S11 C11 O0
M400 P100
M971 S11 C11 O0
M400 P100
M971 S11 C11 O0
M400 P100
M971 S11 C11 O0
M400 P100
M971 S11 C11 O0
M400 P100
M971 S11 C11 O0
M400 P100
M971 S11 C11 O0
M400 P100
M971 S11 C11 O0
M400 P100
M971 S11 C11 O0
M400 P100
M971 S11 C11 O0
M400 P100
M971 S11 C11 O0
M400 P100
M971 S11 C11 O0
M400 P100
M971 S11 C11 O0
M400 P100
M971 S11 C11 O0
M400 P100
M971 S11 C11 O0
M400 P100
M971 S11 C11 O0
M400 P100
M971 S11 C11 O0
M991 S0 P-1 ;end timelapse at safe pos
M623


M140 S0 ; turn off bed
M106 S0 ; turn off fan
M106 P2 S0 ; turn off remote part cooling fan
M106 P3 S0 ; turn off chamber cooling fan

;G1 X27 F15000 ; wipe

; pull back filament to AMS
M620 S255
G1 X267 F15000
T255
G1 X-28.5 F18000
G1 X-48.2 F3000
G1 X-28.5 F18000
G1 X-48.2 F3000
M621 S255

M104 S0 ; turn off hotend

M400 ; wait all motion done
M17 S
M17 Z0.4 ; lower z motor current to reduce impact if there is something in the bottom

    G1 Z189.6 F600
    G1 Z187.6

M400 P100
M17 R ; restore z current

G90
G1 X-48 Y180 F3600
M73 P100 R0

M220 S100  ; Reset feedrate magnitude
M201.2 K1.0 ; Reset acc magnitude
M73.2   R1.0 ;Reset left time magnitude
M1002 set_gcode_claim_speed_level : 0

;=====printer finish  sound=========
M17
M400 S1
M1006 S1
M1006 A0 B20 L100 C37 D20 M40 E42 F20 N60
M1006 A0 B10 L100 C44 D10 M60 E44 F10 N60
M1006 A0 B10 L100 C46 D10 M80 E46 F10 N80
M1006 A44 B20 L100 C39 D20 M60 E48 F20 N60
M1006 A0 B10 L100 C44 D10 M60 E44 F10 N60
M1006 A0 B10 L100 C0 D10 M60 E0 F10 N60
M1006 A0 B10 L100 C39 D10 M60 E39 F10 N60
M1006 A0 B10 L100 C0 D10 M60 E0 F10 N60
M1006 A0 B10 L100 C44 D10 M60 E44 F10 N60
M1006 A0 B10 L100 C0 D10 M60 E0 F10 N60
M1006 A0 B10 L100 C39 D10 M60 E39 F10 N60
M1006 A0 B10 L100 C0 D10 M60 E0 F10 N60
M1006 A0 B10 L100 C48 D10 M60 E44 F10 N80
M1006 A0 B10 L100 C0 D10 M60 E0 F10  N80
M1006 A44 B20 L100 C49 D20 M80 E41 F20 N80
M1006 A0 B20 L100 C0 D20 M60 E0 F20 N80
M1006 A0 B20 L100 C37 D20 M30 E37 F20 N60
M1006 W
;=====printer finish  sound=========

;M17 X0.8 Y0.8 Z0.5 ; lower motor current to 45% power
M400
M18 X Y Z

M73 P100 R0
; EXECUTABLE_BLOCK_END

; filament used [mm] = 22083.96, 0.00, 0.00, 0.00, 0.00
; filament used [cm3] = 53.12, 0.00, 0.00, 0.00, 0.00
; filament used [g] = 66.93, 0.00, 0.00, 0.00, 0.00
; filament cost = 1.67, 0.00, 0.00, 0.00, 0.00""")

# ----
# bambu a1 fast
bambu_a1_start_code_2 = Panel("""; EXECUTABLE_BLOCK_START
M73 P0 R75
M201 X12000 Y12000 Z1500 E5000
M203 X500 Y500 Z30 E30
M204 P12000 R5000 T12000
M205 X9.00 Y9.00 Z3.00 E3.00 ; sets the jerk limits, mm/sec
; FEATURE: Custom
;===== machine: A1 =========================
;===== date: 20240620 =====================
G392 S0
M9833.2
;M400
;M73 P1.717

;===== start to heat heatbead&hotend==========
M1002 gcode_claim_action : 2
M1002 set_filament_type:PLA
M104 S140
M140 S65


;=====avoid end stop =================
G91
G380 S2 Z40 F1200
G380 S3 Z-15 F1200
G90

;===== reset machine status =================
;M290 X39 Y39 Z8
M204 S6000

M630 S0 P0
G91
M17 Z0.3 ; lower the z-motor current

G90
M17 X0.65 Y1.2 Z0.6 ; reset motor current to default
M960 S5 P1 ; turn on logo lamp
G90
M220 S100 ;Reset Feedrate
M221 S100 ;Reset Flowrate
M73.2   R1.0 ;Reset left time magnitude
;M211 X0 Y0 Z0 ; turn off soft endstop to prevent protential logic problem

;====== cog noise reduction=================
M982.2 S1 ; turn on cog noise reduction

M1002 gcode_claim_action : 13

G28 X
G91
G1 Z5 F1200
G90
G0 X128 F30000
G0 Y254 F3000
G91
G1 Z-5 F1200

M109 S25 H140

M17 E0.3
M83
G1 E10 F1200
G1 E-0.5 F30
M17 D

G28 Z P0 T140; home z with low precision,permit 300deg temperature
M104 S220

M1002 judge_flag build_plate_detect_flag
M622 S1
  G39.4
  G90
  G1 Z5 F1200
M623

;M400
;M73 P1.717

;===== prepare print temperature and material ==========
M1002 gcode_claim_action : 24

M400
;G392 S1
M211 X0 Y0 Z0 ;turn off soft endstop
M975 S1 ; turn on

G90
G1 X-28.5 F30000
G1 X-48.2 F3000

M620 M ;enable remap
M620 S0A   ; switch material if AMS exist
    M1002 gcode_claim_action : 4
    M400
    M1002 set_filament_type:UNKNOWN
    M109 S220
    M104 S250
    M400
    T0
    G1 X-48.2 F3000
    M400

    M620.1 E F523.843 T240
    M109 S250 ;set nozzle to common flush temp
    M106 P1 S0
    G92 E0
    G1 E50 F200
    M400
    M1002 set_filament_type:PLA
M621 S0A

M109 S240 H300
G92 E0
G1 E50 F200 ; lower extrusion speed to avoid clog
M400
M106 P1 S178
G92 E0
G1 E5 F200
M104 S220
G92 E0
G1 E-0.5 F300

G1 X-28.5 F30000
G1 X-48.2 F3000
G1 X-28.5 F30000 ;wipe and shake
G1 X-48.2 F3000
G1 X-28.5 F30000 ;wipe and shake
G1 X-48.2 F3000

;G392 S0

M400
M106 P1 S0
;===== prepare print temperature and material end =====

;M400
;M73 P1.717

;===== auto extrude cali start =========================
M975 S1
;G392 S1

G90
M83
T1000
G1 X-48.2 Y0 Z10 F10000
M400
M1002 set_filament_type:UNKNOWN

M412 S1 ;  ===turn on  filament runout detection===
M400 P10
M620.3 W1; === turn on filament tangle detection===
M400 S2

M1002 set_filament_type:PLA

;M1002 set_flag extrude_cali_flag=1
M1002 judge_flag extrude_cali_flag

M622 J1
    M1002 gcode_claim_action : 8

    M109 S220
    G1 E10 F466.248
M73 P0 R74
    M983 F7.7708 A0.3 H0.8; cali dynamic extrusion compensation

    M106 P1 S255
    M400 S5
    G1 X-28.5 F18000
M73 P1 R74
    G1 X-48.2 F3000
    G1 X-28.5 F18000 ;wipe and shake
    G1 X-48.2 F3000
    G1 X-28.5 F12000 ;wipe and shake
    G1 X-48.2 F3000
    M400
    M106 P1 S0

    M1002 judge_last_extrude_cali_success
    M622 J0
        M983 F7.7708 A0.3 H0.8; cali dynamic extrusion compensation
        M106 P1 S255
        M400 S5
        G1 X-28.5 F18000
        G1 X-48.2 F3000
        G1 X-28.5 F18000 ;wipe and shake
        G1 X-48.2 F3000
        G1 X-28.5 F12000 ;wipe and shake
        M400
        M106 P1 S0
    M623
    
    G1 X-48.2 F3000
    M400
    M984 A0.1 E1 S1 F7.7708 H0.8
    M106 P1 S178
    M400 S7
    G1 X-28.5 F18000
    G1 X-48.2 F3000
    G1 X-28.5 F18000 ;wipe and shake
    G1 X-48.2 F3000
    G1 X-28.5 F12000 ;wipe and shake
    G1 X-48.2 F3000
    M400
    M106 P1 S0
M623 ; end of "draw extrinsic para cali paint"

;G392 S0
;===== auto extrude cali end ========================

;M400
;M73 P1.717

M104 S170 ; prepare to wipe nozzle
M106 S255 ; turn on fan

;===== mech mode fast check start =====================
M1002 gcode_claim_action : 3

G1 X128 Y128 F20000
G1 Z5 F1200
M400 P200
M970.3 Q1 A5 K0 O3
M974 Q1 S2 P0

M970.2 Q1 K1 W58 Z0.1
M974 S2

G1 X128 Y128 F20000
G1 Z5 F1200
M400 P200
M970.3 Q0 A10 K0 O1
M974 Q0 S2 P0

M970.2 Q0 K1 W78 Z0.1
M974 S2

M975 S1
G1 F30000
G1 X0 Y5
G28 X ; re-home XY

G1 Z4 F1200

;===== mech mode fast check end =======================

;M400
;M73 P1.717

;===== wipe nozzle ===============================
M1002 gcode_claim_action : 14

M975 S1
M106 S255 ; turn on fan (G28 has turn off fan)
M211 S; push soft endstop status
M211 X0 Y0 Z0 ;turn off Z axis endstop

;===== remove waste by touching start =====

M104 S170 ; set temp down to heatbed acceptable

M83
G1 E-1 F500
M73 P7 R70
G90
M82 ; Extruder moves are absolute
G92 E0
M109 S{ExtruderTemp}
M190 S{BedTemp}
;===================== END START CODE =====================""")
bambu_a1_end_code_2 = Panel(""";===================== START END CODE =====================

; don't support timelapse gcode in spiral_mode and by object sequence for I3 structure printer
M622.1 S1 ; for prev firware, default turned on
M1002 judge_flag timelapse_record_flag
M622 J1
G92 E0
G17
G2 Z90 I0.86 J0.86 P1 F20000 ; spiral lift a little
G1 Z90
G1 X0 Y128 F18000 ; move to safe pos
G1 X-48.2 F3000 ; move to safe pos
M400 P300
M971 S11 C11 O0
G92 E0
G1 X0 F18000
M623

M622.1 S1
M1002 judge_flag g39_3rd_layer_detect_flag
M622 J1
    ; enable nozzle clog detect at 3rd layer
    


    M622.1 S1
    M1002 judge_flag g39_detection_flag
    M622 J1
      
        M622.1 S0
        M1002 judge_flag g39_mass_exceed_flag
        M622 J1
        
            G392 S0
            M400
            G90
            M83
            M204 S5000
            G0 Z90 F4000
            G39.3 S1
            G0 Z90 F4000
            G392 S0
          
        M623
    
    M623
M623


; close powerlost recovery
M1003 S0
M106 S0
M981 S0 P20000 ; close spaghetti detector
; FEATURE: Custom
; filament end gcode 
M106 P3 S0
;===== date: 20231229 =====================
G392 S0 ;turn off nozzle clog detect

M400 ; wait for buffer to clear
G92 E0 ; zero the extruder
G1 E-0.8 F1800 ; retract
G1 Z90.1 F900 ; lower z a little
G1 X0 Y128 F18000 ; move to safe pos
G1 X-13.0 F3000 ; move to safe pos

M1002 judge_flag timelapse_record_flag
M622 J1
M400 P100
M971 S11 C11 O0
M400 P100
M971 S11 C11 O0
M400 P100
M971 S11 C11 O0
M400 P100
M971 S11 C11 O0
M400 P100
M971 S11 C11 O0
M400 P100
M971 S11 C11 O0
M400 P100
M971 S11 C11 O0
M400 P100
M971 S11 C11 O0
M400 P100
M971 S11 C11 O0
M400 P100
M971 S11 C11 O0
M400 P100
M971 S11 C11 O0
M400 P100
M971 S11 C11 O0
M400 P100
M971 S11 C11 O0
M400 P100
M971 S11 C11 O0
M400 P100
M971 S11 C11 O0
M400 P100
M971 S11 C11 O0
M400 P100
M971 S11 C11 O0
M400 P100
M971 S11 C11 O0
M400 P100
M971 S11 C11 O0
M400 P100
M971 S11 C11 O0
M400 P100
M971 S11 C11 O0
M400 P100
M971 S11 C11 O0
M400 P100
M971 S11 C11 O0
M400 P100
M971 S11 C11 O0
M400 P100
M971 S11 C11 O0
M400 P100
M971 S11 C11 O0
M400 P100
M971 S11 C11 O0
M400 P100
M971 S11 C11 O0
M400 P100
M971 S11 C11 O0
M400 P100
M971 S11 C11 O0
M991 S0 P-1 ;end timelapse at safe pos
M623


M140 S0 ; turn off bed
M106 S0 ; turn off fan
M106 P2 S0 ; turn off remote part cooling fan
M106 P3 S0 ; turn off chamber cooling fan

;G1 X27 F15000 ; wipe

; pull back filament to AMS
M620 S255
G1 X267 F15000
T255
G1 X-28.5 F18000
G1 X-48.2 F3000
G1 X-28.5 F18000
G1 X-48.2 F3000
M621 S255

M104 S0 ; turn off hotend

M400 ; wait all motion done
M17 S
M17 Z0.4 ; lower z motor current to reduce impact if there is something in the bottom

    G1 Z189.6 F600
    G1 Z187.6

M400 P100
M17 R ; restore z current

G90
G1 X-48 Y180 F3600
M73 P100 R0

M220 S100  ; Reset feedrate magnitude
M201.2 K1.0 ; Reset acc magnitude
M73.2   R1.0 ;Reset left time magnitude
M1002 set_gcode_claim_speed_level : 0

;=====printer finish  sound=========
M17
M400 S1
M1006 S1
M1006 A0 B20 L100 C37 D20 M40 E42 F20 N60
M1006 A0 B10 L100 C44 D10 M60 E44 F10 N60
M1006 A0 B10 L100 C46 D10 M80 E46 F10 N80
M1006 A44 B20 L100 C39 D20 M60 E48 F20 N60
M1006 A0 B10 L100 C44 D10 M60 E44 F10 N60
M1006 A0 B10 L100 C0 D10 M60 E0 F10 N60
M1006 A0 B10 L100 C39 D10 M60 E39 F10 N60
M1006 A0 B10 L100 C0 D10 M60 E0 F10 N60
M1006 A0 B10 L100 C44 D10 M60 E44 F10 N60
M1006 A0 B10 L100 C0 D10 M60 E0 F10 N60
M1006 A0 B10 L100 C39 D10 M60 E39 F10 N60
M1006 A0 B10 L100 C0 D10 M60 E0 F10 N60
M1006 A0 B10 L100 C48 D10 M60 E44 F10 N80
M1006 A0 B10 L100 C0 D10 M60 E0 F10  N80
M1006 A44 B20 L100 C49 D20 M80 E41 F20 N80
M1006 A0 B20 L100 C0 D20 M60 E0 F20 N80
M1006 A0 B20 L100 C37 D20 M30 E37 F20 N60
M1006 W
;=====printer finish  sound=========

;M17 X0.8 Y0.8 Z0.5 ; lower motor current to 45% power
M400
M18 X Y Z

M73 P100 R0
; EXECUTABLE_BLOCK_END

; filament used [mm] = 22083.96, 0.00, 0.00, 0.00, 0.00
; filament used [cm3] = 53.12, 0.00, 0.00, 0.00, 0.00
; filament used [g] = 66.93, 0.00, 0.00, 0.00, 0.00
; filament cost = 1.67, 0.00, 0.00, 0.00, 0.00""")

merge = Merge(Data1=bambu_a1_start_code_2, Data2=bambu_a1_end_code_2)  # -> graft(Result)
merge_2 = Merge(Data1=bambu_a1_start_code, Data2=bambu_a1_end_code)  # -> graft(Result)
xy = XYPlane(Origin=Point(0, 0, 0))
printer_type = ClusterInput()
layer_height = ClusterInput()
rectangle = Rectangle(Plane=xy, XSize="240", YSize="240", Radius=0)  # -> Rectangle, Length
printer_type_2 = Data(printer_type)
srf = Surface(rectangle.Rectangle)
layer_height_2 = Data(layer_height)
filter = StreamFilter(Gate=printer_type, Stream0=merge_2, Stream1=merge)
unit_z = UnitZ(Factor=layer_height_2)
area = Area(Geometry=srf)  # -> Area, Centroid
move = Move(Geometry=area.Centroid, Motion=unit_z)  # -> Geometry, Transform
extruder_temp = ClusterInput()
fan_speed = ClusterInput()
bed_temp = ClusterInput()
multiplication = Multiplication(A=255, B=fan_speed)
rep = ReplaceText(Text=filter, Find="{BedTemp}", Replace=bed_temp, RecursiveReplace=False)
round = Round(Number=multiplication)  # -> Nearest, Floor, Ceiling
rep_2 = ReplaceText(Text=rep, Find="{ExtruderTemp}", Replace=extruder_temp, RecursiveReplace=False)
bambu_max_feed_rate = Panel("1200")
default_extrusion_ratio = Panel("0.4")
rep_3 = ReplaceText(Text=rep_2, Find="{FanSpeed}", Replace=round.Nearest, RecursiveReplace=False)
bambu_max_feed_rate_2 = ClusterOutput(bambu_max_feed_rate)
default_extrusion_ratio_2 = ClusterOutput(default_extrusion_ratio)
geometry = ClusterOutput(move.Geometry)
srf_2 = ClusterOutput(srf)
item = ListItem(List=flatten(rep_3), Index=0, Wrap=True)  # -> Item, Item1
panel = Panel(item.Item1)
panel_2 = Panel(item.Item)
_3dp_end_code = Data(panel)
_3dp_start_code = Data(panel_2)
_3dp_start_code_2 = ClusterOutput(_3dp_start_code)
_3dp_end_code_2 = ClusterOutput(_3dp_end_code)

# ==== cluster DFLSaveAsGcode: Quckly Save Multi line Data to G code, set a backup directory to save incremented versions of your code
name = ClusterInput()
lines = ClusterInput()
backup_directory = ClusterInput()
directory = ClusterInput()
write = ClusterInput()
txt = Text("gcode")
txt_2 = Text(lines)
txt_3 = Text(name)
bool = Boolean(write)
path = FilePath(directory)
savepanel = PanelSaver(name=txt_3, ext=txt, directory=path, lines=txt_2, write=bool, overwrite=Toggle(True))  # -> error_msg; inputs lines: list, write: Boolean
# ---------- savepanel: Python ----------
import os
import sys
import Grasshopper as gh
import System.IO
import System.Text

# Outputs
error_msg = None  # New output for error reporting

# Set component metadata
if 'ghenv' in globals():
    ghenv.Component.Name = "Panel Saver"
    ghenv.Component.Description = "Saves text content from Grasshopper panels to a file."
    ghenv.Component.Message = "Ready to save"
    ghenv.Component.NickName = "SavePanel"

# Set tooltips (hover messages) for each input parameter
if 'ghenv' in globals():
    input_tooltips = {
        "directory": "The folder path where the file will be saved.",
        "name": "The base name of the output file, without extension.",
        "ext": "The file extension (e.g., .txt, .csv, .md).",
        "lines": "A list of text lines to write to the file.",
        "write": "Boolean (True/False) – Enable to write the file.",
        "overwrite": "Boolean (True/False) – If False, appends a number if file already exists."
    }
    
    for param in ghenv.Component.Params.Input:
        if param.Name in input_tooltips:
            param.Description = input_tooltips[param.Name]

# Ensure text encoding compatibility for IronPython 2.7
if sys.version_info[0] < 3:
    reload(sys)
    sys.setdefaultencoding("utf-8")

# **Check if the directory is valid first** (show error immediately if it's invalid)
if not os.path.isdir(directory):
    error_msg = "Invalid directory: " + str(directory)
    ghenv.Component.AddRuntimeMessage(gh.Kernel.GH_RuntimeMessageLevel.Error, error_msg)
    a = None

# **Only proceed with the 'write' check if the directory exists**
elif not write:
    error_msg = "Set 'write' to True to save the file."
    ghenv.Component.AddRuntimeMessage(gh.Kernel.GH_RuntimeMessageLevel.Warning, error_msg)
    a = None

else:
    # Ensure extension starts with "."
    if not ext.startswith("."):
        ext = "." + ext

    # Generate initial file path
    file_path = os.path.join(directory, name + ext)

    # Handle file existence based on the 'overwrite' option
    if os.path.exists(file_path) and not overwrite:
        count = 1
        while os.path.exists(file_path):
            file_path = os.path.join(directory, name + "-" + str(count) + ext)
            count += 1

    # Write content to file using System.IO.StreamWriter for UTF-8 compatibility
    try:
        writer = System.IO.StreamWriter(file_path, False, System.Text.Encoding.UTF8)
        for line in lines:
            writer.WriteLine(line)
        writer.Close()
        a = "File saved: " + str(file_path)
    except Exception as e:
        error_msg = "Error saving file: " + str(e)
        ghenv.Component.AddRuntimeMessage(gh.Kernel.GH_RuntimeMessageLevel.Error, error_msg)
        a = None
# ---------- end savepanel ----------
savepanel_2 = PanelSaver(name=txt_3, ext=txt, directory=backup_directory, lines=txt_2, write=bool, overwrite=Toggle(False))  # -> error_msg; inputs lines: list, write: Boolean
# ---------- savepanel_2: Python ----------
import os
import sys
import codecs
import Grasshopper as gh

# Outputs
error_msg = None  # New output for error reporting

# Set component metadata
if 'ghenv' in globals():
    ghenv.Component.Name = "Panel Saver"
    ghenv.Component.Description = "Saves text content from Grasshopper panels to a file."
    ghenv.Component.Message = "Ready to save"
    ghenv.Component.NickName = "SavePanel"

# Set tooltips (hover messages) for each input parameter
if 'ghenv' in globals():
    input_tooltips = {
        "directory": "The folder path where the file will be saved.",
        "name": "The base name of the output file, without extension.",
        "ext": "The file extension (e.g., .txt, .csv, .md).",
        "lines": "A list of text lines to write to the file.",
        "write": "Boolean (True/False) – Enable to write the file.",
        "overwrite": "Boolean (True/False) – If False, appends a number if file already exists."
    }
    
    for param in ghenv.Component.Params.Input:
        if param.Name in input_tooltips:
            param.Description = input_tooltips[param.Name]

# Ensure text encoding compatibility for IronPython 2.7
if sys.version_info[0] < 3:
    reload(sys)
    sys.setdefaultencoding("utf-8")

# **Check if the directory is valid first** (show error immediately if it's invalid)
if not os.path.isdir(directory):
    error_msg = "Invalid directory: " + str(directory)
    ghenv.Component.AddRuntimeMessage(gh.Kernel.GH_RuntimeMessageLevel.Error, error_msg)
    a = None

# **Only proceed with the 'write' check if the directory exists**
elif not write:
    error_msg = "Set 'write' to True to save the file."
    ghenv.Component.AddRuntimeMessage(gh.Kernel.GH_RuntimeMessageLevel.Warning, error_msg)
    a = None

else:
    # Ensure extension starts with "."
    if not ext.startswith("."):
        ext = "." + ext

    # Generate initial file path
    file_path = os.path.join(directory, name + ext)

    # Handle file existence based on the 'overwrite' option
    if os.path.exists(file_path) and not overwrite:
        count = 1
        while os.path.exists(file_path):
            file_path = os.path.join(directory, name + "-" + str(count) + ext)
            count += 1

    # Write content to file (Using codecs.open for UTF-8 compatibility in IronPython)
    try:
        with codecs.open(file_path, "w", "utf-8") as f:
            for line in lines:
                f.write(line + "\n")
        a = "File saved: " + str(file_path)
    except Exception as e:
        error_msg = "Error saving file: " + str(e)
        ghenv.Component.AddRuntimeMessage(gh.Kernel.GH_RuntimeMessageLevel.Error, error_msg)
        a = None
# ---------- end savepanel_2 ----------
error_msg = ClusterOutput(savepanel)

# ==== cluster DFL3DPSettingsViewer: Outputs print settings in string format
panel = Panel("""Layer Height: layerHeight
Initial Layer Height: initialLayerHeight
Extruder Temp: extruderTemp
Bed Temp: bedTemp
Fan Speed: fanSpeed
Extrusion Ratio: extrusionRatio
Feed Rate: feedRate""")
replace = ClusterInput()
replace_text = ReplaceText(Text=panel, Find="layerHeight", Replace=replace, RecursiveReplace=False)
replace_2 = ClusterInput()
replace_text_2 = ReplaceText(Text=replace_text, Find="initialLayerHeight", Replace=replace_2, RecursiveReplace=False)
replace_3 = ClusterInput()
replace_text_3 = ReplaceText(Text=replace_text_2, Find="extruderTemp", Replace=replace_3, RecursiveReplace=False)
replace_4 = ClusterInput()
replace_text_4 = ReplaceText(Text=replace_text_3, Find="bedTemp", Replace=replace_4, RecursiveReplace=False)
replace_5 = ClusterInput()
replace_text_5 = ReplaceText(Text=replace_text_4, Find="fanSpeed", Replace=replace_5, RecursiveReplace=False)
replace_6 = ClusterInput()
replace_text_6 = ReplaceText(Text=replace_text_5, Find="extrusionRatio", Replace=replace_6, RecursiveReplace=False)
replace_7 = ClusterInput()
replace_text_7 = ReplaceText(Text=replace_text_6, Find="feedRate", Replace=replace_7, RecursiveReplace=False)
result = ClusterOutput(replace_text_7)
