# Grasshopper definition DFL_3DP_DEV_T2_2026.gh (Grasshopper 1.0.8)
# plug-ins: Pufferfish, KUKA|prc - parametric robot control

# ----
# Bead Control
retraction_movement_tolerance_mm = Panel("1")
nozzle_selection = ValueList({"1.5mm": 1, "3mm": 2, "5mm": 3}, selected="1.5mm")
bead_width = ValueList({"thin": 2, "medium": 3, "wide": 4}, selected="medium")
flat_speed_based_on_shortest_layer = BooleanToggle(False)
layer_time_s = Panel("40")
multiplication = Multiplication(A=nozzle_selection, B=bead_width)
bead_width_2 = Panel(multiplication)
layer_height = Panel(nozzle_selection)

brep = Brep(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)

# ----
# Weave Settings
weave_density_point_count = Slider(40, range=0..100)
weave_depth = Slider(2, range=0..10)
panel = Panel("""0
1""")
weave_flip_control = Panel("""0
0
1""")
weave_application_pattern = Panel("1")

# ----
# Basic Print Details
contouring_type = ValueList({"Waterline": 0, "45 Degree": 1}, selected="Waterline")
print_sequence = ValueList({"Per Object": 0, "Per Layer": 1}, selected="Per Object")
brep_or_mesh = Geometry(brep)
cluster = Cluster_10(gate=contouring_type)

# ----
# Polyline Settings
distance_tolerance = Slider(0.12, range=0..1)
angle_tolerance = Slider(30, range=0..100)

weave_depth_2 = Slider(2, range=0..10)

# ----
# Seam
snap_seam_to_corners = BooleanToggle(False)
set_seam_iteratively = BooleanToggle(True)
align_seam = BooleanToggle(True)
alignment_point = Point(Point(-14, -125, 0))

# ---- group: Contouring
# CONTOURING
layer_width = Number(bead_width_2)
slice_direction = Vector(cluster)
layer_height_2 = Number(layer_height)
contouring = Contouring(
    polyline_tolerance=distance_tolerance,
    angle_tolerance=degrees(angle_tolerance),
    brep_or_mesh_single_or_multiple=brep_or_mesh,
    layer_height=layer_height_2,
    layer_width=layer_width,
    print_sequence=print_sequence,
    contour_direction=slice_direction,
    align_seam=align_seam,
    seam_alignment_point=alignment_point,
    snap_seam=snap_seam_to_corners,
    iterative_seam=set_seam_iteratively,
    weave_outer_depth=weave_depth,
    weave_inner_depth=weave_depth_2,
    weave_density_point_count=weave_density_point_count,
    weave_application_pattern=weave_application_pattern,
    weave_flip_control=weave_flip_control,
    weave_pattern=panel)  # -> polyline_2, spiral_2, weave_3, status_messages

# ---- group: TOOLPATH PART 1
crv = Curve(Tree({0;0}: [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], {0;1}: [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], {0;2}: [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], {0;3}: [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], {1;0}: [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], {1;1}: [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]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))

# ----
panel_2 = Panel(contouring.status_messages)
curve_to_polyline = CurveToPolyline(Curve=crv, ToleranceDistance=Slider(0.01, range=0..0.01), ToleranceAngle=0)  # -> Polyline, Segments

# ---- group: Basic Lead In
# LEADS
contours = Curve(contouring.polyline_2)
lead_in_distance = Slider(20, range=0..1000)
flip_lead_direction = BooleanToggle(False)
method = ValueList({"Lead In": 0, "Brim": 1}, selected="Lead In")
dfl_lead = DFLLead(
    adhesion_method=method,
    no_of_geos=brep_or_mesh,
    order=print_sequence,
    flip_lead_in_direction=flip_lead_direction,
    lead_in_distance=lead_in_distance,
    data=contours,
    bead_width=bead_width_2,
    no_of_loops=Slider(5, range=0..10))

# ----
panel_3 = Panel(crv)

# ----
# BED ORIENT / FIRST LAYER
panel_4 = Panel("1000 to -1000")
point = Point(Point(0, 0, 0))
rectangle = Rectangle(Plane=point, XSize=panel_4, YSize=panel_4, Radius=0)  # -> Rectangle, Length
surface = Surface(rectangle.Rectangle)
unit_z = UnitZ(FirstLayerHeight=layer_height)
cluster_2 = Cluster_5(bed_surface_mesh=surface, path=dfl_lead)
move = Move(Geometry=cluster_2, Motion=unit_z)  # -> Geometry, Transform

# ---- group: Base Contours
# POINTS
explode = Explode(Curve=move.Geometry, Recursive=True)  # -> Segments, Vertices
trim_tree = TrimTree(Tree=explode.Vertices, Depth=1)

# ---- group: Layer Speed
layers = Data(move.Geometry)
print_sequence_2 = Data(print_sequence)
layer_time = Data(layer_time_s)
cluster_3 = Cluster_6(
    print_sequence=print_sequence_2,
    layers=layers,
    layer_time=layer_time,
    print_sequence_2=print_sequence_2,
    layers_2=layers,
    layer_time_2=layer_time)  # -> data, layer_speed_4, relay, s_0, layer_speed_2, relay_2

# ---- group: Compare End Points of Subsequent Layers
tree_statistics = TreeStatistics(Tree=trim_tree)  # -> Paths, Length, Count
# This section takes the list of contour points, duplicates it once, and removes the first and last layer from each respective copy.
# 
# With these copies, each set of end and following start points can be compared with no issues relating to list wrapping (This is so the first and last point of the entire print are not considered)
# 
# The purpose is for finding the layer transfer movement lenght to determine whether a reatract movement is required. The tolerance for this distance can be chosen in retraction movment tolerance.
panel_5 = Panel("0")
list_item = ListItem(List=tree_statistics.Paths, Index="-1", Wrap=True)
list_item_2 = ListItem(List=tree_statistics.Paths, Index=panel_5, Wrap=True)
split_tree = SplitTree(Data=trim_tree, Masks=flatten(list_item))  # -> Positive, Negative
split_tree_2 = SplitTree(Data=trim_tree, Masks=flatten(list_item_2))  # -> Positive, Negative
list_item_3 = ListItem(List=split_tree_2.Negative, Index="0", Wrap=True)
list_item_4 = ListItem(List=split_tree.Negative, Index="-1", Wrap=True)

# ---- group: Set to flat machine speed
boolean = Boolean(flat_speed_based_on_shortest_layer)

# ----
# Speed + Extrusion
_1_5mm_nozzle = Panel("1200")
_3mm_nozzle = Panel("2400")
stream_filter = StreamFilter(Gate=nozzle_selection, Stream0=_1_5mm_nozzle, Stream1=_3mm_nozzle, Stream2=_3mm_nozzle)
layer_height_3 = Data(layer_height)
layer_width_2 = Data(bead_width_2)
cluster_4 = Cluster_8(
    item=layer_height_3,
    max_speed=stream_filter,
    layer_speed=cluster_3.layer_speed_2,
    flat_speed=boolean,
    item_2=layer_width_2)  # -> result, layer_extrusion_rate

panel_6 = Panel(cluster_4.layer_extrusion_rate)
panel_7 = Panel(cluster_4.result)

# ---- group: Transfer Movement Distance calculation
# RETRACTION
line = Line(StartPoint=list_item_4, EndPoint=list_item_3)
length = Length(Curve=line)
multiplication_2 = Multiplication(A=bead_width_2, B=Slider(1, range=0..10))
larger_than = LargerThan(FirstNumber=length, SecondNumber=multiplication_2)  # -> LargerThan, OrEqualTo
cull_pattern = CullPattern(List=line, CullPattern=larger_than.LargerThan)
tree_statistics_2 = TreeStatistics(Tree=cull_pattern)  # -> Paths, Length, Count
cull_pattern_2 = CullPattern(List=tree_statistics_2.Paths, CullPattern=tree_statistics_2.Length)
split_tree_3 = SplitTree(Data=cull_pattern, Masks=flatten(cull_pattern_2))  # -> Positive, Negative

# ----
layer_speed = Data(cluster_3.layer_speed_2)
panel_8 = Panel(layer_speed)
round = Round(Number=panel_6)  # -> Nearest, Floor, Ceiling
panel_9 = Panel(round.Nearest)
minimum = Minimum(A=panel_9, B="0")
replace_text = ReplaceText(Text="MDPE_Forward(x)", Find="x", Replace=panel_9, RecursiveReplace=False)
list_item_5 = ListItem(List=replace_text, Index=0, Wrap=True)

# ---- group: Add branch for calcuated retract movements
path_mapper = PathMapper(split_tree_3.Positive, source="{A;B}(i)", target="{A;B;i}")

# ---- group: Retract Operation
entry_height = Slider(5, range=0..10)
wipe_distance = Slider(10, range=0..100)
exit_height = Slider(10, range=0..100)
cluster_5 = Cluster_9(
    curve=path_mapper,
    data_2=move.Geometry,
    factor=entry_height,
    value=wipe_distance,
    data=trim_tree,
    factor_2=exit_height,
    second_number=multiplication_2)

# ----
merge = Merge(Data1=trim_tree, Data2=cluster_5)

tree_statistics_3 = TreeStatistics(Tree=move.Geometry)  # -> Paths, Length, Count
split_tree_4 = SplitTree(Data=merge, Masks=flatten(tree_statistics_3.Paths))  # -> Positive, Negative
curve = Curve(line)
boolean_2 = Boolean(larger_than.LargerThan)
polyline = PolyLine(Vertices=split_tree_4.Negative, Closed=False)
polyline_2 = PolyLine(Vertices=split_tree_4.Positive, Closed=False)
colour_swatch = ColourSwatch(SwatchColor=RGB(0, 221, 255))
cull_pattern_3 = CullPattern(List=curve, CullPattern=invert(boolean_2))
custom_preview = CustomPreview(Geometry=polyline, Material=ColourSwatch(SwatchColor=RGB(255, 0, 0)))
custom_preview_2 = CustomPreview(Geometry=polyline_2, Material=colour_swatch)
custom_preview_3 = CustomPreview(Geometry=cull_pattern_3, Material=colour_swatch)

plane_orientation = PlaneOrientation(relay=merge)
unit_x = UnitX(Factor=1)
rotate_3d = Rotate3D(Geometry=plane_orientation, Angle=degrees(Slider(25, range=-90..90)), Center=plane_orientation, Axis=unit_x)  # -> Geometry, Transform
contouring_type_boolean = Boolean(contouring_type)
stream_filter_2 = StreamFilter(Gate=contouring_type_boolean, Stream0=plane_orientation, Stream1=rotate_3d.Geometry)
round_to_decimal_place = RoundToDecimalPlace(NumberX=panel_7, DecimalPlace=Slider(5, range=0..10), RoundType=0)  # -> Rounded, Difference
clean_tree = CleanTree(RemoveNulls=True, RemoveInvalid=True, RemoveEmpty=True, Tree=stream_filter_2)
tree_statistics_4 = TreeStatistics(Tree=clean_tree)  # -> Paths, Length, Count
deconstruct_path = DeconstructPath(Branch=tree_statistics_4.Paths)  # -> simplify(Indices)
list_length = ListLength(List=deconstruct_path)
larger_than_2 = LargerThan(FirstNumber=flatten(list_length), SecondNumber="2")  # -> LargerThan, OrEqualTo
dispatch = Dispatch(List=tree_statistics_4.Paths, DispatchPattern=larger_than_2.LargerThan)  # -> ListA, ListB
split_tree_5 = SplitTree(Data=clean_tree, Masks=flatten(dispatch.ListA))  # -> Positive, Negative
krl_code_kuka_prc = KRLCodeKUKAPrc(KRLAsText=list_item_5)
trim_tree_2 = TrimTree(Tree=split_tree_5.Positive, Depth=1)
tree_statistics_5 = TreeStatistics(Tree=trim_tree_2)  # -> Paths, Length, Count
split_tree_6 = SplitTree(Data=krl_code_kuka_prc, Masks=flatten(tree_statistics_5.Paths))  # -> Positive, Negative
linear_movement_kuka_prc = LINearMovementKUKAPrc(TargetAsPlane=split_tree_5.Positive, Speed="0.2", extaxenabled=False, interpolation="C_DIS")
krl_code_kuka_prc_2 = KRLCodeKUKAPrc(KRLAsText="MDPE_OFF()")
tree_statistics_6 = TreeStatistics(Tree=krl_code_kuka_prc)  # -> Paths, Length, Count
panel_10 = Panel(round_to_decimal_place.Rounded)
list_item_6 = ListItem(List=tree_statistics_6.Paths, Index=0, Wrap=True)
weave = Weave(Pattern=[0, 1], Stream0=krl_code_kuka_prc_2, Stream1=linear_movement_kuka_prc, NullGaps=False)
linear_movement_kuka_prc_2 = LINearMovementKUKAPrc(TargetAsPlane=split_tree_5.Negative, Speed=round_to_decimal_place.Rounded, extaxenabled=False, interpolation="C_DIS")
split_tree_7 = SplitTree(Data=krl_code_kuka_prc, Masks=flatten(list_item_6))  # -> Positive, Negative

# ---- group: Set to flat machine speed
boolean_3 = Boolean(flat_speed_based_on_shortest_layer)

# ----
path_mapper_2 = PathMapper(split_tree_6.Positive, source="{A;B}(i)", target="{A;B;i}")
stream_filter_3 = StreamFilter(Gate=boolean_3, Stream0=krl_code_kuka_prc, Stream1=split_tree_7.Positive)
merge_2 = Merge(Data1=weave, Data2=path_mapper_2)

# ---- group: Set to flat machine speed
boolean_4 = Boolean(flat_speed_based_on_shortest_layer)

# ----
merge_3 = Merge(Data1=stream_filter_3, Data2=linear_movement_kuka_prc_2)
stream_filter_4 = StreamFilter(Gate=boolean_4, Stream0=weave, Stream1=merge_2)
merge_4 = Merge(Data1=merge_3, Data2=stream_filter_4)
list_item_7 = ListItem(List=flatten(split_tree_5.Negative), Index=0, Wrap=True)
unit_z_2 = UnitZ(Factor=Slider(50, range=0..100))
list_item_8 = ListItem(List=flatten(split_tree_5.Negative), Index=0, Wrap=True)  # -> Item1, Item
clean_tree_2 = CleanTree(RemoveNulls=True, RemoveInvalid=True, RemoveEmpty=True, Tree=merge_4)
linear_movement_kuka_prc_3 = LINearMovementKUKAPrc(TargetAsPlane=list_item_7, extaxenabled=False, interpolation="C_DIS")
move_2 = Move(Geometry=list_item_8.Item1, Motion=unit_z_2)  # -> Geometry, Transform
panel_11 = Panel(merge_4)
linear_movement_kuka_prc_4 = LINearMovementKUKAPrc(TargetAsPlane=move_2.Geometry, extaxenabled=False, interpolation="C_DIS")
krl_code_kuka_prc_3 = KRLCodeKUKAPrc(KRLAsText="MDPE_OFF()")
merge_5 = Merge(
    Data1=flatten(linear_movement_kuka_prc_3),
    Data2=flatten(clean_tree_2),
    Data3=flatten(krl_code_kuka_prc_3),
    Data4=flatten(linear_movement_kuka_prc_4))

# ---- group: Kr 70 Cell and fixture
base_selection = ValueList({"Plywood Base.": 0, "Rubber Playmat.": 1, "SmoothSrf.": 2}, selected="Rubber Playmat.")
pln = Plane(rectangle.Rectangle)
dfl_kr70_cell = DFLKR70CELL(base_selection=base_selection, build_plane=pln)  # -> kuka_prc_frame, kr70_plinth_and_track, plywood_base_mesh, kr70_turntable_frame, mounting_hole_center_points, mounting_hole_outline, m8_fixture_center_points, m8_fixture_holes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
pt = Point([dfl_kr70_cell.mounting_hole_center_points, dfl_kr70_cell.m8_fixture_center_points])
crv_2 = Curve([dfl_kr70_cell.mounting_hole_outline, dfl_kr70_cell.m8_fixture_holes, dfl_kr70_cell.grid_lines_2])
preview = CustomPreview(Geometry=dfl_kr70_cell.kr70_plinth_and_track, Material=ColourSwatch(SwatchColor=RGB(163, 163, 163)))
preview_2 = CustomPreview(Geometry=dfl_kr70_cell.plywood_base_mesh, Material=ColourSwatch(SwatchColor=RGB(255, 212, 143)))
preview_3 = CustomPreview(Geometry=dfl_kr70_cell.additional_base_geometry, Material=ColourSwatch(SwatchColor=RGB(76, 76, 76)))
preview_4 = CustomPreview(Geometry=flatten(crv_2), Material=ColourSwatch(SwatchColor=RGB(76, 76, 76)))
preview_5 = CustomPreview(Geometry=dfl_kr70_cell.kr70_turntable_frame, Material=ColourSwatch(SwatchColor=RGB(76, 76, 76)))

# ---- group: Simulate and Save / DFK MDPH10
value_list = ValueList({"standard nozzle": 0, "extension nozzle": 1}, selected="extension nozzle")
dfl_mdph_10 = DFLMDPH10(nozzle_type=value_list)

# ----
extract_command_kuka_prc = ExtractCommandKUKAPrc(KUKAPrcCommand=merge_5)  # -> PlaneOutput, AxisValues, SpeedValues
point_2 = Point(extract_command_kuka_prc.PlaneOutput)

# ---- group: Simulate and Save
# 5: Simulate and Save
simulation = Slider(1, range=1e-07..1)
project_name = Panel("shark")
iontec_kr30_70_r2100_robot = IontecKR3070R2100Robot(infiniterot=False)
cluster_6 = Cluster(T=project_name, G=nozzle_selection)
file_name = Panel(cluster_6)
save = Button()
base_8_core = KUKAPrcCORE(
    SimulationSlider=simulation,
    KUKAPrcCommands=merge_5,
    Tool=dfl_mdph_10,
    Robot=iontec_kr30_70_r2100_robot,
    SaveToggle=save,
    Filename=file_name,
    RobotBase=dfl_kr70_cell.kuka_prc_frame,
    PRC_BaseExpose=True,
    PRC_SaveNameExpose=True,
    PRCsettings="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")  # -> RobotGeometry, AnalysisOutput
analysis_kuka_prc = AnalysisKUKAPrc(KUKAPrcAnalysisData=base_8_core.AnalysisOutput)  # -> RobotAxisValues, RobotCollisionCheck, RobotReachabilityCheck, CommandID, TimeValue, Planes, CommandTags, IOState, Index, KRL
time_estimate = TimeEstimate(list=analysis_kuka_prc.TimeValue)
weight_estimate = WeightEstimate(vertices=analysis_kuka_prc.Planes, gate=Toggle(False))
panel_12 = Panel(time_estimate)
panel_13 = Panel(weight_estimate)

# ----
deconstruct = Deconstruct(Point=point_2)  # -> XComponent, YComponent, flatten(ZComponent)
machine_speeds = Number(flatten(round_to_decimal_place.Rounded))
extrusion_rates = Number(flatten(panel_9))
bounds = Bounds(Numbers=machine_speeds)
bounds_2 = Bounds(Numbers=extrusion_rates)
deconstruct_plane = DeconstructPlane(Plane=extract_command_kuka_prc.PlaneOutput)  # -> Origin, XAxis, YAxis, ZAxis
quick_graph = QuickGraph(deconstruct.ZComponent, SortOrder=0)
quick_graph_2 = QuickGraph(machine_speeds, SortOrder=0)
quick_graph_3 = QuickGraph(extrusion_rates, SortOrder=0)
panel_14 = Panel(bounds)
panel_15 = Panel(bounds_2)
average = Average(Input=flatten(deconstruct_plane.YAxis))
average_2 = Average(Input=flatten(deconstruct_plane.XAxis))
average_3 = Average(Input=flatten(deconstruct_plane.ZAxis))
panel_16 = Panel([average_2, average, average_3])

# ==== cluster DFLMDPH10
nozzle_type = ClusterInput()
mdph_regular_nozzle = Mesh([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])
mdph_regular_nozzle_2 = Mesh([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])
mjoin = MeshJoin(Meshes=mdph_regular_nozzle)
mjoin_2 = MeshJoin(Meshes=mdph_regular_nozzle_2)
custom_tool_kuka_prc = CustomToolKUKAPrc(
    CustomToolGeometry=mjoin,
    isExternal=False,
    toolid=3,
    toolvala=0,
    toolvalb=-90,
    toolvalc=180,
    toolvalx=386.73,
    toolvaly=0.27,
    toolvalz=279.03,
    valuesset=True)
custom_tool_kuka_prc_2 = CustomToolKUKAPrc(
    CustomToolGeometry=mjoin_2,
    isExternal=False,
    toolid=2,
    toolvala=0,
    toolvalb=-90,
    toolvalc=180,
    toolvalx=411.73,
    toolvaly=0.27,
    toolvalz=279.03,
    valuesset=True)
filter = StreamFilter(Gate=nozzle_type, Stream0=custom_tool_kuka_prc, Stream1=custom_tool_kuka_prc_2)
tool = ClusterOutput(filter)

# ==== cluster Cluster
G = ClusterInput()
T = ClusterInput()
filter = StreamFilter(Gate=G, Stream1="_1_5mm", Stream2="_3mm", Stream3="_5mm")
rep = ReplaceText(Text=T, Find=" ", Replace="_", RecursiveReplace=False)
concat = Concatenate(FragmentA=rep, FragmentB=filter)
R = ClusterOutput(concat)

# ==== cluster DFLKR70CELL
build_plane = ClusterInput()
base_selection = ClusterInput()
cluster = Cluster_2()
cluster_2 = Cluster_3()
cluster_3 = Cluster_4()
cluster_4 = Cluster_2()
grid_lines = Curve([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])
m8_holes = M8Holes()  # -> C, C_2
fixing_holes = FixingHoles()  # -> C, C_2
brep = Brep([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])
mesh = MeshBrep(
    Brep=brep,
    Settings={GridMaxCount=0, GridMinCount=16, JaggedSeams=False, MaxEdgeLength=0, MinEdgeLength=0.0001, MinTolerance=0, Refine=True, RefineAngle=0, RelativeTolerance=0.65, SimplePlanes=True, Tolerance=0})
frame = FrameKUKAPrc(FrameNumber="6", XValue=1543.36, YValue=-1.35, ZValue=-6.53, AValue=0.01, BValue=-0.19, CValue=0.1, toolaxis="Z")  # -> KUKAPrcFrame, XYZABCAsPlane
frame_2 = FrameKUKAPrc(FrameNumber="8", XValue=1543.36, YValue=-1.35, ZValue=3.53, AValue=0.01, BValue=-0.19, CValue=0.1, toolaxis="Z")  # -> KUKAPrcFrame, XYZABCAsPlane
frame_3 = FrameKUKAPrc(FrameNumber="7", XValue=1543.36, YValue=-1.35, ZValue=-6.53, AValue=0.01, BValue=-0.19, CValue=0.1, toolaxis="Z")  # -> KUKAPrcFrame, XYZABCAsPlane
plywood_base = Entwine(
    Branch00=cluster,
    Branch01=cluster_2,
    Branch02=fixing_holes.C,
    Branch03=fixing_holes.C_2,
    Branch04=m8_holes.C,
    Branch05=m8_holes.C_2,
    Branch07=grid_lines,
    FlattenInputs=True)
rubber_base = Entwine(
    Branch00=cluster,
    Branch01=cluster_2,
    Branch02=fixing_holes.C,
    Branch03=fixing_holes.C_2,
    Branch04=m8_holes.C,
    Branch05=m8_holes.C_2,
    Branch06=cluster_3,
    Branch07=grid_lines,
    Branch08=ColourSwatch(SwatchColor=RGB(173, 173, 173)),
    FlattenInputs=True)
smoothsrf = Entwine(
    Branch00=cluster,
    Branch01=cluster_2,
    Branch02=fixing_holes.C,
    Branch03=fixing_holes.C_2,
    Branch04=m8_holes.C,
    Branch05=m8_holes.C_2,
    Branch06=cluster_4,
    Branch07=grid_lines,
    Branch08=ColourSwatch(SwatchColor=RGB(255, 255, 255)),
    FlattenInputs=True)
filter = StreamFilter(Gate=base_selection, Stream0=plywood_base, Stream1=rubber_base, Stream2=smoothsrf)  # -> simplify(Stream)
frame_4 = StreamFilter(Gate=base_selection, Stream0=frame_2.KUKAPrcFrame, Stream1=frame_3.KUKAPrcFrame, Stream2=frame.KUKAPrcFrame)
bbox = BoundingBox(Content=flatten(filter), Plane=PlaneXY(0, 0, 0), UnionBox=True)  # -> Box, Box_2
debrep = DeconstructBrep(Brep=bbox.Box)  # -> Faces, Edges, Vertices
item = ListItem(List=debrep.Faces, Index=5, Wrap=True)
area = Area(Geometry=item)  # -> Area, Centroid
move2pt = MoveToPoint(Geometry=filter, PointA=area.Centroid, PointB=build_plane)  # -> Moved, Vector, Transform
move2pt_2 = MoveToPoint(Geometry=mesh, PointA=area.Centroid, PointB=build_plane)  # -> Moved, Vector, Transform
bang = ExplodeTree(Data=move2pt.Moved)  # -> Branch0, Branch1, Branch2, Branch3, Branch4, Branch5, Branch6, Branch7, Branch8
kuka_prc_frame = ClusterOutput(frame_4)
data = Data(bang.Branch8)
plywood_base_mesh = ClusterOutput(bang.Branch0)
mounting_hole_center_points = ClusterOutput(bang.Branch2)
m8_fixture_center_points = ClusterOutput(bang.Branch4)
m8_fixture_holes = ClusterOutput(bang.Branch5)
mounting_hole_outline = ClusterOutput(bang.Branch3)
kr70_plinth_and_track = ClusterOutput(move2pt_2.Moved)
kr70_turntable_frame = ClusterOutput(bang.Branch1)
additional_base_colour = ClusterOutput(data)
grid_lines_2 = ClusterOutput(bang.Branch7)
additional_base_geometry = ClusterOutput(bang.Branch6)
data_2 = Data(bang.Branch6)

# ==== cluster TimeEstimate
list = ClusterInput()
list_item = ListItem(List=flatten(list), Index=-1, Wrap=True)
division = Division(A=list_item, B="3600")
round = Round(Number=division)  # -> Nearest, Floor, Ceiling
subtraction = Subtraction(A=division, B=round.Floor)
integer = Integer(round.Floor)
multiplication = Multiplication(A=subtraction, B="60")
concatenate = Concatenate()
panel = Panel(division)
round_2 = Round(Number=multiplication)  # -> Nearest, Floor, Ceiling
merge = Merge(Data1=integer, Data2=round_2.Ceiling)  # -> graft(Result)
replace_text = ReplaceText(Text="X hour(s) Y minutes.", Find="X", Replace=flatten(integer), RecursiveReplace=False)
replace_text_2 = ReplaceText(Text=replace_text, Find="Y", Replace=flatten(round_2.Ceiling), RecursiveReplace=False)  # -> flatten(Result)
result = ClusterOutput(replace_text_2)

# ==== cluster WeightEstimate
gate = ClusterInput()
vertices = ClusterInput()
polyline = PolyLine(Vertices=flatten(vertices), Closed=False)
stream_filter = StreamFilter(Gate=gate, Stream0="2", Stream1="1")
length = Length(Curve=polyline)
division = Division(A=length, B="90000")
division_2 = Division(A=division, B=stream_filter)
round_to_decimal_place = RoundToDecimalPlace(NumberX=division_2, DecimalPlace=Slider(2, range=0..10), RoundType=0)  # -> Rounded, Difference
replace_text = ReplaceText(Text="Xkgs", Find="X", Replace=round_to_decimal_place.Rounded, RecursiveReplace=False)
result = ClusterOutput(replace_text)

# ==== cluster Cluster_5
panel = Panel("Path")
bed_surface_mesh = ClusterInput()
path = ClusterInput()  # Path
bounding_box = BoundingBox(Content=flatten(path), Plane=PlaneXY(0, 0, 0), UnionBox=True)  # -> Box, Box_2
deconstruct_brep = DeconstructBrep(Brep=bounding_box.Box)  # -> Faces, Edges, Vertices
area = Area(Geometry=deconstruct_brep.Faces)  # -> Area, Centroid
deconstruct = Deconstruct(Point=area.Centroid)  # -> XComponent, YComponent, ZComponent
rectangle = Rectangle(Plane=PlaneXY(0, 0, 0), XSize=Domain(-1, 1), YSize=Domain(-2, 2), Radius=0)  # -> Rectangle, Length
bed_surface_mesh_2 = Surface(bed_surface_mesh)
sort_list = SortList(Keys=deconstruct.ZComponent, ValuesValuesA=deconstruct_brep.Faces)  # -> Keys, ValuesValuesA
surface = Surface(rectangle.Rectangle)
list_item = ListItem(List=sort_list.ValuesValuesA, Index=0, Wrap=True)
flip = Flip(Surface=bed_surface_mesh_2, Guide=surface)  # -> Surface, Result
md_slider = MDSlider(
    SliderMode=0,
    slider_value=Point(0.5037536621, 0.5022096634, 0.5),
    x_domain=Domain(0, 1),
    y_domain=Domain(0, 1),
    z_domain=Domain(0, 1))
area_2 = Area(Geometry=list_item)  # -> Area, Centroid
evaluate_surface = EvaluateSurface(Surface=reparameterize(flip.Surface), Point=md_slider)  # -> Point, Normal, UDirection, VDirection, Frame
orient = Orient(Geometry=path, Source=flatten(area_2.Centroid), Target=flatten(evaluate_surface.Frame))  # -> Geometry, Transform
path_2 = ClusterOutput(orient.Geometry)  # Path

# ==== cluster DFLLead
lead_in_settings = ClusterInput()  # -- LEAD IN SETTINGS --
adhesion_method = ClusterInput()  # Adhesion Method
flip_lead_in_direction = ClusterInput()  # Flip Lead-in Direction
lead_in_distance = ClusterInput()  # Lead in Distance
no_of_geos = ClusterInput()  # no. of geos
list_length = ListLength(List=no_of_geos)
larger_than = LargerThan(FirstNumber=list_length, SecondNumber="1")  # -> LargerThan, OrEqualTo
order = ClusterInput()  # order
invert_boolean = InvertBoolean(Boolean=order)  # -> Inverted, Number
gate_and = GateAnd(A=larger_than.LargerThan, B=invert_boolean.Inverted)
data = ClusterInput()
data_2 = Data(data)
brim_settings = ClusterInput()  # -- BRIM SETTINGS --
bead_width = ClusterInput()  # bead width
no_of_loops = ClusterInput()  # No. of Loops
stream_filter = StreamFilter(Gate=gate_and, Stream0="{0;?}", Stream1="{?;0}")
multiplication = Multiplication(A=bead_width, B="0.8")
split_tree = SplitTree(Data=data_2, Masks=flatten(stream_filter))  # -> Positive, Negative
series = Series(Start=multiplication, Step=multiplication, Count=no_of_loops)
offset_curve = OffsetCurve(Curve=split_tree.Positive, Distance=series, Corners=1)
perp_frame = PerpFrame(Curve=reparameterize(split_tree.Positive), Parameter="0")
unit_z = UnitZ(Factor=1)
trim_tree = TrimTree(Tree=offset_curve, Depth=1)
align_plane = AlignPlane(Plane=perp_frame, Direction=unit_z)  # -> Plane, Angle
reverse_list = ReverseList(List=trim_tree)
deconstruct_plane = DeconstructPlane(Plane=align_plane.Plane)  # -> Origin, XAxis, YAxis, ZAxis
amplitude = Amplitude(Vector=deconstruct_plane.YAxis, Amplitude=lead_in_distance)
merge = Merge(Data1=simplify(reverse_list), Data2=simplify(split_tree.Positive))
graft_tree = GraftTree(Tree=flatten(merge), IncludeEmptyLists=True, IncludeNullItems=True)
negative = Negative(Value=amplitude)
graft_tree_2 = GraftTree(Tree=merge, IncludeEmptyLists=True, IncludeNullItems=True)
stream_filter_2 = StreamFilter(Gate=flip_lead_in_direction, Stream0=amplitude, Stream1=negative)
stream_filter_3 = StreamFilter(Gate=gate_and, Stream0=graft_tree, Stream1=graft_tree_2)
move = Move(Geometry=deconstruct_plane.Origin, Motion=stream_filter_2)  # -> Geometry, Transform
line = Line(StartPoint=move.Geometry, EndPoint=deconstruct_plane.Origin)
trim_tree_2 = TrimTree(Tree=line, Depth=1)
merge_2 = Merge(Data1=stream_filter_3, Data2=split_tree.Negative)
reverse_list_2 = ReverseList(List=trim_tree_2)
construct_tree_branch = ConstructTreeBranch(BranchPath="{0;0}", BranchItems=line)
merge_3 = Merge(Data1=simplify(reverse_list_2), Data2=simplify(split_tree.Positive))
graft_tree_3 = GraftTree(Tree=flatten(merge_3), IncludeEmptyLists=True, IncludeNullItems=True)
graft_tree_4 = GraftTree(Tree=merge_3, IncludeEmptyLists=True, IncludeNullItems=True)
split_tree_2 = SplitTree(Data=data_2, Masks=flatten("{0;?}"))  # -> Positive, Negative
stream_filter_4 = StreamFilter(Gate=gate_and, Stream0=graft_tree_3, Stream1=graft_tree_4)
path_mapper = PathMapper(split_tree_2.Positive, source="{a;x}", target="{a;x+1}")
merge_4 = Merge(Data1=stream_filter_4, Data2=split_tree.Negative)
data_3 = Data(path_mapper)
stream_filter_5 = StreamFilter(Gate=adhesion_method, Stream0=merge_4, Stream1=merge_2)
merge_5 = Merge(Data1=construct_tree_branch, Data2=data_3, Data3=split_tree_2.Negative)
s_0 = ClusterOutput(stream_filter_5)

# ==== cluster Cluster_6
layer_time = ClusterInput()
layers = ClusterInput()
print_sequence = ClusterInput()
layer_time_2 = ClusterInput()
layers_2 = ClusterInput()
print_sequence_2 = ClusterInput()
layer_time_3 = Data(layer_time)
layers_3 = Data(layers)
layers_4 = Data(layers_2)
print_sequence_3 = Data(print_sequence)
print_sequence_4 = Data(print_sequence_2)
trim_tree = TrimTree(Tree=layers_3, Depth=1)
layer_time_4 = Data(layer_time_2)
trim_tree_2 = TrimTree(Tree=layers_4, Depth=1)
stream_filter = StreamFilter(Gate=print_sequence_3, Stream0=layers_3, Stream1=trim_tree)
length = Length(Curve=trim_tree_2)

# ---- group: Dynamic Print Speed
length_2 = Length(Curve=layers_4)
mass_addition = MassAddition(Input=length_2)  # -> Result, PartialResults
division = Division(A=mass_addition.Result, B=1000)
tree_statistics = TreeStatistics(Tree=layers_4)  # -> Paths, Length, Count
division_2 = Division(A=division, B=layer_time_4)  # -> simplify(Result)
construct_tree_branch = ConstructTreeBranch(BranchPath=graft(tree_statistics.Paths), BranchItems=graft(tree_statistics.Length))
duplicate_data = DuplicateData(Data=division_2, Number=construct_tree_branch, Order=True)  # -> simplify(Data)

# ----
relay = ClusterOutput(stream_filter)
relay_2 = ClusterOutput(layers_4)
mass_addition_2 = MassAddition(Input=length)  # -> Result, PartialResults
division_3 = Division(A=mass_addition_2.Result, B=1000)
tree_statistics_2 = TreeStatistics(Tree=trim_tree_2)  # -> Paths, Length, Count
division_4 = Division(A=division_3, B=layer_time_4)  # -> simplify(Result)
construct_tree_branch_2 = ConstructTreeBranch(BranchPath=graft(tree_statistics_2.Paths), BranchItems=graft(tree_statistics_2.Length))
duplicate_data_2 = DuplicateData(Data=division_4, Number=construct_tree_branch_2, Order=True)  # -> simplify(Data)
unflatten_tree = UnflattenTree(Tree=duplicate_data_2, Guide=layers_4)
stream_filter_2 = StreamFilter(Gate=print_sequence_4, Stream0=duplicate_data, Stream1=unflatten_tree)
panel = Panel(unflatten_tree)
layer_speed = Data(unflatten_tree)
s_0 = ClusterOutput(stream_filter_2)
layer_speed_2 = ClusterOutput(layer_speed)

# ---- group: Dynamic Print Speed
length_3 = Length(Curve=stream_filter)
mass_addition_3 = MassAddition(Input=length_3)  # -> Result, PartialResults
division_5 = Division(A=mass_addition_3.Result, B=1000)
tree_statistics_3 = TreeStatistics(Tree=layers_3)  # -> Paths, Length, Count
division_6 = Division(A=division_5, B=layer_time_3)  # -> simplify(Result)
construct_tree_branch_3 = ConstructTreeBranch(BranchPath=graft(tree_statistics_3.Paths), BranchItems=graft(tree_statistics_3.Length))

# ----
trim_tree_3 = TrimTree(Tree=construct_tree_branch_3, Depth=1)

# ---- group: Dynamic Print Speed (continued)
duplicate_data_3 = DuplicateData(Data=division_6, Number=trim_tree_3, Order=True)  # -> simplify(Data)

# ----
data = ClusterOutput(duplicate_data_3)
layer_speed_3 = Data(duplicate_data_3)
panel_2 = Panel(layer_speed_3)
layer_speed_4 = ClusterOutput(layer_speed_3)

# ==== cluster Cluster_8
item = ClusterInput()
layer_speed = ClusterInput()
layer_speed_2 = Data(layer_speed)
replace_items = ReplaceItems(List=layer_speed_2, Item=item, Indices="0", Wrap=False)
panel = Panel(layer_speed)
item_2 = ClusterInput()
replace_items_2 = ReplaceItems(List=replace_items, Item=item, Indices="1", Wrap=True)
replace_items_3 = ReplaceItems(List=layer_speed_2, Item=item_2, Indices="0", Wrap=False)
simplify_tree = SimplifyTree(Tree=replace_items_2, Front=False)
replace_items_4 = ReplaceItems(List=replace_items_3, Item=item_2, Indices="1", Wrap=True)
simplify_tree_2 = SimplifyTree(Tree=replace_items_4, Front=False)
simplify_tree_3 = SimplifyTree(Tree=replace_items_3, Front=False)
flat_speed = ClusterInput()  # Flat Speed
max_speed = ClusterInput()
cluster = Cluster_7(
    segment_height=simplify_tree,
    segment_width=simplify_tree_2,
    per_layer_speed=layer_speed_2,
    max_speed=max_speed,
    flat_speed=flat_speed)  # -> rpm_required, capped_speeds
panel_2 = Panel(cluster.rpm_required)
multiplication = Multiplication(A=cluster.capped_speeds, B=10)
layer_extrusion_rate = ClusterOutput(cluster.rpm_required)
division = Division(A=cluster.capped_speeds, B="1000")
result = ClusterOutput(division)
number_slider = Slider(-90, range=-180..180)
panel_3 = Panel(division)

# ==== cluster PlaneOrientation
relay = ClusterInput()
xz_plane = XZPlane(Origin=relay)
xz_plane_2 = XZPlane(Origin=relay)
rotate = Rotate(Geometry=xz_plane, Angle=degrees(Slider(-90, range=-180..180)), Plane=xz_plane_2)  # -> Geometry, Transform
xy_plane = XYPlane(Origin=rotate.Geometry)
rotate_2 = Rotate(Geometry=rotate.Geometry, Angle=degrees(Slider(-90, range=-180..180)), Plane=xy_plane)  # -> Geometry, Transform
flip_plane = FlipPlane(Plane=rotate_2.Geometry, FlipX=Toggle(False), FlipY=Toggle(False), FlipZ=Toggle(False))  # -> Flipped, ResultBoolean
flipped = ClusterOutput(flip_plane.Flipped)

# ==== cluster Cluster_9
curve = ClusterInput()
curve_2 = Curve(curve)
trim_tree = TrimTree(Tree=curve_2, Depth=1)
tree_statistics = TreeStatistics(Tree=trim_tree)  # -> Paths, Length, Count
panel = Panel("""0
-1""")
value = ClusterInput()
data = ClusterInput()
negative = Negative(Value=value)
split_tree = SplitTree(Data=data, Masks=flatten(tree_statistics.Paths))  # -> Positive, Negative
data_2 = ClusterInput()
list_item = ListItem(List=split_tree.Positive, Index=panel, Wrap=True)
split_tree_2 = SplitTree(Data=data_2, Masks=flatten(tree_statistics.Paths))  # -> Positive, Negative
list_item_2 = ListItem(List=list_item, Index=0, Wrap=True)  # -> Item, Item1
extend_curve = ExtendCurve(Curve=split_tree_2.Positive, Type=0, Start=negative, End="0")
distance = Distance(PointA=list_item_2.Item, PointB=list_item_2.Item1)
end_points = EndPoints(Curve=split_tree_2.Positive)  # -> Start, End
end_points_2 = EndPoints(Curve=extend_curve)  # -> Start, End
second_number = ClusterInput()
larger_than = LargerThan(FirstNumber=distance, SecondNumber=second_number)  # -> LargerThan, OrEqualTo
point = Point(end_points_2.Start)
point_2 = Point(end_points.End)
factor = ClusterInput()
point_3 = Point(end_points_2.End)
unit_z = UnitZ(Factor=factor)
pick_n_choose = PickNChoose(Pattern=larger_than.LargerThan, Stream0=point, Stream1=point_2)
factor_2 = ClusterInput()
move = Move(Geometry=curve_2, Motion=unit_z)  # -> Geometry, Transform
path_mapper = PathMapper(point_3, source="{A;B}(i)", target="{A;B;i}")
path_mapper_2 = PathMapper(pick_n_choose, source="{A;B}(i)", target="{A;B;i}")
unit_z_2 = UnitZ(Factor=factor_2)
end_points_3 = EndPoints(Curve=move.Geometry)  # -> Start, End
end_points_4 = EndPoints(Curve=curve_2)  # -> Start, End
move_2 = Move(Geometry=path_mapper_2, Motion=unit_z_2)  # -> Geometry, Transform
merge = Merge(Data1=path_mapper, Data2=path_mapper_2, Data3=move_2.Geometry, Data4=end_points_3.End, Data5=end_points_4.End)
result = ClusterOutput(merge)

# ==== cluster Contouring

polyline_settings = ClusterInput()  # -- POLYLINE SETTINGS --
polyline_tolerance = ClusterInput()
angle_tolerance = ClusterInput()

weave_inner_depth = ClusterInput()  # Weave Inner Depth

brep_or_mesh_single_or_multiple = ClusterInput()  # BREP or Mesh (Single or Multiple)
layer_height = ClusterInput()  # Layer Height
layer_width = ClusterInput()  # Layer Width
print_sequence = ClusterInput()  # Print Sequence
contour_direction = ClusterInput()  # Contour Direction
seam_settings = ClusterInput()  # -- SEAM SETTINGS --
align_seam = ClusterInput()  # Align Seam

weave_settings = ClusterInput()  # -- WEAVE SETTINGS --
weave_outer_depth = ClusterInput()  # Weave Outer Depth
weave_density_point_count = ClusterInput()  # Weave Density (Point Count)
weave_application_pattern = ClusterInput()  # Weave Application Pattern
weave_flip_control = ClusterInput()  # Weave Flip Control

seam_alignment_point = ClusterInput()
iterative_seam = ClusterInput()  # iterative seam
snap_seam = ClusterInput()  # snap seam

point = Point(Point(0, 0, 0))
print_sequence_2 = Data(print_sequence)
brep_or_mesh = Geometry(brep_or_mesh_single_or_multiple)
layer_height_2 = Number(layer_height)
vector_display = VectorDisplay(Anchor=point, Vector=contour_direction)
contour = Contour(Shape=brep_or_mesh, Point=Point(0, 0, 0), Direction=contour_direction, Distance=layer_height_2)
close_curve = CloseCurve(Curve=contour, CloseType=0, Bulge=0.5, Tolerance=Slider(5, range=0..10))  # -> Closed, ResultBoolean

# ---- group: cull curve less than bead width
length = Length(Curve=close_curve.Closed)
bead_width = Number(layer_width)
smaller_than = SmallerThan(FirstNumber=length, SecondNumber=bead_width)  # -> SmallerThan, OrEqualTo
cull_pattern = CullPattern(List=close_curve.Closed, CullPattern=invert(smaller_than.SmallerThan))
graft_tree = GraftTree(Tree=cull_pattern, IncludeEmptyLists=True, IncludeNullItems=True)
simplify_tree = SimplifyTree(Tree=graft_tree, Front=True)
data = Data(simplify_tree)

# ----
list_length = ListLength(List=weave_flip_control)
weave_pattern = ClusterInput()  # Weave Pattern
panel = Panel("""0
0
0
1""")
panel_2 = Panel(data)
trim_tree = TrimTree(Tree=cull_pattern, Depth=1)
# 3 modes
# 
# single, nB
# single, B
# multiple, nB
graft_tree_2 = GraftTree(Tree=cull_pattern, IncludeEmptyLists=True, IncludeNullItems=True)
flip_matrix = FlipMatrix(Data=trim_tree)  # -> graft(Data)
panel_3 = Panel(flip_matrix)
simplify_tree_2 = SimplifyTree(Tree=graft_tree_2, Front=True)
path_mapper = PathMapper(simplify_tree_2, source="{a;b;c}", target="{a;b}")
list_length_2 = ListLength(List=brep_or_mesh)
stream_filter = StreamFilter(Gate=print_sequence_2, Stream0=simplify_tree_2, Stream1=flip_matrix)
stream_filter_2 = StreamFilter(Gate=print_sequence_2, Stream0=path_mapper, Stream1=flip_matrix)
panel_4 = Panel(simplify_tree_2)
larger_than = LargerThan(FirstNumber=list_length_2, SecondNumber="1")  # -> LargerThan, OrEqualTo
data_2 = Data()
stream_filter_3 = StreamFilter(Gate=larger_than.LargerThan, Stream0=simplify_tree_2, Stream1=stream_filter_2)
simplify_tree_3 = SimplifyTree(Tree=stream_filter_3, Front=False)
align_curve_seams = AlignCurveSeams(Curves=reparameterize(flatten(stream_filter_3)), Guide=seam_alignment_point, Snap=snap_seam, Iterative=iterative_seam)  # -> Aligned, Points, ResultBoolean
curve = Curve(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)
unflatten_tree = UnflattenTree(Tree=align_curve_seams.Aligned, Guide=stream_filter_3)
trim_tree_2 = TrimTree(Tree=align_curve_seams.Aligned, Depth=1)
boolean_toggle = BooleanToggle(False)
stream_filter_4 = StreamFilter(Gate=align_seam, Stream0=stream_filter_3, Stream1=unflatten_tree)

# ---- group: open seam and ends by 1/2 of bead width
bead_width_2 = Number(bead_width)
division = Division(A=bead_width_2, B="4")
extend_curve = ExtendCurve(Curve=stream_filter_4, Type=0, Start=expr("-x", division), End=expr("-x", division))

# ----
curve_2 = Curve(extend_curve)
dispatch = Dispatch(List=flatten(curve_2), DispatchPattern=weave_application_pattern)  # -> ListA, ListB
divide_curve = DivideCurve(Curve=dispatch.ListA, Count=weave_density_point_count, Kinks=False)  # -> simplify(Points), Tangents, Parameters
tree_statistics = TreeStatistics(Tree=divide_curve.Points)  # -> Paths, Length, Count
division_2 = Division(A=tree_statistics.Count, B=list_length)
round = Round(Number=division_2)  # -> Nearest, Floor, Ceiling
duplicate_data = DuplicateData(Data=weave_flip_control, Number=round.Ceiling, Order=True)
split_list = SplitList(List=duplicate_data, Index=tree_statistics.Count)  # -> simplify(graft(ListA)), ListB
boolean = Boolean(split_list.ListA)
shift_list = ShiftList(List=divide_curve.Points, Shift=graft(split_list.ListA), Wrap=True)  # -> simplify(List)
dispatch_2 = Dispatch(List=divide_curve.Points, DispatchPattern=weave_pattern)  # -> ListA, ListB
point_2 = Point(divide_curve.Points)
polyline = PolyLine(Vertices=point_2, Closed=False)
number_slider = Slider(5, range=0..10)
construct_domain = ConstructDomain(DomainStart=weave_outer_depth, DomainEnd="0")
domain = Domain("0 to 1")
remap_numbers = RemapNumbers(Value=Slider(0, range=0..1), Source=domain, Target=construct_domain)  # -> Mapped, Clipped
clean_tree = CleanTree(RemoveNulls=True, RemoveInvalid=True, RemoveEmpty=True, Tree=extend_curve)

tree_statistics_2 = TreeStatistics(Tree=simplify_tree_3)  # -> Paths, Length, Count
deconstruct_path = DeconstructPath(Branch=tree_statistics_2.Paths)
explode_tree = ExplodeTree(Data=deconstruct_path)  # -> Branch0, Branch1
list_length_3 = ListLength(List=explode_tree.Branch0)
larger_than_2 = LargerThan(FirstNumber=list_length_3, SecondNumber="1")  # -> LargerThan, OrEqualTo

stream_filter_5 = StreamFilter(Gate=larger_than_2.LargerThan, Stream0=brep_or_mesh, Stream1=data_2)
brep_closest_point = BrepClosestPoint(Point=dispatch_2.ListA, Brep=stream_filter_5)  # -> Point, Normal, Distance
curve_closest_point = CurveClosestPoint(Point=brep_closest_point.Point, Curve=curve)  # -> Point, Parameter, Distance
panel_5 = Panel(curve_closest_point.Distance)
stream_filter_6 = StreamFilter(Gate=boolean_toggle, Stream0=curve_closest_point.Distance, Stream1="0 to 1")
bounds = Bounds(Numbers=flatten(stream_filter_6))
deconstruct_vector = DeconstructVector(Vector=brep_closest_point.Normal)  # -> XComponent, YComponent, ZComponent
vector_xyz = VectorXYZ(XComponent=deconstruct_vector.XComponent, YComponent=deconstruct_vector.YComponent, ZComponent=0)  # -> Vector, Length
contours = Geometry(contour)
negative = Negative(Value=weave_outer_depth)
spiral = Spiral(relay=contours)
curve_to_polyline = CurveToPolyline(Curve=clean_tree, ToleranceDistance=polyline_tolerance, ToleranceAngle=degrees(angle_tolerance))  # -> Polyline, Segments
curve_to_polyline_2 = CurveToPolyline(Curve=spiral, ToleranceDistance=polyline_tolerance, ToleranceAngle=degrees(angle_tolerance))  # -> Polyline, Segments
amplitude = Amplitude(Vector=vector_xyz.Vector, Amplitude=negative)
brep_closest_point_2 = BrepClosestPoint(Point=dispatch_2.ListB, Brep=stream_filter_5)  # -> Point, Normal, Distance
curve_3 = Curve(<curve referenced from the Rhino model>)

panel_6 = Panel(curve_to_polyline.Polyline)
polyline_2 = ClusterOutput(curve_to_polyline.Polyline)  # Polyline

curve_closest_point_2 = CurveClosestPoint(Point=brep_closest_point_2.Point, Curve=curve)  # -> Point, Parameter, Distance
# ATT!
# Spiral and Weave only work with single brep upload.
data_3 = Data()
negative_2 = Negative(Value=amplitude)
stream_filter_7 = StreamFilter(Gate=larger_than_2.LargerThan, Stream0=curve_to_polyline_2.Polyline, Stream1=data_3)
bounds_2 = Bounds(Numbers=flatten(curve_closest_point_2.Distance))
group = Group(Geometry=amplitude)
group_2 = Group(Geometry=negative_2)
stream_filter_8 = StreamFilter(Gate=boolean_toggle, Stream0=curve_closest_point_2.Distance, Stream1="0 to 1")
spiral_2 = ClusterOutput(stream_filter_7)
deconstruct_vector_2 = DeconstructVector(Vector=brep_closest_point_2.Normal)  # -> XComponent, YComponent, ZComponent
remap_numbers_2 = RemapNumbers(Value=stream_filter_8, Source=bounds_2, Target=construct_domain)  # -> Mapped, Clipped
pick_n_choose = PickNChoose(Pattern=split_list.ListA, Stream0=group, Stream1=group_2)
ungroup = Ungroup(Group=pick_n_choose)
move = Move(Geometry=brep_closest_point.Point, Motion=ungroup)  # -> Geometry, Transform
vector_xyz_2 = VectorXYZ(XComponent=deconstruct_vector_2.XComponent, YComponent=deconstruct_vector_2.YComponent, ZComponent=0)  # -> Vector, Length
python_3_script = Python3Script(x=weave_inner_depth)  # -> result; inputs x: tree of Double
# ---------- python_3_script: Python ----------
from Grasshopper import DataTree
from Grasshopper.Kernel.Data import GH_Path

result = DataTree[float]()

for i in range(x.BranchCount):
    path = x.Path(i)
    branch = x.Branch(path)
    cleaned = [max(0, float(n)) for n in branch]
    for val in cleaned:
        result.Add(val, path)
# ---------- end python_3_script ----------
amplitude_2 = Amplitude(Vector=vector_xyz_2.Vector, Amplitude=python_3_script)
negative_3 = Negative(Value=amplitude_2)
group_3 = Group(Geometry=amplitude_2)
group_4 = Group(Geometry=negative_3)
subtraction = Subtraction(A=weave_pattern, B="1")
negative_4 = Negative(Value=subtraction)
pick_n_choose_2 = PickNChoose(Pattern=split_list.ListA, Stream0=group_3, Stream1=group_4)
ungroup_2 = Ungroup(Group=pick_n_choose_2)
move_2 = Move(Geometry=brep_closest_point_2.Point, Motion=ungroup_2)  # -> Geometry, Transform
weave = Weave(Pattern=negative_4, Stream0=move.Geometry, Stream1=move_2.Geometry, NullGaps=False)
list_item = ListItem(List=divide_curve.Points, Index=0, Wrap=True)  # -> Item1, Item
integer = Integer(weave_application_pattern)
invert_boolean = InvertBoolean(Boolean=integer)  # -> Inverted, Number
panel_7 = Panel("-1")
replace_items = ReplaceItems(List=weave, Item=list_item.Item, Indices="0", Wrap=False)
list_length_4 = ListLength(List=replace_items)
panel_8 = Panel(list_length_4)
subtraction_2 = Subtraction(A=panel_8, B="1")
# ATT!
# Spiral and Weave only work with single brep upload.
panel_9 = Panel("""ATT!
Spiral and Weave only work with single brep upload.""")
replace_items_2 = ReplaceItems(List=replace_items, Item=list_item.Item1, Indices=subtraction_2, Wrap=False)
interpolate = Interpolate(Vertices=replace_items_2, Degree=3, Periodic=Toggle(False), KnotStyle=1)  # -> Curve, Length, Domain
weave_2 = Weave(Pattern=invert_boolean.Inverted, Stream0=flatten(interpolate.Curve), Stream1=flatten(dispatch.ListB), NullGaps=False)  # -> graft(Weave)
curve_4 = Curve(weave_2)
list_item_2 = ListItem(List=flatten(weave_2), Index=0, Wrap=True)  # -> Item, Item1, Item2, Item3, Item4, Item5, Item6, Item7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
curve_to_polyline_3 = CurveToPolyline(Curve=weave_2, ToleranceDistance=polyline_tolerance, ToleranceAngle=degrees(angle_tolerance))  # -> Polyline, Segments
path_mapper_2 = PathMapper(curve_to_polyline_3.Polyline, source="{a;b}", target="{b;a}")
data_4 = Data()
stream_filter_9 = StreamFilter(Gate=larger_than_2.LargerThan, Stream0=path_mapper_2, Stream1=data_4)
stream_filter_10 = StreamFilter(Gate=larger_than_2.LargerThan, Stream0=data_4, Stream1=panel_9)
weaved = Curve(stream_filter_9)
status_messages = ClusterOutput(stream_filter_10)  # Status Messages
weave_3 = ClusterOutput(weaved)  # Weave

# ==== cluster Cluster_10
gate = ClusterInput()
vector_xyz = VectorXYZ(XComponent=0, YComponent="-1", ZComponent="1")  # -> Vector, Length
contour_direction_vector = UnitZ(Factor=1)
stream_filter = StreamFilter(Gate=gate, Stream0=contour_direction_vector, Stream1=vector_xyz.Vector)
s_0 = ClusterOutput(stream_filter)

# ==== cluster FixingHoles
fixture_holes_from_fusion = Curve([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])
area = Area(Geometry=fixture_holes_from_fusion)  # -> Area, Centroid
xy = XYPlane(Origin=area.Centroid)
C = ClusterOutput(area.Centroid)
cir = Circle(Plane=xy, Radius="12")
C_2 = ClusterOutput(cir)

# ==== cluster M8Holes
m8_fixtures_from_fusion = Curve([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])
area = Area(Geometry=m8_fixtures_from_fusion)  # -> Area, Centroid
xy = XYPlane(Origin=area.Centroid)
C = ClusterOutput(area.Centroid)
cir = Circle(Plane=xy, Radius="4.75")
C_2 = ClusterOutput(cir)

# ==== cluster Cluster_2
brep = Brep(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)
mesh = MeshBrep(
    Brep=brep,
    Settings={GridMaxCount=0, GridMinCount=16, JaggedSeams=False, MaxEdgeLength=0, MinEdgeLength=0.0001, MinTolerance=0, Refine=True, RefineAngle=0, RelativeTolerance=0.65, SimplePlanes=True, Tolerance=0})
M = ClusterOutput(mesh)

# ==== cluster Cluster_3
brep = Brep([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])
mesh = MeshBrep(
    Brep=brep,
    Settings={GridMaxCount=0, GridMinCount=16, JaggedSeams=False, MaxEdgeLength=0, MinEdgeLength=0.0001, MinTolerance=0, Refine=True, RefineAngle=0, RelativeTolerance=0.65, SimplePlanes=True, Tolerance=0})
M = ClusterOutput(mesh)

# ==== cluster Cluster_4
brep = Brep(<brep referenced from the Rhino model>)
brep_2 = Brep(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)
mesh = MeshBrep(
    Brep=brep_2,
    Settings={GridMaxCount=0, GridMinCount=16, JaggedSeams=False, MaxEdgeLength=0, MinEdgeLength=0.0001, MinTolerance=0, Refine=True, RefineAngle=0, RelativeTolerance=0.65, SimplePlanes=True, Tolerance=0})
M = ClusterOutput(mesh)

# ==== cluster Cluster_7
segment_height = ClusterInput()
segment_width = ClusterInput()
per_layer_speed = ClusterInput()
segment_height_2 = Number(segment_height)
segment_width_2 = Number(segment_width)
per_layer_speed_2 = Number(per_layer_speed)
segment_height_3 = Number(segment_height_2)
segment_width_3 = Number(segment_width_2)
per_layer_speed_3 = Number(per_layer_speed_2)
panel = Panel(per_layer_speed_3)
multiplication = Multiplication(A=per_layer_speed_3, B="1000")

correction_value_for_trimming = Number("1")

panel_2 = Panel("""3.3
9
13.9
18.8
24.1
27
31.91
33.78
37.91
41.9""")
panel_3 = Panel("""300
556
811
1067
1322
1578
1833
2089
2344
2600""")
correction_value_for_trimming_2 = Number("1")
multiplication_2 = Multiplication(A=segment_height_3, B=segment_width_3, C=correction_value_for_trimming, D=multiplication)
panel_4 = Panel("0.002")
panel_5 = Panel(segment_width_3)
maximum = Maximum(A=multiplication, B="2")
bounds = Bounds(Numbers=flatten(maximum))
deconstruct_domain = DeconstructDomain(Domain=bounds)  # -> Start, End
replace_items = ReplaceItems(List=maximum, Item=deconstruct_domain.Start, Indices="0", Wrap=False)
panel_6 = Panel(deconstruct_domain.Start)

k_mm3_s_per_screw_turn = Panel("0.82")
rotation_volume = Number(k_mm3_s_per_screw_turn)

flat_speed = ClusterInput()  # Flat Speed
trim_tree = TrimTree(Tree=replace_items, Depth=1)
stream_filter = StreamFilter(Gate=flat_speed, Stream0=maximum, Stream1=trim_tree)
dyanmic_flow_calibration = Python3Script(
    rpm_list=panel_3,
    mass_list=panel_2,
    extrude_time="60",
    material_density="1.27",
    layer_heights=simplify(segment_height_3),
    layer_widths=simplify(segment_width_3),
    flattening_factor=correction_value_for_trimming_2,
    robot_speeds=simplify(stream_filter))  # -> k1, calibrated_slope, calibrated_offset, vol_rate_required, rpm_required; inputs rpm_list: list of Double, mass_list: list of Double, extrude_time: Double, material_density: Double, layer_heights: tree of Double, layer_widths: tree of Double, flattening_factor: Double, robot_speeds: tree of Double
# ---------- dyanmic_flow_calibration: Python ----------
import Rhino
from Grasshopper.Kernel.Data import GH_Path
from Grasshopper import DataTree

def flatten_branch(tree, path):
    return list(tree.Branch(path))

# === INPUTS ===
# rpm_list, mass_list, extrude_time, material_density
# layer_heights_input  : DataTree[Double]
# layer_widths_input   : DataTree[Double]
# robot_speeds_input   : DataTree[Double]
# flattening_factor

# Step 1: Calibration (same as before)
if len(rpm_list) != len(mass_list):
    raise Exception("Calibration lists must be same length.")

# convert calibration masses -> volume flow (mm3/s)
vol_flows = []
dens_kg_mm3 = (material_density/1000.0)/1000.0

for m in mass_list:
    kg = m/1000.0
    vol_mm3_total = kg / dens_kg_mm3
    vol_flows.append(vol_mm3_total / extrude_time)

n = len(rpm_list)
sum_x = sum(rpm_list)
sum_y = sum(vol_flows)
sum_xx = sum([x*x for x in rpm_list])
sum_xy = sum([rpm_list[i]*vol_flows[i] for i in range(n)])
den = (n*sum_xx - sum_x*sum_x)

if den == 0:
    raise Exception("Calibration regression failed.")

k1 = (n*sum_xy - sum_x*sum_y)/den
k0 = (sum_y - k1*sum_x)/n

calibrated_slope = k1
calibrated_offset = k0

# Step 2: Build output tree
rpm_required_tree = DataTree[float]()
vol_rate_tree = DataTree[float]()

# Ensure both motion trees have the same branches
paths_h = layer_heights.Paths
paths_w = layer_widths.Paths
paths_v = robot_speeds.Paths

for path in paths_h:
    heights = flatten_branch(layer_heights, path)
    widths  = flatten_branch(layer_widths, path)
    speeds  = flatten_branch(robot_speeds, path)

    if not(len(heights)==len(widths)==len(speeds)):
        raise Exception(f"Branch {path} has mismatched counts.")

    rpm_branch = []
    vol_branch = []

    for h, w, v in zip(heights, widths, speeds):
        target_vol = v * w * h * flattening_factor
        vol_branch.append(target_vol)
        rpm_val = (target_vol - k0)/k1
        rpm_branch.append(rpm_val)

    rpm_required_tree.AddRange(rpm_branch, GH_Path(path.Indices))
    vol_rate_tree.AddRange(vol_branch, GH_Path(path.Indices))

rpm_required = rpm_required_tree
vol_rate_required = vol_rate_tree
# ---------- end dyanmic_flow_calibration ----------
panel_7 = Panel(dyanmic_flow_calibration.rpm_required)
max_speed = ClusterInput()
division = Division(A=multiplication_2, B=rotation_volume)
minimum = Minimum(A=dyanmic_flow_calibration.rpm_required, B=max_speed)
maximum_2 = Maximum(A=minimum, B="100")
rpm_required = ClusterOutput(maximum_2)  # rpm_required
division_2 = Division(A=maximum_2, B=dyanmic_flow_calibration.rpm_required)
capped_rpm = Panel(minimum)
multiplication_3 = Multiplication(A=stream_filter, B=division_2)
capped_speeds = ClusterOutput(multiplication_3)  # capped speeds
panel_8 = Panel(multiplication_3)

# ==== cluster Spiral
relay = ClusterInput()
number_slider = Slider(100, range=0..100)
divide_curve = DivideCurve(Curve=relay, Count=number_slider, Kinks=False)  # -> Points, Tangents, Parameters
flip_matrix = FlipMatrix(Data=divide_curve.Points)
polyline = PolyLine(Vertices=flip_matrix, Closed=False)
explode = Explode(Curve=polyline, Recursive=True)  # -> Segments, Vertices
end_points = EndPoints(Curve=explode.Segments)  # -> Start, End
range = Range(Domain=Domain(0, 1), Steps=expr("x-1", number_slider))
range_2 = Range(Domain=Domain(0, 1), Steps=number_slider)
vector_2pt = Vector2Pt(PointA=end_points.Start, PointB=end_points.End, Unitize=False)  # -> Vector, Length
flip_matrix_2 = FlipMatrix(Data=vector_2pt.Vector)
multiplication = Multiplication(A=flip_matrix_2, B=range)
move = Move(Geometry=divide_curve.Points, Motion=multiplication)  # -> Geometry, Transform
list_item = ListItem(List=flatten(relay), Index="-1", Wrap=True)
polyline_2 = PolyLine(Vertices=flatten(move.Geometry), Closed=False)
curve_curve = CurveCurve(CurveA=list_item, CurveB=polyline_2)  # -> Points, ParamsA, ParamsB
shatter = Shatter(Curve=polyline_2, Parameters=curve_curve.ParamsB)
shatter_2 = Shatter(Curve=list_item, Parameters=curve_curve.ParamsA)
interpolate = Interpolate(Vertices=flatten(move.Geometry), Degree=3, Periodic=False, KnotStyle=1)  # -> Curve, Length, Domain
number_slider_2 = Slider(20, range=0..100)
list_item_2 = ListItem(List=shatter_2, Index=0, Wrap=True)  # -> Item, Item1
list_item_3 = ListItem(List=shatter, Index=0, Wrap=True)  # -> Item, Item1, Item2
end_points_2 = EndPoints(Curve=relay)  # -> Start, End
number_slider_3 = Slider(0.1, range=0..1)
curve_closest_point = CurveClosestPoint(Point=end_points_2.Start, Curve=interpolate.Curve)  # -> Point, Parameter, Distance
curve = Curve([list_item_2.Item, list_item_2.Item1])
curve_2 = Curve(list_item_3.Item)
trim_tree = TrimTree(Tree=curve_closest_point.Parameter, Depth=1)
flip_matrix_3 = FlipMatrix(Data=curve_closest_point.Parameter)  # -> graft(Data)
flip_matrix_4 = FlipMatrix(Data=trim_tree)  # -> graft(Data)
shatter_3 = Shatter(Curve=interpolate.Curve, Parameters=flatten(flip_matrix_4))
trim_tree_2 = TrimTree(Tree=shatter_3, Depth=1)
flip_matrix_5 = FlipMatrix(Data=trim_tree_2)  # -> graft(Data)
extend_curve = ExtendCurve(Curve=flip_matrix_5, Type=0, Start="0", End="-2")
curve_3 = ClusterOutput(extend_curve)
