# Grasshopper definition DFL_3DP_PULSAR_DEV_T2_2026.gh (Grasshopper 1.0.8)
# plug-ins: Robots, Pufferfish

# ---- group: Setup Fixture
build_plate_center_x = Slider(600, range=500..800)
sandbox_x_gap = Slider(140, range=0..200)
benv0015_fixtures = ValueList({"Custom Fixture": 0, "Clay Cover": 5, "Clay Riser": 6, "Sand Box": 7, "Build Plate": 8}, selected="Build Plate")
adaptor_distance_from_table_edge = Slider(56, range=0..600)
robot_placement = ValueList({"Cart": 0, "Table": 1}, selected="Cart")
addition = Addition(A=sandbox_x_gap, B=90)

# ----
# Bead Control
retraction_movement_tolerance_mm = Panel("1")
nozzle_selection = ValueList({"1.5mm": 1, "3mm": 2, "5mm": 3}, selected="1.5mm")
bead_width = ValueList({"thin": 2, "medium": 3, "wide": 4}, selected="medium")
flat_speed_based_on_shortest_layer = BooleanToggle(False)
layer_time_s = Panel("40")
multiplication = Multiplication(A=nozzle_selection, B=bead_width)
bead_width_2 = Panel(multiplication)
layer_height = Panel(nozzle_selection)

cylander_padding = Panel("20")

# ---- group: Setup Fixture
# Fixture Setup
stock = ValueList({"100 x 100 slab": 0, "200 x 200 slab": 1, "90 dia Cylander": 2, "90 dia Taper Cylander": 3, "sandbox": 4}, selected="90 dia Cylander")
sand_height = Panel("25")
cylander_height = Panel("195")
dfl_ur_fixutres = DFLURFixutres(
    A_2=adaptor_distance_from_table_edge,
    A="0",
    i_2=robot_placement,
    d2=build_plate_center_x,
    i=benv0015_fixtures,
    F=addition)  # -> G, adaptorplate_2, G_2, fixture_z, fixture_x, i_4, i_3, point
dfl_make_stock = DFLMakeStock(G=stock, relay=dfl_ur_fixutres.point, num=cylander_height, padded_dist=cylander_padding, num_2=sand_height)  # -> brep_4, pln_3, pln_4, surfaces, brep_2
table = ColourSwatch(SwatchColor=RGB(217, 185, 126))
pln = Plane(dfl_make_stock.pln_3)
preview = CustomPreview(Geometry=dfl_make_stock.brep_4, Material=ColourSwatch(SwatchColor=RGBA(255, 239, 161, 131)))
table_2 = CustomPreview(Geometry=dfl_ur_fixutres.G, Material=table)
mounts = CustomPreview(
    Geometry=[dfl_ur_fixutres.adaptorplate_2, dfl_ur_fixutres.G_2],
    Material=ColourSwatch(SwatchColor=RGBA(152, 149, 158, 165)))
fixture = CustomPreview(Geometry=[dfl_ur_fixutres.i_4, dfl_ur_fixutres.i_3], Material=ColourSwatch(SwatchColor=RGB(214, 214, 214)))

# ----
# Weave Settings
weave_density_point_count = Slider(40, range=0..100)
weave_depth = Slider(2, range=0..10)
panel = Panel("""0
1""")
weave_flip_control = Panel("""0
0
1""")
weave_application_pattern = Panel("1")

# ----
# Polyline Settings
distance_tolerance = Slider(1, range=0..1)
angle_tolerance = Slider(30, range=0..100)

brep = Brep(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)
weave_depth_2 = Slider(2, range=0..10)

# ----
# Seam
snap_seam_to_corners = BooleanToggle(False)
set_seam_iteratively = BooleanToggle(True)
align_seam = BooleanToggle(True)
alignment_point = Point(Point(-14, -125, 0))

cyl = Cylinder(Base=PlaneXY(0, 0, 0), Radius=Slider(178, range=0..1000), Length=Slider(100, range=0..100))

# ----
# Basic Print Details
contouring_type = ValueList({"Waterline": 0, "45 Degree": 1}, selected="Waterline")
print_sequence = ValueList({"Per Object": 0, "Per Layer": 1}, selected="Per Object")
brep_or_mesh = Geometry(cyl)
cluster = Cluster_6(gate=contouring_type)

# ---- group: Robots library
list = RobotsLibrary({"UR3e", "UR5e", "UR10e", "UR16e", "UR3", "UR5", "UR10", "UR20", "UR30"}, selected="UR5", Type=0)

# ----
# Robot Setup
inital_pose_axis_values_in_degrees = Panel("""0
-95
-68
-86
91
0""")
loadrobot = LoadRobotSystem(Name=list, Base=PlaneXY(0, 0, 0))
degrees_to_radians = DegreesToRadians(Degrees=inital_pose_axis_values_in_degrees, RobotSystem=loadrobot, MechanicalGroup=0)

# ---- group: End Effector / Optional Pen/knife
weight = Panel("0.1")
width_dia = Panel("15")
length = Panel("130")

# ---- group: End Effector
benv_0015_tools = ValueList({"Pen Holder": 3, "Clay Tool": 4, "Clay Tool With Insert": 5}, selected="Pen Holder")
tool = Tool(i=benv_0015_tools, length=length, dia_width=width_dia, weight=weight)  # -> tool_2, tcp

# ----
zone_accuracy = Slider(1, range=-0.01..2)
controlled_speed = Slider(60, range=1..100)
transfer_speed = Slider(100, range=1..100)

# ---- group: Contouring
# CONTOURING
layer_width = Number(bead_width_2)
slice_direction = Vector(cluster)
layer_height_2 = Number(layer_height)
contouring = Contouring(
    polyline_tolerance=distance_tolerance,
    angle_tolerance=degrees(angle_tolerance),
    brep_or_mesh_single_or_multiple=brep_or_mesh,
    layer_height=layer_height_2,
    layer_width=layer_width,
    print_sequence=print_sequence,
    contour_direction=slice_direction,
    align_seam=align_seam,
    seam_alignment_point=alignment_point,
    snap_seam=snap_seam_to_corners,
    iterative_seam=set_seam_iteratively,
    weave_outer_depth=weave_depth,
    weave_inner_depth=weave_depth_2,
    weave_density_point_count=weave_density_point_count,
    weave_application_pattern=weave_application_pattern,
    weave_flip_control=weave_flip_control,
    weave_pattern=panel)  # -> polyline_2, spiral_2, weave_3, status_messages

# ---- group: PULSAR
pt = Point(<point referenced from the Rhino model>)
yz = YZPlane(Origin=pt)
pulsar_with_part_cooing = Mesh([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])
include_part_cooling_fan = BooleanToggle(True)
pulsar = Mesh([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])
mjoin = MeshJoin(Meshes=pulsar)
mjoin_2 = MeshJoin(Meshes=pulsar_with_part_cooing)
filter = StreamFilter(Gate=include_part_cooling_fan, Stream0=mjoin, Stream1=mjoin_2)
tool_2 = CreateTool(Name="pulsar", TCP=yz, Weight="1.6", Mesh=filter)  # -> Tool, TCP
pln_2 = Plane(tool_2.TCP)

# ----
panel_2 = Panel(contouring.status_messages)

# ---- group: Basic Lead In
# LEADS
contours = Curve(contouring.polyline_2)
lead_in_distance = Slider(20, range=0..1000)
flip_lead_direction = BooleanToggle(False)
method = ValueList({"Lead In": 0, "Brim": 1}, selected="Lead In")
dfl_lead = DFLLead(
    adhesion_method=method,
    no_of_geos=brep_or_mesh,
    order=print_sequence,
    flip_lead_in_direction=flip_lead_direction,
    lead_in_distance=lead_in_distance,
    data=contours,
    bead_width=bead_width_2,
    no_of_loops=Slider(5, range=0..10))

# ----
list_2 = RobotsLibrary({"UR3e", "UR5e", "UR10e", "UR16e", "UR3", "UR5", "UR10", "UR20", "UR30"}, selected="UR5e", Type=0)
loadrobotsystem = LoadRobotSystem(Name=list_2, Base=PlaneXY(0, 0, 0))
pt_2 = ConstructPoint(XCoordinate=Slider(506, range=0..1000), YCoordinate=0, ZCoordinate="40")

# ----
# BED ORIENT / FIRST LAYER
panel_3 = Panel("200 to -200")
rectangle = Rectangle(Plane=dfl_ur_fixutres.point, XSize=panel_3, YSize=panel_3, Radius=0)  # -> Rectangle, Length
surface = Surface(rectangle.Rectangle)
unit_z = UnitZ(FirstLayerHeight=layer_height)
cluster_2 = Cluster(bed_surface_mesh=surface, path=dfl_lead)
move = Move(Geometry=cluster_2, Motion=unit_z)  # -> Geometry, Transform

pt_3 = Point(pt_2)

# ---- group: Base Contours
# POINTS
explode = Explode(Curve=move.Geometry, Recursive=True)  # -> Segments, Vertices
trim_tree = TrimTree(Tree=explode.Vertices, Depth=1)

# ---- group: Layer Speed
layers = Data(move.Geometry)
print_sequence_2 = Data(print_sequence)
layer_time = Data(layer_time_s)
cluster_3 = Cluster_2(
    print_sequence=print_sequence_2,
    layers=layers,
    layer_time=layer_time,
    print_sequence_2=print_sequence_2,
    layers_2=layers,
    layer_time_2=layer_time)  # -> data, layer_speed_4, relay, s_0, layer_speed_2, relay_2

# ---- group: Compare End Points of Subsequent Layers
tree_statistics = TreeStatistics(Tree=trim_tree)  # -> Paths, Length, Count
# This section takes the list of contour points, duplicates it once, and removes the first and last layer from each respective copy.
# 
# With these copies, each set of end and following start points can be compared with no issues relating to list wrapping (This is so the first and last point of the entire print are not considered)
# 
# The purpose is for finding the layer transfer movement lenght to determine whether a reatract movement is required. The tolerance for this distance can be chosen in retraction movment tolerance.
panel_4 = Panel("0")
list_item = ListItem(List=tree_statistics.Paths, Index="-1", Wrap=True)
list_item_2 = ListItem(List=tree_statistics.Paths, Index=panel_4, Wrap=True)
split_tree = SplitTree(Data=trim_tree, Masks=flatten(list_item))  # -> Positive, Negative
split_tree_2 = SplitTree(Data=trim_tree, Masks=flatten(list_item_2))  # -> Positive, Negative
list_item_3 = ListItem(List=split_tree_2.Negative, Index="0", Wrap=True)
list_item_4 = ListItem(List=split_tree.Negative, Index="-1", Wrap=True)

# ---- group: Set to flat machine speed
boolean = Boolean(flat_speed_based_on_shortest_layer)

# ----
# Speed + Extrusion
_1_5mm_nozzle = Panel("1200")
_3mm_nozzle = Panel("2400")
stream_filter = StreamFilter(Gate=nozzle_selection, Stream0=_1_5mm_nozzle, Stream1=_3mm_nozzle, Stream2=_3mm_nozzle)
layer_height_3 = Data(layer_height)
layer_width_2 = Data(bead_width_2)
cluster_4 = Cluster_4(
    item=layer_height_3,
    max_speed=stream_filter,
    layer_speed=cluster_3.layer_speed_2,
    flat_speed=boolean,
    item_2=layer_width_2)  # -> result, layer_extrusion_rate

panel_5 = Panel(cluster_4.layer_extrusion_rate)
panel_6 = Panel(cluster_4.result)

# ---- group: Transfer Movement Distance calculation
# RETRACTION
line = Line(StartPoint=list_item_4, EndPoint=list_item_3)
length_2 = Length(Curve=line)
multiplication_2 = Multiplication(A=bead_width_2, B=Slider(1, range=0..10))
larger_than = LargerThan(FirstNumber=length_2, SecondNumber=multiplication_2)  # -> LargerThan, OrEqualTo
cull_pattern = CullPattern(List=line, CullPattern=larger_than.LargerThan)
tree_statistics_2 = TreeStatistics(Tree=cull_pattern)  # -> Paths, Length, Count
cull_pattern_2 = CullPattern(List=tree_statistics_2.Paths, CullPattern=tree_statistics_2.Length)
split_tree_3 = SplitTree(Data=cull_pattern, Masks=flatten(cull_pattern_2))  # -> Positive, Negative

# ----
layer_speed = Data(cluster_3.layer_speed_2)
panel_7 = Panel(layer_speed)
round = Round(Number=panel_5)  # -> Nearest, Floor, Ceiling
panel_8 = Panel(round.Nearest)
minimum = Minimum(A=panel_8, B="0")
replace_text = ReplaceText(Text="MDPE_Forward(x)", Find="x", Replace=panel_8, RecursiveReplace=False)
list_item_5 = ListItem(List=replace_text, Index=0, Wrap=True)

# ---- group: Add branch for calcuated retract movements
path_mapper = PathMapper(split_tree_3.Positive, source="{A;B}(i)", target="{A;B;i}")

# ---- group: Retract Operation
entry_height = Slider(5, range=0..10)
wipe_distance = Slider(10, range=0..100)
exit_height = Slider(10, range=0..100)
cluster_5 = Cluster_5(
    curve=path_mapper,
    data_2=move.Geometry,
    factor=entry_height,
    value=wipe_distance,
    data=trim_tree,
    factor_2=exit_height,
    second_number=multiplication_2)

# ----
xz_plane = XZPlane(Origin=trim_tree)
xz_plane_2 = XZPlane(Origin=trim_tree)
init3dp_pose_axis_values_in_degrees = Panel("""0
-90
-90
-180
-90
180""")
home_pose_values = Panel("""0
-90
0
-90
0
0""")
home_intermediate_values = Panel("""0
-90
-45
-200
-0
180""")
rotate = Rotate(Geometry=xz_plane, Angle=degrees(Slider(90, range=-180..180)), Plane=xz_plane_2)  # -> Geometry, Transform
xy_plane = XYPlane(Origin=rotate.Geometry)
rotate_2 = Rotate(Geometry=rotate.Geometry, Angle=degrees(Slider(-180, range=-180..180)), Plane=xy_plane)  # -> Geometry, Transform
flip_plane = FlipPlane(Plane=rotate_2.Geometry, FlipX=Toggle(True), FlipY=Toggle(False), FlipZ=Toggle(False))  # -> Flipped, ResultBoolean

controlled_speed_2 = Slider(100, range=1..100)
transfer_speed_2 = Slider(100, range=1..100)
zone_accuracy_2 = Slider(1, range=0..5)

merge = Merge(Data1=trim_tree, Data2=cluster_5)

tree_statistics_3 = TreeStatistics(Tree=move.Geometry)  # -> Paths, Length, Count
split_tree_4 = SplitTree(Data=merge, Masks=flatten(tree_statistics_3.Paths))  # -> Positive, Negative
curve = Curve(line)
boolean_2 = Boolean(larger_than.LargerThan)
polyline = PolyLine(Vertices=split_tree_4.Positive, Closed=False)
polyline_2 = PolyLine(Vertices=split_tree_4.Negative, Closed=False)
colour_swatch = ColourSwatch(SwatchColor=RGB(0, 221, 255))
cull_pattern_3 = CullPattern(List=curve, CullPattern=invert(boolean_2))
custom_preview = CustomPreview(Geometry=polyline_2, Material=ColourSwatch(SwatchColor=RGB(255, 0, 0)))
custom_preview_2 = CustomPreview(Geometry=polyline, Material=colour_swatch)
custom_preview_3 = CustomPreview(Geometry=cull_pattern_3, Material=colour_swatch)

robot_system = RobotSystemParameter()
unit_x = UnitX(Factor=1)
Y = UnitY(Factor=1)
contouring_type_boolean = Boolean(contouring_type)
rotate_3d = Rotate3D(Geometry=flip_plane.Flipped, Angle=degrees(Slider(90, range=-90..90)), Center=flip_plane.Flipped, Axis=unit_x)  # -> Geometry, Transform
stream_filter_2 = StreamFilter(Gate=contouring_type_boolean, Stream0=flip_plane.Flipped, Stream1=rotate_3d.Geometry)
clean = CleanTree(RemoveNulls=True, RemoveInvalid=True, RemoveEmpty=False, Tree=stream_filter_2)
panel_9 = Panel(clean)
item = ListItem(List=flatten(rotate_3d.Geometry), Index=0, Wrap=True)  # -> Item1, Item
pln_3 = Plane()

job_done_popup = Panel("Job Complete! Please put all the caps back on the pens and tidy up!")
code = Panel("""popup("[Popup]", title="Job_Done", warning=False, error=False, blocking=True)
  duet_close()""")
rep = ReplaceText(Text=code, Find="[Popup]", Replace=job_done_popup, RecursiveReplace=False)
customcommand = CustomCommand(Name="Pulsar_End", Manufacturer="UR", Code=rep)

code_2 = Panel("""duet_open("172.22.22.100", 23)
  pulsar_clear_heater_faults()
  pulsar_preheat([Barrell], [Nozzle])""")
barrel_temp = Panel("190")
nozzle_temp = Panel("215")
rep_2 = ReplaceText(Text=code_2, Find="[Barrell]", Replace=barrel_temp, RecursiveReplace=False)
rep_3 = ReplaceText(Text=rep_2, Find="[Nozzle]", Replace=nozzle_temp, RecursiveReplace=False)
decleration = Panel("""debug_pulsar_ready = True
  pulsar_ready_pin   = 0

  def duet_open(ip, port):
    socket_open(ip, port, "duet")
    sleep(0.2)
  end

  def duet_close():
    socket_close("duet")
  end

  def duet_send_line(line):
    socket_send_line(line, "duet")
  end

  def duet_send_line_and_read(line, timeout):
    socket_send_line(line, "duet")
    sleep(0.05)
    resp = socket_read_string("duet", "", "", False, timeout)
    return resp
  end

  def duet_handshake(timeout):
    resp = duet_send_line_and_read("M115", timeout)
    if (resp != ""):
      return True
    end
    return False
  end

  def pulsar_clear_heater_faults():
    duet_send_line("M98 P\"pulsar_clear_faults.g\"")
    sleep(0.1)
  end

  def pulsar_preheat(barrel, nozzle):
    cmd = "M98 P\"pulsar_preheat.g\" B" + to_str(barrel) + " N" + to_str(nozzle)
    duet_send_line(cmd)
  end

  def wait_for_pulsar_enabled(debug, pin):
    if (debug == False):
      while (get_standard_digital_in(pin) == False):
        sleep(0.5)
      end
    end
  end

  def pulsar_start_extrusion(feed, flow):
    cmd = "M98 P\"pulsar_start.g\" F" + to_str(feed) + " R" + to_str(flow)
    duet_send_line(cmd)
  end

  def pulsar_flow_on(flow):
    duet_send_line("M98 P\"pulsar_flow.g\" S" + to_str(flow))
  end

  def pulsar_flow_off():
    duet_send_line("M98 P\"pulsar_flow.g\" S0")
  end

  def pulsar_retract(mm, feed):
    duet_send_line("M98 P\"pulsar_retract.g\" S" + to_str(mm) + " F" + to_str(feed))
  end

  def pulsar_unretract(mm, feed):
    duet_send_line("M98 P\"pulsar_unretract.g\" S" + to_str(mm) + " F" + to_str(feed))
  end

  def pulsar_stop_extrusion():
    duet_send_line("M98 P\"pulsar_stop.g\"")
  end

  def pulsar_cooldown():
    duet_send_line("M98 P\"pulsar_cooldown.g\"")
  end""")
customcommand_2 = CustomCommand(Name="Pulsar_Setup", Manufacturer="UR", Code=rep_3, Declaration=decleration)

code_3 = Panel("""wait_for_pulsar_enabled(debug_pulsar_ready, pulsar_ready_pin)
  popup("[Popup]", title="Operator_Safety", warning=False, error=False, blocking=True)
  pulsar_start_extrusion(900, [%])""")
popup_message = Panel("Press Continue to start your print")
extrusion_rate = Panel("900")
extrusion_scale = Panel("100")
rep_4 = ReplaceText(Text=code_3, Find="[Popup]", Replace=popup_message, RecursiveReplace=False)
rep_5 = ReplaceText(Text=rep_4, Find="[Extrusion]", Replace=extrusion_rate, RecursiveReplace=False)
rep_6 = ReplaceText(Text=rep_5, Find="[%]", Replace=extrusion_scale, RecursiveReplace=False)
customcommand_3 = CustomCommand(Name="Pulsar_Start", Manufacturer="UR", Code=rep_6)

multiplication_3 = Multiplication(A=extrusion_rate, B=0.66)
code_4 = Panel("""pulsar_flow_off()
  pulsar_retract([LD], [LE])
  pulsar_stop_extrusion()
  pulsar_cooldown()""")
de_extrude_distance = Panel("3")
de_extrude_rate = Panel(multiplication_3)
rep_7 = ReplaceText(Text=code_4, Find="[LD]", Replace=de_extrude_distance, RecursiveReplace=False)
rep_8 = ReplaceText(Text=rep_7, Find="[LE]", Replace=de_extrude_rate, RecursiveReplace=False)
customcommand_4 = CustomCommand(Name="Pulsar_Stop", Manufacturer="UR", Code=rep_8)

pln_4 = Plane(item.Item1)
createtarget = CreateTarget(
    Plane=pln_4,
    Configuration=5,
    Motion="Joint",
    Tool=tool_2.Tool,
    Speed=controlled_speed_2,
    Zone=zone_accuracy_2,
    Command=customcommand_4,
    IsCartesian=True)

multiplication_4 = Multiplication(A=extrusion_rate, B=0.66)
code_5 = Panel("""pulsar_flow_off()
  pulsar_retract([LD], [LE])""")
de_extrude_distance_2 = Panel("3")
de_extrude_rate_2 = Panel(multiplication_4)
rep_9 = ReplaceText(Text=code_5, Find="[LD]", Replace=de_extrude_distance_2, RecursiveReplace=False)
rep_10 = ReplaceText(Text=rep_9, Find="[LE]", Replace=de_extrude_rate_2, RecursiveReplace=False)
customcommand_5 = CustomCommand(Name="Pulsar_Pre_Travel", Manufacturer="UR", Code=rep_10)

multiplication_5 = Multiplication(A=extrusion_rate, B=0.66)
code_6 = Panel("""pulsar_unretract([LD], [LE])
  pulsar_flow_on([%])""")
de_extrude_distance_3 = Panel("3")
de_extrude_rate_3 = Panel(multiplication_5)
rep_11 = ReplaceText(Text=code_6, Find="[LD]", Replace=de_extrude_distance_3, RecursiveReplace=False)
rep_12 = ReplaceText(Text=rep_11, Find="[LE]", Replace=de_extrude_rate_3, RecursiveReplace=False)
customcommand_6 = CustomCommand(Name="Pulsar_Post_Travel", Manufacturer="UR", Code=rep_12)

smooth_transition_post_values = Panel("""0
-90
-90
-180
-90
180""")
home_pose_values_2 = Panel("""0
-90
0
-90
0
0""")
degrees_to_radians_2 = DegreesToRadians(Degrees=smooth_transition_post_values, RobotSystem=loadrobotsystem, MechanicalGroup=0)
degrees_to_radians_3 = DegreesToRadians(Degrees=home_pose_values_2, RobotSystem=loadrobotsystem, MechanicalGroup=0)
createtarget_2 = CreateTarget(
    Joints=degrees_to_radians_3,
    Tool=tool_2.Tool,
    Speed=controlled_speed_2,
    Zone=zone_accuracy_2,
    Command=customcommand_2,
    IsCartesian=False)
createtarget_3 = CreateTarget(Joints=degrees_to_radians_2, Tool=tool_2.Tool, Speed=controlled_speed_2, Zone=zone_accuracy_2, IsCartesian=False)
merge_2 = Merge(Data1=createtarget_2, Data2=createtarget_3)

code_7 = Panel("pulsar_flow_on([%])")
flow = Panel("75")
rep_13 = ReplaceText(Text=code_7, Find="[%]", Replace=flow, RecursiveReplace=False)
customcommand_7 = CustomCommand(Name="Pulsar_Flow", Manufacturer="UR", Code=rep_13)

pln_5 = Plane(Plane(origin=(392.1394935, -266.5069343, 312.7736288), x=(1, 0, 0), y=(0, -1, 0)))
createtarget_4 = CreateTarget(
    Plane=pln_5,
    Configuration=5,
    Tool=tool_2.Tool,
    Speed=controlled_speed_2,
    Zone=zone_accuracy_2,
    Command=customcommand,
    IsCartesian=True)

merge_3 = Merge(Data1="[Barrell]", Data2="[Nozzle]", Data3="[Popup]", Data4="[LD]", Data5="[LE]", Data6="[%]")

pln_6 = Plane(Plane(origin=(392.1394935, -266.5069343, 312.7736288), x=(1, 0, 0), y=(0, -1, 0)))
list_3 = FlagFields({"Shoulder": 1, "Elbow": 2, "Wrist": 4}, selected=["Shoulder", "Elbow"])
createtarget_5 = CreateTarget(
    Plane=pln_6,
    Configuration=list_3,
    Tool=tool_2.Tool,
    Speed=controlled_speed_2,
    Zone=zone_accuracy_2,
    Command=customcommand_5,
    IsCartesian=True)

panel_10 = Panel(merge_3)

list_4 = FlagFields({"Shoulder": 1, "Elbow": 2, "Wrist": 4}, selected="Shoulder")
pln_7 = Plane(Plane(origin=(392.1394935, -266.5069343, 312.7736288), x=(1, 0, 0), y=(0, -1, 0)))
createtarget_6 = CreateTarget(
    Plane=pln_7,
    Configuration=list_4,
    Tool=tool_2.Tool,
    Speed=transfer_speed_2,
    Zone=zone_accuracy_2,
    Command=customcommand_6,
    IsCartesian=True)

list_5 = FlagFields({"Shoulder": 1, "Elbow": 2, "Wrist": 4}, selected="Shoulder")
pln_8 = Plane(Plane(origin=(392.1394935, -266.5069343, 312.7736288), x=(1, 0, 0), y=(0, -1, 0)))
createtarget_7 = CreateTarget(
    Plane=pln_8,
    Configuration=list_5,
    Tool=tool_2.Tool,
    Speed=controlled_speed_2,
    Zone=zone_accuracy_2,
    Command=customcommand_7,
    IsCartesian=True)

createtarget_8 = CreateTarget(
    Plane=flatten(rotate_3d.Geometry),
    Configuration=5,
    Tool=tool_2.Tool,
    Speed=controlled_speed_2,
    Zone=zone_accuracy_2,
    IsCartesian=True)

# ---- group: Flag fields
list_6 = FlagFields({"Shoulder": 1, "Elbow": 2, "Wrist": 4}, selected="Shoulder")

# ----
popup_title_no_spaces = Panel("Operator_Safety")
popup_text = Panel("Press Ready to start your print")
pln_9 = Plane(Plane(origin=(392.1394935, -266.5069343, 312.7736288), x=(1, 0, 0), y=(0, -1, 0)))
dfl_ur_custom_popup = DFLURCustomPopup(N=popup_title_no_spaces, B=popup_text)
createtarget_9 = CreateTarget(
    Plane=pln_9,
    Configuration=list_6,
    Tool=tool_2.Tool,
    Speed=transfer_speed_2,
    Zone=zone_accuracy_2,
    Command=dfl_ur_custom_popup,
    IsCartesian=True)

createtarget_10 = CreateTarget(IsCartesian=True)
machine_speeds = Number()
extrusion_rates = Number(flatten(panel_8))

# ---- group: Save URP / Program Name
# Save
panel_11 = Panel("PULSTEST9")

# ----
bounds = Bounds(Numbers=machine_speeds)
bounds_2 = Bounds(Numbers=extrusion_rates)
quick_graph = QuickGraph(machine_speeds, SortOrder=0)
quick_graph_2 = QuickGraph(extrusion_rates, SortOrder=0)
panel_12 = Panel(bounds)
panel_13 = Panel(bounds_2)

item_2 = ListItem(List=flatten(rotate_3d.Geometry), Index=0, Wrap=True)

pln_10 = Plane(item_2)

createtarget_11 = CreateTarget(
    Plane=pln_10,
    Configuration=5,
    Motion="Joint",
    Tool=tool_2.Tool,
    Speed=controlled_speed_2,
    Zone=zone_accuracy_2,
    Command=customcommand_3,
    IsCartesian=True)

merge_4 = Merge(
    Data1=flatten(merge_2),
    Data2=flatten(createtarget_11),
    Data3=flatten(createtarget_8),
    Data4=flatten(createtarget),
    Data5=flatten(createtarget_4))  # -> flatten(Result)
deconstructtarget = DeconstructTarget(Target=merge_4)  # -> Joints, Plane
clean_2 = CleanTree(RemoveNulls=True, RemoveInvalid=True, RemoveEmpty=False, Tree=deconstructtarget.Plane)
createprogram = CreateProgram(Name=panel_11, RobotSystem=loadrobotsystem, Targets=merge_4, StepSize=1)  # -> Program, Code, Duration, Warnings, Errors
point = Point(clean_2)

# ---- group: Simulate
# Simulate Preview Export
sim_slider = Slider(0, range=0..1)
program_simulation = ProgramSimulation(Program=createprogram.Program, Time=sim_slider, Normalized=True)  # -> SystemMeshes, JointRotations, Plane, Index, Time, flatten(Program), Errors

# ---- group: Analysis
any_program_warnings = Panel(createprogram.Warnings)
any_program_errors = Panel(createprogram.Errors)
degrees = Degrees(Radians=graft(program_simulation.JointRotations))  # -> simplify(Degrees)
each_axis_rotation_analysis = Panel(degrees)

# ----
deconstruct = Deconstruct(Point=point)  # -> XComponent, YComponent, flatten(ZComponent)

# ---- group: Save URP
save_as_urp = Button()
select_directory = FilePath("/Users/z3528358/Desktop/")
set_as_your_usb_drive = Panel(select_directory)
dispatch = Dispatch(List=set_as_your_usb_drive, DispatchPattern=save_as_urp)  # -> ListA, ListB
saveprog = SaveProgram(Program=program_simulation.Program, Folder=dispatch.ListA)

# ---- group: Preview Robot
tool_colour = ColourSwatch(SwatchColor=RGB(168, 168, 168))
custom_preview_4 = CustomPreview(Geometry=program_simulation.SystemMeshes, Material=tool_colour)

# ----
deconstruct_plane = DeconstructPlane(Plane=point)  # -> Origin, XAxis, YAxis, ZAxis

# ---- group: Preview Robot / Colour Swatch
trail = SimpleTrail(Program=program_simulation.Program, Length=500, MechanicalGroup=0)

# ----
z_height_display = QuickGraph(deconstruct.ZComponent, SortOrder=0)
average = Average(Input=flatten(deconstruct_plane.YAxis))
average_2 = Average(Input=flatten(deconstruct_plane.XAxis))
average_3 = Average(Input=flatten(deconstruct_plane.ZAxis))
panel_14 = Panel(createprogram.Code)
panel_15 = Panel([average_2, average, average_3])

multiplication_6 = Multiplication(A=extrusion_rate, B=0.66)
code_8 = Panel("""pulsar_flow_off()
  pulsar_retract([LD], [LE])
  popup("[Popup]", title="Pause", warning=False, error=False, blocking=True)
  pulsar_unretract([LD], [LE])
  pulsar_flow_on([%])""")
de_extrude_distance_4 = Panel("3")
de_extrude_rate_4 = Panel(multiplication_6)
pause_popup = Panel("Paused, Click Continue to resume")
rep_14 = ReplaceText(Text=code_8, Find="[LD]", Replace=de_extrude_distance_4, RecursiveReplace=False)
rep_15 = ReplaceText(Text=rep_14, Find="[LE]", Replace=de_extrude_rate_4, RecursiveReplace=False)

rep_16 = ReplaceText(Text=rep_15, Find="[Popup]", Replace=pause_popup, RecursiveReplace=False)

customcommand_8 = CustomCommand(Name="Pulsar_Pause", Manufacturer="UR", Code=rep_16)

pln_11 = Plane(Plane(origin=(392.1394935, -266.5069343, 312.7736288), x=(1, 0, 0), y=(0, -1, 0)))
list_7 = FlagFields({"Shoulder": 1, "Elbow": 2, "Wrist": 4}, selected=["Shoulder", "Elbow"])
createtarget_12 = CreateTarget(
    Plane=pln_11,
    Configuration=list_7,
    Tool=tool_2.Tool,
    Speed=controlled_speed_2,
    Zone=zone_accuracy_2,
    Command=customcommand_8,
    IsCartesian=True)

# ==== cluster Cluster
panel = Panel("Path")
bed_surface_mesh = ClusterInput()
path = ClusterInput()  # Path
bounding_box = BoundingBox(Content=flatten(path), Plane=PlaneXY(0, 0, 0), UnionBox=True)  # -> Box, Box_2
deconstruct_brep = DeconstructBrep(Brep=bounding_box.Box)  # -> Faces, Edges, Vertices
area = Area(Geometry=deconstruct_brep.Faces)  # -> Area, Centroid
deconstruct = Deconstruct(Point=area.Centroid)  # -> XComponent, YComponent, ZComponent
rectangle = Rectangle(Plane=PlaneXY(0, 0, 0), XSize=Domain(-1, 1), YSize=Domain(-2, 2), Radius=0)  # -> Rectangle, Length
bed_surface_mesh_2 = Surface(bed_surface_mesh)
sort_list = SortList(Keys=deconstruct.ZComponent, ValuesValuesA=deconstruct_brep.Faces)  # -> Keys, ValuesValuesA
surface = Surface(rectangle.Rectangle)
list_item = ListItem(List=sort_list.ValuesValuesA, Index=0, Wrap=True)
flip = Flip(Surface=bed_surface_mesh_2, Guide=surface)  # -> Surface, Result
md_slider = MDSlider(
    SliderMode=0,
    slider_value=Point(0.5037536621, 0.5022096634, 0.5),
    x_domain=Domain(0, 1),
    y_domain=Domain(0, 1),
    z_domain=Domain(0, 1))
area_2 = Area(Geometry=list_item)  # -> Area, Centroid
evaluate_surface = EvaluateSurface(Surface=reparameterize(flip.Surface), Point=md_slider)  # -> Point, Normal, UDirection, VDirection, Frame
orient = Orient(Geometry=path, Source=flatten(area_2.Centroid), Target=flatten(evaluate_surface.Frame))  # -> Geometry, Transform
path_2 = ClusterOutput(orient.Geometry)  # Path

# ==== cluster DFLLead
lead_in_settings = ClusterInput()  # -- LEAD IN SETTINGS --
adhesion_method = ClusterInput()  # Adhesion Method
flip_lead_in_direction = ClusterInput()  # Flip Lead-in Direction
lead_in_distance = ClusterInput()  # Lead in Distance
no_of_geos = ClusterInput()  # no. of geos
list_length = ListLength(List=no_of_geos)
larger_than = LargerThan(FirstNumber=list_length, SecondNumber="1")  # -> LargerThan, OrEqualTo
order = ClusterInput()  # order
invert_boolean = InvertBoolean(Boolean=order)  # -> Inverted, Number
gate_and = GateAnd(A=larger_than.LargerThan, B=invert_boolean.Inverted)
data = ClusterInput()
data_2 = Data(data)
brim_settings = ClusterInput()  # -- BRIM SETTINGS --
bead_width = ClusterInput()  # bead width
no_of_loops = ClusterInput()  # No. of Loops
stream_filter = StreamFilter(Gate=gate_and, Stream0="{0;?}", Stream1="{?;0}")
multiplication = Multiplication(A=bead_width, B="0.8")
split_tree = SplitTree(Data=data_2, Masks=flatten(stream_filter))  # -> Positive, Negative
series = Series(Start=multiplication, Step=multiplication, Count=no_of_loops)
offset_curve = OffsetCurve(Curve=split_tree.Positive, Distance=series, Corners=1)
perp_frame = PerpFrame(Curve=reparameterize(split_tree.Positive), Parameter="0")
unit_z = UnitZ(Factor=1)
trim_tree = TrimTree(Tree=offset_curve, Depth=1)
align_plane = AlignPlane(Plane=perp_frame, Direction=unit_z)  # -> Plane, Angle
reverse_list = ReverseList(List=trim_tree)
deconstruct_plane = DeconstructPlane(Plane=align_plane.Plane)  # -> Origin, XAxis, YAxis, ZAxis
amplitude = Amplitude(Vector=deconstruct_plane.YAxis, Amplitude=lead_in_distance)
merge = Merge(Data1=simplify(reverse_list), Data2=simplify(split_tree.Positive))
graft_tree = GraftTree(Tree=flatten(merge), IncludeEmptyLists=True, IncludeNullItems=True)
negative = Negative(Value=amplitude)
graft_tree_2 = GraftTree(Tree=merge, IncludeEmptyLists=True, IncludeNullItems=True)
stream_filter_2 = StreamFilter(Gate=flip_lead_in_direction, Stream0=amplitude, Stream1=negative)
stream_filter_3 = StreamFilter(Gate=gate_and, Stream0=graft_tree, Stream1=graft_tree_2)
move = Move(Geometry=deconstruct_plane.Origin, Motion=stream_filter_2)  # -> Geometry, Transform
line = Line(StartPoint=move.Geometry, EndPoint=deconstruct_plane.Origin)
trim_tree_2 = TrimTree(Tree=line, Depth=1)
merge_2 = Merge(Data1=stream_filter_3, Data2=split_tree.Negative)
reverse_list_2 = ReverseList(List=trim_tree_2)
construct_tree_branch = ConstructTreeBranch(BranchPath="{0;0}", BranchItems=line)
merge_3 = Merge(Data1=simplify(reverse_list_2), Data2=simplify(split_tree.Positive))
graft_tree_3 = GraftTree(Tree=flatten(merge_3), IncludeEmptyLists=True, IncludeNullItems=True)
graft_tree_4 = GraftTree(Tree=merge_3, IncludeEmptyLists=True, IncludeNullItems=True)
split_tree_2 = SplitTree(Data=data_2, Masks=flatten("{0;?}"))  # -> Positive, Negative
stream_filter_4 = StreamFilter(Gate=gate_and, Stream0=graft_tree_3, Stream1=graft_tree_4)
path_mapper = PathMapper(split_tree_2.Positive, source="{a;x}", target="{a;x+1}")
merge_4 = Merge(Data1=stream_filter_4, Data2=split_tree.Negative)
data_3 = Data(path_mapper)
stream_filter_5 = StreamFilter(Gate=adhesion_method, Stream0=merge_4, Stream1=merge_2)
merge_5 = Merge(Data1=construct_tree_branch, Data2=data_3, Data3=split_tree_2.Negative)
s_0 = ClusterOutput(stream_filter_5)

# ==== cluster Cluster_2
layer_time = ClusterInput()
layers = ClusterInput()
print_sequence = ClusterInput()
layer_time_2 = ClusterInput()
layers_2 = ClusterInput()
print_sequence_2 = ClusterInput()
layer_time_3 = Data(layer_time)
layers_3 = Data(layers)
layers_4 = Data(layers_2)
print_sequence_3 = Data(print_sequence)
print_sequence_4 = Data(print_sequence_2)
trim_tree = TrimTree(Tree=layers_3, Depth=1)
layer_time_4 = Data(layer_time_2)
trim_tree_2 = TrimTree(Tree=layers_4, Depth=1)
stream_filter = StreamFilter(Gate=print_sequence_3, Stream0=layers_3, Stream1=trim_tree)
length = Length(Curve=trim_tree_2)

# ---- group: Dynamic Print Speed
length_2 = Length(Curve=layers_4)
mass_addition = MassAddition(Input=length_2)  # -> Result, PartialResults
division = Division(A=mass_addition.Result, B=1000)
tree_statistics = TreeStatistics(Tree=layers_4)  # -> Paths, Length, Count
division_2 = Division(A=division, B=layer_time_4)  # -> simplify(Result)
construct_tree_branch = ConstructTreeBranch(BranchPath=graft(tree_statistics.Paths), BranchItems=graft(tree_statistics.Length))
duplicate_data = DuplicateData(Data=division_2, Number=construct_tree_branch, Order=True)  # -> simplify(Data)

# ----
relay = ClusterOutput(stream_filter)
relay_2 = ClusterOutput(layers_4)
mass_addition_2 = MassAddition(Input=length)  # -> Result, PartialResults
division_3 = Division(A=mass_addition_2.Result, B=1000)
tree_statistics_2 = TreeStatistics(Tree=trim_tree_2)  # -> Paths, Length, Count
division_4 = Division(A=division_3, B=layer_time_4)  # -> simplify(Result)
construct_tree_branch_2 = ConstructTreeBranch(BranchPath=graft(tree_statistics_2.Paths), BranchItems=graft(tree_statistics_2.Length))
duplicate_data_2 = DuplicateData(Data=division_4, Number=construct_tree_branch_2, Order=True)  # -> simplify(Data)
unflatten_tree = UnflattenTree(Tree=duplicate_data_2, Guide=layers_4)
stream_filter_2 = StreamFilter(Gate=print_sequence_4, Stream0=duplicate_data, Stream1=unflatten_tree)
panel = Panel(unflatten_tree)
layer_speed = Data(unflatten_tree)
s_0 = ClusterOutput(stream_filter_2)
layer_speed_2 = ClusterOutput(layer_speed)

# ---- group: Dynamic Print Speed
length_3 = Length(Curve=stream_filter)
mass_addition_3 = MassAddition(Input=length_3)  # -> Result, PartialResults
division_5 = Division(A=mass_addition_3.Result, B=1000)
tree_statistics_3 = TreeStatistics(Tree=layers_3)  # -> Paths, Length, Count
division_6 = Division(A=division_5, B=layer_time_3)  # -> simplify(Result)
construct_tree_branch_3 = ConstructTreeBranch(BranchPath=graft(tree_statistics_3.Paths), BranchItems=graft(tree_statistics_3.Length))

# ----
trim_tree_3 = TrimTree(Tree=construct_tree_branch_3, Depth=1)

# ---- group: Dynamic Print Speed (continued)
duplicate_data_3 = DuplicateData(Data=division_6, Number=trim_tree_3, Order=True)  # -> simplify(Data)

# ----
data = ClusterOutput(duplicate_data_3)
layer_speed_3 = Data(duplicate_data_3)
panel_2 = Panel(layer_speed_3)
layer_speed_4 = ClusterOutput(layer_speed_3)

# ==== cluster Cluster_4
item = ClusterInput()
layer_speed = ClusterInput()
layer_speed_2 = Data(layer_speed)
replace_items = ReplaceItems(List=layer_speed_2, Item=item, Indices="0", Wrap=False)
panel = Panel(layer_speed)
item_2 = ClusterInput()
replace_items_2 = ReplaceItems(List=replace_items, Item=item, Indices="1", Wrap=True)
replace_items_3 = ReplaceItems(List=layer_speed_2, Item=item_2, Indices="0", Wrap=False)
simplify_tree = SimplifyTree(Tree=replace_items_2, Front=False)
replace_items_4 = ReplaceItems(List=replace_items_3, Item=item_2, Indices="1", Wrap=True)
simplify_tree_2 = SimplifyTree(Tree=replace_items_4, Front=False)
simplify_tree_3 = SimplifyTree(Tree=replace_items_3, Front=False)
flat_speed = ClusterInput()  # Flat Speed
max_speed = ClusterInput()
cluster = Cluster_3(
    segment_height=simplify_tree,
    segment_width=simplify_tree_2,
    per_layer_speed=layer_speed_2,
    max_speed=max_speed,
    flat_speed=flat_speed)  # -> rpm_required, capped_speeds
panel_2 = Panel(cluster.rpm_required)
multiplication = Multiplication(A=cluster.capped_speeds, B=10)
layer_extrusion_rate = ClusterOutput(cluster.rpm_required)
division = Division(A=cluster.capped_speeds, B="1000")
result = ClusterOutput(division)
number_slider = Slider(-90, range=-180..180)
panel_3 = Panel(division)

# ==== cluster Cluster_5
curve = ClusterInput()
curve_2 = Curve(curve)
trim_tree = TrimTree(Tree=curve_2, Depth=1)
tree_statistics = TreeStatistics(Tree=trim_tree)  # -> Paths, Length, Count
panel = Panel("""0
-1""")
value = ClusterInput()
data = ClusterInput()
negative = Negative(Value=value)
split_tree = SplitTree(Data=data, Masks=flatten(tree_statistics.Paths))  # -> Positive, Negative
data_2 = ClusterInput()
list_item = ListItem(List=split_tree.Positive, Index=panel, Wrap=True)
split_tree_2 = SplitTree(Data=data_2, Masks=flatten(tree_statistics.Paths))  # -> Positive, Negative
list_item_2 = ListItem(List=list_item, Index=0, Wrap=True)  # -> Item, Item1
extend_curve = ExtendCurve(Curve=split_tree_2.Positive, Type=0, Start=negative, End="0")
distance = Distance(PointA=list_item_2.Item, PointB=list_item_2.Item1)
end_points = EndPoints(Curve=split_tree_2.Positive)  # -> Start, End
end_points_2 = EndPoints(Curve=extend_curve)  # -> Start, End
second_number = ClusterInput()
larger_than = LargerThan(FirstNumber=distance, SecondNumber=second_number)  # -> LargerThan, OrEqualTo
point = Point(end_points_2.Start)
point_2 = Point(end_points.End)
factor = ClusterInput()
point_3 = Point(end_points_2.End)
unit_z = UnitZ(Factor=factor)
pick_n_choose = PickNChoose(Pattern=larger_than.LargerThan, Stream0=point, Stream1=point_2)
factor_2 = ClusterInput()
move = Move(Geometry=curve_2, Motion=unit_z)  # -> Geometry, Transform
path_mapper = PathMapper(point_3, source="{A;B}(i)", target="{A;B;i}")
path_mapper_2 = PathMapper(pick_n_choose, source="{A;B}(i)", target="{A;B;i}")
unit_z_2 = UnitZ(Factor=factor_2)
end_points_3 = EndPoints(Curve=move.Geometry)  # -> Start, End
end_points_4 = EndPoints(Curve=curve_2)  # -> Start, End
move_2 = Move(Geometry=path_mapper_2, Motion=unit_z_2)  # -> Geometry, Transform
merge = Merge(Data1=path_mapper, Data2=path_mapper_2, Data3=move_2.Geometry, Data4=end_points_3.End, Data5=end_points_4.End)
result = ClusterOutput(merge)

# ==== cluster Contouring

polyline_settings = ClusterInput()  # -- POLYLINE SETTINGS --
polyline_tolerance = ClusterInput()
angle_tolerance = ClusterInput()

weave_inner_depth = ClusterInput()  # Weave Inner Depth

brep_or_mesh_single_or_multiple = ClusterInput()  # BREP or Mesh (Single or Multiple)
layer_height = ClusterInput()  # Layer Height
layer_width = ClusterInput()  # Layer Width
print_sequence = ClusterInput()  # Print Sequence
contour_direction = ClusterInput()  # Contour Direction
seam_settings = ClusterInput()  # -- SEAM SETTINGS --
align_seam = ClusterInput()  # Align Seam

weave_settings = ClusterInput()  # -- WEAVE SETTINGS --
weave_outer_depth = ClusterInput()  # Weave Outer Depth
weave_density_point_count = ClusterInput()  # Weave Density (Point Count)
weave_application_pattern = ClusterInput()  # Weave Application Pattern
weave_flip_control = ClusterInput()  # Weave Flip Control

seam_alignment_point = ClusterInput()
iterative_seam = ClusterInput()  # iterative seam
snap_seam = ClusterInput()  # snap seam

point = Point(Point(0, 0, 0))
print_sequence_2 = Data(print_sequence)
brep_or_mesh = Geometry(brep_or_mesh_single_or_multiple)
layer_height_2 = Number(layer_height)
vector_display = VectorDisplay(Anchor=point, Vector=contour_direction)
contour = Contour(Shape=brep_or_mesh, Point=Point(0, 0, 0), Direction=contour_direction, Distance=layer_height_2)
close_curve = CloseCurve(Curve=contour, CloseType=0, Bulge=0.5, Tolerance=Slider(5, range=0..10))  # -> Closed, ResultBoolean

# ---- group: cull curve less than bead width
length = Length(Curve=close_curve.Closed)
bead_width = Number(layer_width)
smaller_than = SmallerThan(FirstNumber=length, SecondNumber=bead_width)  # -> SmallerThan, OrEqualTo
cull_pattern = CullPattern(List=close_curve.Closed, CullPattern=invert(smaller_than.SmallerThan))
graft_tree = GraftTree(Tree=cull_pattern, IncludeEmptyLists=True, IncludeNullItems=True)
simplify_tree = SimplifyTree(Tree=graft_tree, Front=True)
data = Data(simplify_tree)

# ----
list_length = ListLength(List=weave_flip_control)
weave_pattern = ClusterInput()  # Weave Pattern
panel = Panel("""0
0
0
1""")
panel_2 = Panel(data)
trim_tree = TrimTree(Tree=cull_pattern, Depth=1)
# 3 modes
# 
# single, nB
# single, B
# multiple, nB
graft_tree_2 = GraftTree(Tree=cull_pattern, IncludeEmptyLists=True, IncludeNullItems=True)
flip_matrix = FlipMatrix(Data=trim_tree)  # -> graft(Data)
panel_3 = Panel(flip_matrix)
simplify_tree_2 = SimplifyTree(Tree=graft_tree_2, Front=True)
path_mapper = PathMapper(simplify_tree_2, source="{a;b;c}", target="{a;b}")
list_length_2 = ListLength(List=brep_or_mesh)
stream_filter = StreamFilter(Gate=print_sequence_2, Stream0=simplify_tree_2, Stream1=flip_matrix)
stream_filter_2 = StreamFilter(Gate=print_sequence_2, Stream0=path_mapper, Stream1=flip_matrix)
panel_4 = Panel(simplify_tree_2)
larger_than = LargerThan(FirstNumber=list_length_2, SecondNumber="1")  # -> LargerThan, OrEqualTo
data_2 = Data()
stream_filter_3 = StreamFilter(Gate=larger_than.LargerThan, Stream0=simplify_tree_2, Stream1=stream_filter_2)
simplify_tree_3 = SimplifyTree(Tree=stream_filter_3, Front=False)
align_curve_seams = AlignCurveSeams(Curves=reparameterize(flatten(stream_filter_3)), Guide=seam_alignment_point, Snap=snap_seam, Iterative=iterative_seam)  # -> Aligned, Points, ResultBoolean
curve = Curve(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)
unflatten_tree = UnflattenTree(Tree=align_curve_seams.Aligned, Guide=stream_filter_3)
trim_tree_2 = TrimTree(Tree=align_curve_seams.Aligned, Depth=1)
boolean_toggle = BooleanToggle(False)
stream_filter_4 = StreamFilter(Gate=align_seam, Stream0=stream_filter_3, Stream1=unflatten_tree)

# ---- group: open seam and ends by 1/2 of bead width
bead_width_2 = Number(bead_width)
division = Division(A=bead_width_2, B="4")
extend_curve = ExtendCurve(Curve=stream_filter_4, Type=0, Start=expr("-x", division), End=expr("-x", division))

# ----
curve_2 = Curve(extend_curve)
dispatch = Dispatch(List=flatten(curve_2), DispatchPattern=weave_application_pattern)  # -> ListA, ListB
divide_curve = DivideCurve(Curve=dispatch.ListA, Count=weave_density_point_count, Kinks=False)  # -> simplify(Points), Tangents, Parameters
tree_statistics = TreeStatistics(Tree=divide_curve.Points)  # -> Paths, Length, Count
division_2 = Division(A=tree_statistics.Count, B=list_length)
round = Round(Number=division_2)  # -> Nearest, Floor, Ceiling
duplicate_data = DuplicateData(Data=weave_flip_control, Number=round.Ceiling, Order=True)
split_list = SplitList(List=duplicate_data, Index=tree_statistics.Count)  # -> simplify(graft(ListA)), ListB
boolean = Boolean(split_list.ListA)
shift_list = ShiftList(List=divide_curve.Points, Shift=graft(split_list.ListA), Wrap=True)  # -> simplify(List)
dispatch_2 = Dispatch(List=divide_curve.Points, DispatchPattern=weave_pattern)  # -> ListA, ListB
point_2 = Point(divide_curve.Points)
polyline = PolyLine(Vertices=point_2, Closed=False)
number_slider = Slider(5, range=0..10)
construct_domain = ConstructDomain(DomainStart=weave_outer_depth, DomainEnd="0")
domain = Domain("0 to 1")
remap_numbers = RemapNumbers(Value=Slider(0, range=0..1), Source=domain, Target=construct_domain)  # -> Mapped, Clipped
clean_tree = CleanTree(RemoveNulls=True, RemoveInvalid=True, RemoveEmpty=True, Tree=extend_curve)

tree_statistics_2 = TreeStatistics(Tree=simplify_tree_3)  # -> Paths, Length, Count
deconstruct_path = DeconstructPath(Branch=tree_statistics_2.Paths)
explode_tree = ExplodeTree(Data=deconstruct_path)  # -> Branch0, Branch1
list_length_3 = ListLength(List=explode_tree.Branch0)
larger_than_2 = LargerThan(FirstNumber=list_length_3, SecondNumber="1")  # -> LargerThan, OrEqualTo

stream_filter_5 = StreamFilter(Gate=larger_than_2.LargerThan, Stream0=brep_or_mesh, Stream1=data_2)
brep_closest_point = BrepClosestPoint(Point=dispatch_2.ListA, Brep=stream_filter_5)  # -> Point, Normal, Distance
curve_closest_point = CurveClosestPoint(Point=brep_closest_point.Point, Curve=curve)  # -> Point, Parameter, Distance
panel_5 = Panel(curve_closest_point.Distance)
stream_filter_6 = StreamFilter(Gate=boolean_toggle, Stream0=curve_closest_point.Distance, Stream1="0 to 1")
bounds = Bounds(Numbers=flatten(stream_filter_6))
deconstruct_vector = DeconstructVector(Vector=brep_closest_point.Normal)  # -> XComponent, YComponent, ZComponent
vector_xyz = VectorXYZ(XComponent=deconstruct_vector.XComponent, YComponent=deconstruct_vector.YComponent, ZComponent=0)  # -> Vector, Length
contours = Geometry(contour)
negative = Negative(Value=weave_outer_depth)
spiral = Spiral(relay=contours)
curve_to_polyline = CurveToPolyline(Curve=clean_tree, ToleranceDistance=polyline_tolerance, ToleranceAngle=degrees(angle_tolerance))  # -> Polyline, Segments
curve_to_polyline_2 = CurveToPolyline(Curve=spiral, ToleranceDistance=polyline_tolerance, ToleranceAngle=degrees(angle_tolerance))  # -> Polyline, Segments
amplitude = Amplitude(Vector=vector_xyz.Vector, Amplitude=negative)
brep_closest_point_2 = BrepClosestPoint(Point=dispatch_2.ListB, Brep=stream_filter_5)  # -> Point, Normal, Distance
curve_3 = Curve(<curve referenced from the Rhino model>)

panel_6 = Panel(curve_to_polyline.Polyline)
polyline_2 = ClusterOutput(curve_to_polyline.Polyline)  # Polyline

curve_closest_point_2 = CurveClosestPoint(Point=brep_closest_point_2.Point, Curve=curve)  # -> Point, Parameter, Distance
# ATT!
# Spiral and Weave only work with single brep upload.
data_3 = Data()
negative_2 = Negative(Value=amplitude)
stream_filter_7 = StreamFilter(Gate=larger_than_2.LargerThan, Stream0=curve_to_polyline_2.Polyline, Stream1=data_3)
bounds_2 = Bounds(Numbers=flatten(curve_closest_point_2.Distance))
group = Group(Geometry=amplitude)
group_2 = Group(Geometry=negative_2)
stream_filter_8 = StreamFilter(Gate=boolean_toggle, Stream0=curve_closest_point_2.Distance, Stream1="0 to 1")
spiral_2 = ClusterOutput(stream_filter_7)
deconstruct_vector_2 = DeconstructVector(Vector=brep_closest_point_2.Normal)  # -> XComponent, YComponent, ZComponent
remap_numbers_2 = RemapNumbers(Value=stream_filter_8, Source=bounds_2, Target=construct_domain)  # -> Mapped, Clipped
pick_n_choose = PickNChoose(Pattern=split_list.ListA, Stream0=group, Stream1=group_2)
ungroup = Ungroup(Group=pick_n_choose)
move = Move(Geometry=brep_closest_point.Point, Motion=ungroup)  # -> Geometry, Transform
vector_xyz_2 = VectorXYZ(XComponent=deconstruct_vector_2.XComponent, YComponent=deconstruct_vector_2.YComponent, ZComponent=0)  # -> Vector, Length
python_3_script = Python3Script(x=weave_inner_depth)  # -> result; inputs x: tree of Double
# ---------- python_3_script: Python ----------
from Grasshopper import DataTree
from Grasshopper.Kernel.Data import GH_Path

result = DataTree[float]()

for i in range(x.BranchCount):
    path = x.Path(i)
    branch = x.Branch(path)
    cleaned = [max(0, float(n)) for n in branch]
    for val in cleaned:
        result.Add(val, path)
# ---------- end python_3_script ----------
amplitude_2 = Amplitude(Vector=vector_xyz_2.Vector, Amplitude=python_3_script)
negative_3 = Negative(Value=amplitude_2)
group_3 = Group(Geometry=amplitude_2)
group_4 = Group(Geometry=negative_3)
subtraction = Subtraction(A=weave_pattern, B="1")
negative_4 = Negative(Value=subtraction)
pick_n_choose_2 = PickNChoose(Pattern=split_list.ListA, Stream0=group_3, Stream1=group_4)
ungroup_2 = Ungroup(Group=pick_n_choose_2)
move_2 = Move(Geometry=brep_closest_point_2.Point, Motion=ungroup_2)  # -> Geometry, Transform
weave = Weave(Pattern=negative_4, Stream0=move.Geometry, Stream1=move_2.Geometry, NullGaps=False)
list_item = ListItem(List=divide_curve.Points, Index=0, Wrap=True)  # -> Item1, Item
integer = Integer(weave_application_pattern)
invert_boolean = InvertBoolean(Boolean=integer)  # -> Inverted, Number
panel_7 = Panel("-1")
replace_items = ReplaceItems(List=weave, Item=list_item.Item, Indices="0", Wrap=False)
list_length_4 = ListLength(List=replace_items)
panel_8 = Panel(list_length_4)
subtraction_2 = Subtraction(A=panel_8, B="1")
# ATT!
# Spiral and Weave only work with single brep upload.
panel_9 = Panel("""ATT!
Spiral and Weave only work with single brep upload.""")
replace_items_2 = ReplaceItems(List=replace_items, Item=list_item.Item1, Indices=subtraction_2, Wrap=False)
interpolate = Interpolate(Vertices=replace_items_2, Degree=3, Periodic=Toggle(False), KnotStyle=1)  # -> Curve, Length, Domain
weave_2 = Weave(Pattern=invert_boolean.Inverted, Stream0=flatten(interpolate.Curve), Stream1=flatten(dispatch.ListB), NullGaps=False)  # -> graft(Weave)
curve_4 = Curve(weave_2)
list_item_2 = ListItem(List=flatten(weave_2), Index=0, Wrap=True)  # -> Item, Item1, Item2, Item3, Item4, Item5, Item6, Item7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
curve_to_polyline_3 = CurveToPolyline(Curve=weave_2, ToleranceDistance=polyline_tolerance, ToleranceAngle=degrees(angle_tolerance))  # -> Polyline, Segments
path_mapper_2 = PathMapper(curve_to_polyline_3.Polyline, source="{a;b}", target="{b;a}")
data_4 = Data()
stream_filter_9 = StreamFilter(Gate=larger_than_2.LargerThan, Stream0=path_mapper_2, Stream1=data_4)
stream_filter_10 = StreamFilter(Gate=larger_than_2.LargerThan, Stream0=data_4, Stream1=panel_9)
weaved = Curve(stream_filter_9)
status_messages = ClusterOutput(stream_filter_10)  # Status Messages
weave_3 = ClusterOutput(weaved)  # Weave

# ==== cluster Cluster_6
gate = ClusterInput()
vector_xyz = VectorXYZ(XComponent=0, YComponent="-1", ZComponent="1")  # -> Vector, Length
contour_direction_vector = UnitZ(Factor=1)
stream_filter = StreamFilter(Gate=gate, Stream0=contour_direction_vector, Stream1=vector_xyz.Vector)
s_0 = ClusterOutput(stream_filter)

# ==== cluster DFLURFixutres
number_slider = Slider(100, range=0..100)
F = ClusterInput()
mesh = Mesh(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)
X = UnitX(Factor=F)
turntablebase = Mesh(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)
move = Move(Geometry=mesh, Motion=X)  # -> Geometry, Transform
bbox = BoundingBox(Content=move.Geometry, Plane=PlaneXY(0, 0, 0))  # -> Box, Box_2
debrep = DeconstructBrep(Brep=bbox.Box)  # -> Faces, Edges, Vertices
area = Area(Geometry=debrep.Faces)  # -> Area, Centroid
mesh_2 = Mesh([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])
_140_circle_mount = Mesh(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)
pdecon = Deconstruct(Point=area.Centroid)  # -> XComponent, YComponent, ZComponent
item = ListItem(List=debrep.Faces, Index=Slider(4, range=0..10), Wrap=True)
extension_clay = Mesh(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)
sort = SortList(Keys=pdecon.ZComponent, ValuesA=area.Centroid)  # -> Keys, ValuesA
area_2 = Area(Geometry=item)  # -> Area, Centroid
_90_circle_mount = Mesh(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)
_50_riser_square = Mesh(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)
_100_plate_square = Mesh(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)
item_2 = ListItem(List=sort.ValuesA, Index=0, Wrap=True)
xy = XYPlane(Origin=Point(0, 0, 0))
extension = Mesh(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)
turntable = Mesh(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)
brep = Brep(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)
brep_2 = Brep(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)
pdecon_2 = Deconstruct(Point=item_2)  # -> XComponent, YComponent, ZComponent
zoffset = Panel("78")
mesh_3 = Mesh(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)
zoffset_2 = Panel("24.5")
mjoin = MeshJoin(Meshes=[turntable, extension, _100_plate_square])
A = ClusterInput()
bbox_2 = BoundingBox(Content=[brep, brep_2], Plane=PlaneXY(0, 0, 0), UnionBox=True)  # -> Box, Box_2
drawing_table = Mesh(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)
mjoin_2 = MeshJoin(Meshes=[turntable, extension, _50_riser_square])
zoffset_3 = Panel("19")
clay_cover = Mesh(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)
mjoin_3 = MeshJoin(Meshes=[turntable, clay_cover, mesh_2, _140_circle_mount])
mjoin_4 = MeshJoin(Meshes=[turntable, clay_cover, mesh_2])
mjoin_5 = MeshJoin(Meshes=[turntable, clay_cover])
zoffset_4 = Panel("-15")
zoffset_5 = Panel("3")
debrep_2 = DeconstructBrep(Brep=bbox_2.Box)  # -> Faces, Edges, Vertices
addition = Addition(A=zoffset_2, B=zoffset)
addition_2 = Addition(A=A, B=zoffset_4)
area_3 = Area(Geometry=debrep_2.Faces)  # -> Area, Centroid
addition_3 = Addition(A=zoffset_2, B=zoffset_5)
addition_4 = Addition(A=addition_3, B=zoffset)
d2 = ClusterInput()
panel = Panel(d2)
pt = ConstructPoint(XCoordinate=panel, YCoordinate=0, ZCoordinate=0)
pdecon_3 = Deconstruct(Point=area_3.Centroid)  # -> XComponent, YComponent, ZComponent
carttrack = Mesh([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])
sort_2 = SortList(Keys=pdecon_3.ZComponent, ValuesA=area_3.Centroid)  # -> Keys, ValuesA
carttabletop = Mesh(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)
merge = Merge(Data1=addition, Data2="500", Data3=turntablebase, Data4=mjoin_2)
tabletop = Mesh(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)
tabletrack = Mesh([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])
merge_2 = Merge(Data1=zoffset_3, Data2="500", Data3=drawing_table, Data4=mesh_3)
merge_3 = Merge(Data1=addition, Data2="500", Data3=turntablebase, Data4=mjoin)
merge_4 = Merge(Data1=zoffset_2, Data2="500", Data3=turntablebase, Data4=turntable)
merge_5 = Merge(Data1=addition_2, Data2=d2, Data3=mesh_3, Data4=mesh_3)
merge_6 = Merge(Data1=addition_3, Data2="500", Data3=turntablebase, Data4=mjoin_5)
merge_7 = Merge(Data1=addition_4, Data2="500", Data3=turntablebase, Data4=mjoin_3)
merge_8 = Merge(Data1="-7", Data2=flatten(pdecon_2.XComponent), Data3=flatten(move.Geometry))
item_3 = ListItem(List=sort_2.ValuesA, Index=0, Wrap=True)
move2pt = MoveToPoint(Geometry=brep, PointA=item_3, PointB=pt)  # -> Moved, Vector, Transform
move2pt_2 = MoveToPoint(Geometry=brep_2, PointA=item_3, PointB=pt)  # -> Moved, Vector, Transform
mesh_4 = MeshBrep(
    Brep=move2pt.Moved,
    Settings={GridMaxCount=0, GridMinCount=16, JaggedSeams=False, MaxEdgeLength=0, MinEdgeLength=0.0001, MinTolerance=0, Refine=True, RefineAngle=0, RelativeTolerance=0.65, SimplePlanes=True, Tolerance=0})
mesh_5 = MeshBrep(
    Brep=move2pt_2.Moved,
    Settings={GridMaxCount=0, GridMinCount=16, JaggedSeams=False, MaxEdgeLength=0, MinEdgeLength=0.0001, MinTolerance=0, Refine=True, RefineAngle=0, RelativeTolerance=0.65, SimplePlanes=True, Tolerance=0})
merge_9 = Merge(Data1="40", Data2=panel, Data3=mesh_4, Data4=mesh_5)  # -> flatten(Result)
merge_10 = Merge(Data1=carttabletop, Data2=flatten(carttrack))
merge_11 = Merge(Data1=tabletop, Data2=flatten(tabletrack))
merge_12 = Merge(
    Data1=graft(merge_5),
    Data2=graft(merge_2),
    Data3=graft(merge_4),
    Data4=graft(merge),
    Data5=graft(merge_3),
    Data6=graft(merge_6),
    Data7=graft(merge_7),
    Data8=graft(merge_8),
    Data9=graft(merge_9))
i = ClusterInput()
merge_13 = Merge(Data1=graft(merge_10), Data2=graft(merge_11))
i_2 = ClusterInput()
item_4 = ListItem(List=merge_13, Index=i_2, Wrap=True)
item_5 = ListItem(List=merge_12, Index=i, Wrap=True)
A_2 = ClusterInput()
tabletop_2 = ListItem(List=flatten(item_4), Index=0, Wrap=True)
track = ListItem(List=flatten(item_4), Index=1, Wrap=True)
track_2 = ListItem(List=flatten(item_4), Index=2, Wrap=True)
tabletop_3 = ListItem(List=flatten(item_5), Index=0, Wrap=False)
track_3 = ListItem(List=flatten(item_5), Index=1, Wrap=False)
track_4 = ListItem(List=flatten(item_5), Index=2, Wrap=False)
track_5 = ListItem(List=flatten(item_5), Index=3, Wrap=False)
multiplication = Multiplication(A=A_2, B=-1)
pt_2 = ConstructPoint(XCoordinate=multiplication, YCoordinate=0, ZCoordinate=0)
construct_point = ConstructPoint(XCoordinate=track_3, YCoordinate=0, ZCoordinate=tabletop_3)
i_3 = ClusterOutput(track_5)
adaptorplate = Mesh(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)
move_2 = Move(Geometry=tabletop_2, Motion=pt_2)  # -> Geometry, Transform
move_3 = Move(Geometry=[track, track_2], Motion=pt_2)  # -> Geometry, Transform
point = ClusterOutput(construct_point)
G = ClusterOutput(move_2.Geometry)
adaptorplate_2 = ClusterOutput(adaptorplate)
fixture_z = ClusterOutput(tabletop_3)
fixture_x = ClusterOutput(track_3)
G_2 = ClusterOutput(move_3.Geometry)
i_4 = ClusterOutput(track_4)

# ==== cluster Tool
dia_width = ClusterInput()
length = ClusterInput()
weight = ClusterInput()
i = ClusterInput()
weight_of_the_tool = Panel("0.8")
tool_centre_point = Panel("0,0,385")
name_of_tool = Panel("HWcutterNarrow")
tool = ValueList({"HW cutter Wide": 0, "HW cutter Narrow": 1, "Pen Holder (old)": 2, "Pen Holder (new)": 3, "Clay Tool": 4}, selected="Pen Holder (new)")
weight_of_the_tool_2 = Panel("1.2")
name_of_tool_2 = Panel("HWcutterWide")
tool_centre_point_2 = Panel("0,0,240")
length_2 = Panel("100")
weight_2 = Panel("0.1")
xy = XYPlane(Origin=tool_centre_point)
widt_dia = Panel("Width")
rot3d = Rotate3D(Geometry=xy, Angle=degrees("180"), Center=xy, Axis=Vector(0, 0, 1))  # -> Geometry, Transform
xy_2 = XYPlane(Origin=tool_centre_point_2)
hw_narrow_mesh = Mesh(flatten(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))
name_of_tool_3 = Panel("PenHolderNew")
name_of_tool_4 = Panel("claytoolinsert")
name_of_tool_5 = Panel("claytoolinsert")
dia = Panel("18")
name_of_tool_6 = Panel("PenHolderOld")
hw_wide_mesh = Mesh(flatten(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))
rot3d_2 = Rotate3D(Geometry=xy_2, Angle=degrees("180"), Center=xy_2, Axis=Vector(0, 0, 1))  # -> Geometry, Transform
claytool = Claytool(A_2=length, A=dia_width, B=weight)  # -> R, P, flatten(R_2)
merge = Merge(
    Data1=flatten(name_of_tool),
    Data2=flatten(rot3d.Geometry),
    Data3=flatten(weight_of_the_tool),
    Data4=flatten(hw_narrow_mesh))  # -> flatten(Result)
claytoolinsert = ClayToolInsert(A_2=length, A=dia_width, B=weight)  # -> R, P, flatten(R_2)
merge_2 = Merge(
    Data1=flatten(name_of_tool_2),
    Data2=flatten(rot3d_2.Geometry),
    Data3=flatten(weight_of_the_tool_2),
    Data4=flatten(hw_wide_mesh))  # -> flatten(Result)
penholder2 = PenHolder2(A_2=length, A=dia_width, B=weight)  # -> R, G, simplify(mesh_4)
penholder1 = PenHolder1(A_2=length, A=dia_width, B=weight)  # -> R, i, flatten(R_2)
pln = Plane(claytool.P)
pln_2 = Plane(claytoolinsert.P)
pln_3 = Plane(penholder1.i)
pln_4 = Plane(penholder2.G)
merge_3 = Merge(Data1=flatten(name_of_tool_6), Data2=flatten(pln_3), Data3=flatten(penholder1.R), Data4=flatten(penholder1.R_2))  # -> flatten(Result)
merge_4 = Merge(Data1=flatten(name_of_tool_4), Data2=flatten(pln), Data3=flatten(claytool.R), Data4=flatten(claytool.R_2))  # -> flatten(Result)
merge_5 = Merge(Data1=flatten(name_of_tool_5), Data2=flatten(pln_2), Data3=flatten(claytoolinsert.R), Data4=flatten(claytoolinsert.R_2))  # -> flatten(Result)
merge_6 = Merge(Data1=flatten(name_of_tool_3), Data2=flatten(pln_4), Data3=flatten(penholder2.R), Data4=flatten(penholder2.mesh_4))  # -> flatten(Result)
merge_7 = Merge(
    Data1=graft(merge_2),
    Data2=graft(merge),
    Data3=graft(merge_3),
    Data4=graft(merge_6),
    Data5=graft(merge_4),
    Data6=graft(merge_5))
item = ListItem(List=merge_7, Index=i, Wrap=False)
name = ListItem(List=flatten(item), Index=0, Wrap=True)  # -> flatten(Item)
wieght = ListItem(List=flatten(item), Index=2, Wrap=False)
mesh = ListItem(List=flatten(item), Index=3, Wrap=True)
centre_point = ListItem(List=flatten(item), Index=1, Wrap=True)

# ---- group: Set up End Effector
name_of_tool_7 = Panel(name)
tool_centre_point_3 = Panel(centre_point)
weight_4 = Panel(wieght)
end_effectror_mesh = Mesh(mesh)
create_tool = CreateTool(Name=name_of_tool_7, TCP=centre_point, Weight=weight_4, Mesh=end_effectror_mesh)  # -> Tool, TCP

# ----
tcp = ClusterOutput(create_tool.TCP)
tool_2 = ClusterOutput(create_tool.Tool)

# ==== cluster DFLMakeStock
padded_dist = ClusterInput()
num = ClusterInput()
num_2 = ClusterInput()
panel = Panel("20")
relay = ClusterInput()
num_3 = Number(num)
num_4 = Number(num_2)
dom = ConstructDomain(DomainStart=expr("-x/2", "500"), DomainEnd=expr("x/2", "500"))
cir = Circle(Plane=relay, Radius=expr("x/2", "100"))
Z = UnitZ(Factor=num_3)
cir_2 = Circle(Plane=relay, Radius=expr("x/2", "100"))
Z_2 = UnitZ(Factor=num_4)
dom_2 = ConstructDomain(DomainStart=expr("-x/2", "90"), DomainEnd=expr("x/2", "90"))
Z_3 = UnitZ(Factor=num_3)
dom_3 = ConstructDomain(DomainStart=expr("-x/2", "200"), DomainEnd=expr("x/2", "200"))
rectangle = Rectangle(Plane=relay, XSize=dom, YSize=dom, Radius=0)  # -> Rectangle, Length
Z_4 = UnitZ(Factor="20")
Z_5 = UnitZ(Factor="20")
rectangle_2 = Rectangle(Plane=relay, XSize=dom_2, YSize=dom_2, Radius=0)  # -> Rectangle, Length
Z_6 = UnitZ(Factor=expr("-x", padded_dist))
extr = Extrude(Base=rectangle.Rectangle, Direction=Z_2)
rectangle_3 = Rectangle(Plane=relay, XSize=dom_3, YSize=dom_3, Radius=0)  # -> Rectangle, Length
extr_2 = Extrude(Base=cir_2, Direction=Z)
extr_3 = Extrude(Base=cir, Direction=Z_3)
extrtaper = ExtrudeTaperedPolysurface(Profile=cir_2, Direction=Z, Angle=2, CornerType=0, FaceMerge=True)
cap = CapHoles(Brep=extr)
extr_4 = Extrude(Base=rectangle_2.Rectangle, Direction=Z_4)
extr_5 = Extrude(Base=rectangle_3.Rectangle, Direction=Z_5)
move = Move(Geometry=cir, Motion=Z_6)  # -> Geometry, Transform
pt = ConstructPoint(XCoordinate=expr("x/2", "90"), YCoordinate=expr("x/2", "90"), ZCoordinate=0)
cap_2 = CapHoles(Brep=extr_3)
pt_2 = ConstructPoint(XCoordinate=0, YCoordinate=0, ZCoordinate=expr("-x", padded_dist))
cap_3 = CapHoles(Brep=extr_4)
pt_3 = Point(Point(0, 0, -20))
cap_4 = CapHoles(Brep=extr_5)
addition = Addition(A=num_3, B=padded_dist)
cap_5 = CapHoles(Brep=extrtaper)
pt_4 = ConstructPoint(XCoordinate=0, YCoordinate=0, ZCoordinate=addition)
move_2 = Move(Geometry=cap_3, Motion=pt)  # -> Geometry, Transform
multiplication = Multiplication(A=padded_dist, B=2)
G = ClusterInput()
merge = Merge(Data1=pt_4, Data2=pt_2)
addition_2 = Addition(A=num_3, B=multiplication)
extrtaper_2 = ExtrudeTaperedPolysurface(Profile=cir_2, Direction=merge, Angle=2, CornerType=0, FaceMerge=True)
filter = StreamFilter(Gate=G, Stream0=move_2.Geometry, Stream1=cap_4, Stream2=cap_2, Stream3=cap_5, Stream4=cap)
Z_7 = UnitZ(Factor=addition_2)
extr_6 = Extrude(Base=move.Geometry, Direction=Z_7)
cap_6 = CapHoles(Brep=extr_6)
debrep = DeconstructBrep(Brep=filter)  # -> Faces, Edges, Vertices
join = BrepJoin(Breps=flatten(extrtaper_2))  # -> Breps, Closed
null = NullItem()  # -> NullFlags, InvalidFlags, Description
edges = BrepEdges(Brep=join.Breps)  # -> Naked, Interior, NonManifold
area = Area(Geometry=debrep.Faces)  # -> Area, Centroid
pdecon = Deconstruct(Point=area.Centroid)  # -> XComponent, YComponent, ZComponent
rev = ReverseList(List=edges.Naked)
loft = Loft(Curves=rev, Options={Adjust=False, Closed=False, LoftEnds=0, LoftSimp=0, LoftType=0, Rebuild=10, Refit=0.01})
cap_7 = CapHoles(Brep=loft)
filter_2 = StreamFilter(Gate=G, Stream0=null.NullFlags, Stream1=null.NullFlags, Stream2=cap_6, Stream3=cap_7, Stream4=null.NullFlags)
sort = SortList(Keys=pdecon.ZComponent, ValuesA=area.Centroid)  # -> Keys, ValuesA
item = ListItem(List=sort.ValuesA, Index=0, Wrap=True)  # -> Item1, Item
brep = Brep(filter_2)
xy = XYPlane(Origin=item.Item)
xy_2 = XYPlane(Origin=item.Item1)
brep_2 = ClusterOutput(brep)
list_item = ListItem(List=debrep.Faces, Index=Slider(5, range=0..10), Wrap=True)
boundary_surfaces = BoundarySurfaces(Edges=list_item)
brep_3 = Brep(filter)
pln = Plane(xy)
pln_2 = Plane(xy_2)
brep_4 = ClusterOutput(brep_3)
pln_3 = ClusterOutput(pln)
pln_4 = ClusterOutput(pln_2)
surfaces = ClusterOutput(boundary_surfaces)

# ==== cluster DFLURCustomPopup
N = ClusterInput()
B = ClusterInput()
concat = Concatenate(
    FragmentA="popup (\"",
    FragmentB=B,
    FragmentC="\", title=\"",
    FragmentD=N,
    FragmentE="\", warning=False, error=False, blocking=True)")
customcmd = CustomCommand(Name=N, Manufacturer="UR", Code=concat)
C = ClusterOutput(customcmd)

# ==== cluster Cluster_3
segment_height = ClusterInput()
segment_width = ClusterInput()
per_layer_speed = ClusterInput()
segment_height_2 = Number(segment_height)
segment_width_2 = Number(segment_width)
per_layer_speed_2 = Number(per_layer_speed)
segment_height_3 = Number(segment_height_2)
segment_width_3 = Number(segment_width_2)
per_layer_speed_3 = Number(per_layer_speed_2)
panel = Panel(per_layer_speed_3)
multiplication = Multiplication(A=per_layer_speed_3, B="1000")

correction_value_for_trimming = Number("1")

panel_2 = Panel("""3.3
9
13.9
18.8
24.1
27
31.91
33.78
37.91
41.9""")
panel_3 = Panel("""300
556
811
1067
1322
1578
1833
2089
2344
2600""")
correction_value_for_trimming_2 = Number("1")
multiplication_2 = Multiplication(A=segment_height_3, B=segment_width_3, C=correction_value_for_trimming, D=multiplication)
panel_4 = Panel("0.002")
panel_5 = Panel(segment_width_3)
maximum = Maximum(A=multiplication, B="2")
bounds = Bounds(Numbers=flatten(maximum))
deconstruct_domain = DeconstructDomain(Domain=bounds)  # -> Start, End
replace_items = ReplaceItems(List=maximum, Item=deconstruct_domain.Start, Indices="0", Wrap=False)
panel_6 = Panel(deconstruct_domain.Start)

k_mm3_s_per_screw_turn = Panel("0.82")
rotation_volume = Number(k_mm3_s_per_screw_turn)

flat_speed = ClusterInput()  # Flat Speed
trim_tree = TrimTree(Tree=replace_items, Depth=1)
stream_filter = StreamFilter(Gate=flat_speed, Stream0=maximum, Stream1=trim_tree)
dyanmic_flow_calibration = Python3Script(
    rpm_list=panel_3,
    mass_list=panel_2,
    extrude_time="60",
    material_density="1.27",
    layer_heights=simplify(segment_height_3),
    layer_widths=simplify(segment_width_3),
    flattening_factor=correction_value_for_trimming_2,
    robot_speeds=simplify(stream_filter))  # -> k1, calibrated_slope, calibrated_offset, vol_rate_required, rpm_required; inputs rpm_list: list of Double, mass_list: list of Double, extrude_time: Double, material_density: Double, layer_heights: tree of Double, layer_widths: tree of Double, flattening_factor: Double, robot_speeds: tree of Double
# ---------- dyanmic_flow_calibration: Python ----------
import Rhino
from Grasshopper.Kernel.Data import GH_Path
from Grasshopper import DataTree

def flatten_branch(tree, path):
    return list(tree.Branch(path))

# === INPUTS ===
# rpm_list, mass_list, extrude_time, material_density
# layer_heights_input  : DataTree[Double]
# layer_widths_input   : DataTree[Double]
# robot_speeds_input   : DataTree[Double]
# flattening_factor

# Step 1: Calibration (same as before)
if len(rpm_list) != len(mass_list):
    raise Exception("Calibration lists must be same length.")

# convert calibration masses -> volume flow (mm3/s)
vol_flows = []
dens_kg_mm3 = (material_density/1000.0)/1000.0

for m in mass_list:
    kg = m/1000.0
    vol_mm3_total = kg / dens_kg_mm3
    vol_flows.append(vol_mm3_total / extrude_time)

n = len(rpm_list)
sum_x = sum(rpm_list)
sum_y = sum(vol_flows)
sum_xx = sum([x*x for x in rpm_list])
sum_xy = sum([rpm_list[i]*vol_flows[i] for i in range(n)])
den = (n*sum_xx - sum_x*sum_x)

if den == 0:
    raise Exception("Calibration regression failed.")

k1 = (n*sum_xy - sum_x*sum_y)/den
k0 = (sum_y - k1*sum_x)/n

calibrated_slope = k1
calibrated_offset = k0

# Step 2: Build output tree
rpm_required_tree = DataTree[float]()
vol_rate_tree = DataTree[float]()

# Ensure both motion trees have the same branches
paths_h = layer_heights.Paths
paths_w = layer_widths.Paths
paths_v = robot_speeds.Paths

for path in paths_h:
    heights = flatten_branch(layer_heights, path)
    widths  = flatten_branch(layer_widths, path)
    speeds  = flatten_branch(robot_speeds, path)

    if not(len(heights)==len(widths)==len(speeds)):
        raise Exception(f"Branch {path} has mismatched counts.")

    rpm_branch = []
    vol_branch = []

    for h, w, v in zip(heights, widths, speeds):
        target_vol = v * w * h * flattening_factor
        vol_branch.append(target_vol)
        rpm_val = (target_vol - k0)/k1
        rpm_branch.append(rpm_val)

    rpm_required_tree.AddRange(rpm_branch, GH_Path(path.Indices))
    vol_rate_tree.AddRange(vol_branch, GH_Path(path.Indices))

rpm_required = rpm_required_tree
vol_rate_required = vol_rate_tree
# ---------- end dyanmic_flow_calibration ----------
panel_7 = Panel(dyanmic_flow_calibration.rpm_required)
max_speed = ClusterInput()
division = Division(A=multiplication_2, B=rotation_volume)
minimum = Minimum(A=dyanmic_flow_calibration.rpm_required, B=max_speed)
maximum_2 = Maximum(A=minimum, B="100")
rpm_required = ClusterOutput(maximum_2)  # rpm_required
division_2 = Division(A=maximum_2, B=dyanmic_flow_calibration.rpm_required)
capped_rpm = Panel(minimum)
multiplication_3 = Multiplication(A=stream_filter, B=division_2)
capped_speeds = ClusterOutput(multiplication_3)  # capped speeds
panel_8 = Panel(multiplication_3)

# ==== cluster Spiral
relay = ClusterInput()
number_slider = Slider(100, range=0..100)
divide_curve = DivideCurve(Curve=relay, Count=number_slider, Kinks=False)  # -> Points, Tangents, Parameters
flip_matrix = FlipMatrix(Data=divide_curve.Points)
polyline = PolyLine(Vertices=flip_matrix, Closed=False)
explode = Explode(Curve=polyline, Recursive=True)  # -> Segments, Vertices
end_points = EndPoints(Curve=explode.Segments)  # -> Start, End
range = Range(Domain=Domain(0, 1), Steps=expr("x-1", number_slider))
vector_2pt = Vector2Pt(PointA=end_points.Start, PointB=end_points.End, Unitize=False)  # -> Vector, Length
range_2 = Range(Domain=Domain(0, 1), Steps=number_slider)
flip_matrix_2 = FlipMatrix(Data=vector_2pt.Vector)
multiplication = Multiplication(A=flip_matrix_2, B=range)
move = Move(Geometry=divide_curve.Points, Motion=multiplication)  # -> Geometry, Transform
list_item = ListItem(List=flatten(relay), Index="-1", Wrap=True)
polyline_2 = PolyLine(Vertices=flatten(move.Geometry), Closed=False)
curve_curve = CurveCurve(CurveA=list_item, CurveB=polyline_2)  # -> Points, ParamsA, ParamsB
shatter = Shatter(Curve=polyline_2, Parameters=curve_curve.ParamsB)
shatter_2 = Shatter(Curve=list_item, Parameters=curve_curve.ParamsA)
interpolate = Interpolate(Vertices=flatten(move.Geometry), Degree=3, Periodic=False, KnotStyle=1)  # -> Curve, Length, Domain
number_slider_2 = Slider(20, range=0..100)
list_item_2 = ListItem(List=shatter_2, Index=0, Wrap=True)  # -> Item, Item1
list_item_3 = ListItem(List=shatter, Index=0, Wrap=True)  # -> Item, Item1, Item2
end_points_2 = EndPoints(Curve=relay)  # -> Start, End
number_slider_3 = Slider(0.1, range=0..1)
curve_closest_point = CurveClosestPoint(Point=end_points_2.Start, Curve=interpolate.Curve)  # -> Point, Parameter, Distance
curve = Curve([list_item_2.Item, list_item_2.Item1])
curve_2 = Curve(list_item_3.Item)
trim_tree = TrimTree(Tree=curve_closest_point.Parameter, Depth=1)
flip_matrix_3 = FlipMatrix(Data=curve_closest_point.Parameter)  # -> graft(Data)
flip_matrix_4 = FlipMatrix(Data=trim_tree)  # -> graft(Data)
shatter_3 = Shatter(Curve=interpolate.Curve, Parameters=flatten(flip_matrix_4))
trim_tree_2 = TrimTree(Tree=shatter_3, Depth=1)
flip_matrix_5 = FlipMatrix(Data=trim_tree_2)  # -> graft(Data)
extend_curve = ExtendCurve(Curve=flip_matrix_5, Type=0, Start="0", End="-2")
curve_3 = ClusterOutput(extend_curve)

# ==== cluster PenHolder1
mesh = Mesh(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)
pen_length_offset = Panel("-1")
pen_v_block_offset_mm = Panel("16")
holder_weight = Panel(".133")
B = ClusterInput()
addition = Addition(A=holder_weight, B=B)
A = ClusterInput()
division = Division(A=A, B=2)
pt = ConstructPoint(XCoordinate=division, YCoordinate=division, ZCoordinate=0)
xy = XYPlane(Origin=pt)
A_2 = ClusterInput()
R = ClusterOutput(addition)
cir = Circle(Plane=xy, Radius=division)
subtraction = Subtraction(A=A_2, B=pen_length_offset)
pt_2 = Point(Point(0, 0, 0))
pt_3 = ConstructPoint(XCoordinate=0, YCoordinate=0, ZCoordinate="1")
ln = Line(StartPoint=pt_2, EndPoint=pt_3)
rotax = RotateAxis(Geometry=cir, Angle=degrees("45"), Axis=ln)  # -> Geometry, Transform
pt_4 = ConstructPoint(XCoordinate="1", YCoordinate=0, ZCoordinate=0)
ln_2 = Line(StartPoint=pt_2, EndPoint=pt_4)
rotax_2 = RotateAxis(Geometry=rotax.Geometry, Angle=degrees("90"), Axis=ln_2)  # -> Geometry, Transform
pt_5 = ConstructPoint(XCoordinate=0, YCoordinate=subtraction, ZCoordinate=pen_v_block_offset_mm)
merge = Merge(Data1=division, Data2=division)
move = Move(Geometry=rotax_2.Geometry, Motion=pt_5)  # -> Geometry, Transform
pt_6 = ConstructPoint(XCoordinate=0, YCoordinate=0, ZCoordinate="1")
lng = ListLength(List=merge)
ln_3 = Line(StartPoint=pt_2, EndPoint=pt_6)
range = Range(Domain="0 to 1", Steps=expr("x-1", lng))
rotax_3 = RotateAxis(Geometry=move.Geometry, Angle=degrees("-45"), Axis=ln_3)  # -> Geometry, Transform
pen_visulaization_hack = GraphMapper(range, x0=0, x1=1, y0=0, y1=1, container_name="Bezier", cpx=[0, 0.1894655079, 0, 1], cpy=[0, 0.6900714636, 1, 1])
area = Area(Geometry=rotax_3.Geometry)  # -> Area, Centroid
pdecon = Deconstruct(Point=area.Centroid)  # -> XComponent, YComponent, ZComponent
pt_7 = ConstructPoint(XCoordinate=0, YCoordinate=0, ZCoordinate=pdecon.ZComponent)
ln_4 = Line(StartPoint=pt_7, EndPoint=area.Centroid)
vpipe = PipeVariable(Curve=ln_4, Parameters=pen_visulaization_hack, Radii=merge, Caps=2)
mesh_2 = MeshBrep(
    Brep=vpipe,
    Settings={GridMaxCount=0, GridMinCount=16, JaggedSeams=False, MaxEdgeLength=0, MinEdgeLength=0.0001, MinTolerance=0, Refine=True, RefineAngle=0, RelativeTolerance=0.65, SimplePlanes=True, Tolerance=0})
pframes = PerpFrames(Curve=ln_4, Count="1", Align=True)  # -> Frames, Parameters
munion = MeshUnion(Meshes=flatten([mesh, mesh_2]))
R_2 = ClusterOutput(munion)
item = ListItem(List=pframes.Frames, Index=1, Wrap=True)
i = ClusterOutput(item)

# ==== cluster PenHolder2
pen_v_block_offset_mm = Panel("50")
pen_length_offset = Panel("-1")
holder_weight = Panel(".133")
mesh = Mesh(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)
B = ClusterInput()
addition = Addition(A=holder_weight, B=B)
A = ClusterInput()
A_2 = ClusterInput()
R = ClusterOutput(addition)
division = Division(A=A, B=2)
pt = ConstructPoint(XCoordinate=0, YCoordinate=0, ZCoordinate=pen_v_block_offset_mm)
xy = XYPlane(Origin=pt)
panel = Panel("1")
xz = XZPlane(Origin=pt)
subtraction = Subtraction(A=A_2, B=pen_length_offset)
addition_2 = Addition(A=A_2, B=pen_v_block_offset_mm)
cir = Circle(Plane=xy, Radius=division)
pt_2 = ConstructPoint(XCoordinate=0, YCoordinate=0, ZCoordinate=addition_2)
boundary_surfaces = BoundarySurfaces(Edges=cir)
unit_z = UnitZ(Factor=Slider(130, range=0..1000))
merge = Merge(Data1=division, Data2=division)
extrude = Extrude(Base=boundary_surfaces, Direction=unit_z)
lng = ListLength(List=merge)
range = Range(Domain="0 to 1", Steps=expr("x-1", lng))
pen_visulaization_hack = GraphMapper(
    range,
    x0=0,
    x1=1,
    y0=0,
    y1=1,
    container_name="Bezier",
    cpx=[0, 0.1894655079, 0.002457328374, 1],
    cpy=[0, 0.6900714636, 1, 1])
subtraction_2 = Subtraction(A=division, B=1)
mesh_brep = MeshBrep(
    Brep=extrude,
    Settings={GridMaxCount=0, GridMinCount=16, JaggedSeams=False, MaxEdgeLength=0, MinEdgeLength=0.0001, MinTolerance=0, Refine=True, RefineAngle=0, RelativeTolerance=0.65, SimplePlanes=True, Tolerance=0})
vpipe = PipeVariable(Caps=0, FitRail=False)
ln = Line(StartPoint=pt, EndPoint=pt_2)
vpipe_2 = PipeVariable(Curve=ln, Parameters=pen_visulaization_hack, Radii=merge, Caps=0, FitRail=False)
cap = CapHoles(Brep=vpipe_2)
filedge = FilletEdge(Shape=cap, Blend=1, Metric=0, Edges=2, Radii=subtraction_2)
pframes = PerpFrames(Curve=ln, Count="1", Align=True)  # -> Frames, Parameters
mesh_2 = MeshBrep(
    Brep=filedge,
    Settings={GridMaxCount=0, GridMinCount=16, JaggedSeams=False, MaxEdgeLength=0, MinEdgeLength=0.0001, MinTolerance=0, Refine=True, RefineAngle=0, RelativeTolerance=0.65, SimplePlanes=True, Tolerance=0})  # -> flatten(Mesh)
munion = MeshUnion(Meshes=[mesh, mesh_2])
item = ListItem(List=pframes.Frames, Index=1, Wrap=True)
mesh_3 = Mesh(munion)
rot3d = Rotate3D(Geometry=item, Angle=degrees("180"), Center=Point(0, 0, 0), Axis=Vector(0, 0, 1))  # -> Geometry, Transform
mesh_4 = ClusterOutput(mesh_3)
G = ClusterOutput(rot3d.Geometry)

# ==== cluster ClayToolInsert
pen_length_offset = Panel("0")
pen_v_block_offset_mm = Panel("15")
holder_weight = Panel(".133")
mesh = Mesh([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])
B = ClusterInput()
addition = Addition(A=holder_weight, B=B)
A = ClusterInput()
A_2 = ClusterInput()
R = ClusterOutput(addition)
division = Division(A=A, B=2)
subtraction = Subtraction(A=A_2, B=pen_length_offset)
addition_2 = Addition(A=A_2, B=pen_v_block_offset_mm)
pt = ConstructPoint(XCoordinate=0, YCoordinate=0, ZCoordinate=addition_2)
pt_2 = ConstructPoint(XCoordinate=0, YCoordinate=0, ZCoordinate=pen_v_block_offset_mm)
division_2 = Division(A=A, B=2)
division_3 = Division(A=A, B=2)
division_4 = Division(A="3", B=2)
division_5 = Division(A="3", B=2)
merge = Merge(Data1=division, Data2=division)
dom = ConstructDomain(DomainStart=expr("-x", division_2), DomainEnd=division_3)
dom_2 = ConstructDomain(DomainStart=expr("-x", division_4), DomainEnd=division_5)
panel = Panel("0 to 1")
rectangle = Rectangle(Plane=pt_2, XSize=dom_2, YSize=dom, Radius=0)  # -> Rectangle, Length
lng = ListLength(List=merge)
Z = UnitZ(Factor=A_2)
extr = Extrude(Base=rectangle.Rectangle, Direction=Z)
cap = CapHoles(Brep=extr)
edges = BrepEdges(Brep=cap)  # -> Naked, Interior, NonManifold
item = ListItem(List=edges.Interior, Index=Slider(5, range=0..10), Wrap=True)
filedge = FilletEdge(Shape=cap, Blend=1, Metric=0, Edges=["3", "5"], Radii=expr("x/2", "3"))
mesh_2 = MeshBrep(
    Brep=filedge,
    Settings={GridMaxCount=0, GridMinCount=16, JaggedSeams=False, MaxEdgeLength=0, MinEdgeLength=0.0001, MinTolerance=0, Refine=True, RefineAngle=0, RelativeTolerance=0.65, SimplePlanes=True, Tolerance=0})  # -> flatten(Mesh)
munion = MeshUnion(Meshes=[mesh, mesh_2])
xy = XYPlane(Origin=pt)
R_2 = ClusterOutput(munion)
rotate = Rotate(Geometry=xy, Angle=3.141592654, Plane=PlaneXY(0, 0, 0))  # -> Geometry, Transform
P = ClusterOutput(xy)

# ==== cluster Claytool
panel = Panel("0.5 * Pi")
pen_length_offset = Panel("0")
pen_v_block_offset_mm = Panel("11")
holder_weight = Panel(".133")
mesh = Mesh(<mesh referenced from the Rhino model>)
B = ClusterInput()
addition = Addition(A=holder_weight, B=B)
A = ClusterInput()
A_2 = ClusterInput()
R = ClusterOutput(addition)
division = Division(A=A, B=2)
subtraction = Subtraction(A=A_2, B=pen_length_offset)
addition_2 = Addition(A=A_2, B=pen_v_block_offset_mm)
pt = ConstructPoint(XCoordinate=0, YCoordinate=0, ZCoordinate=addition_2)
pt_2 = ConstructPoint(XCoordinate=0, YCoordinate=0, ZCoordinate=pen_v_block_offset_mm)
division_2 = Division(A=A, B=2)
division_3 = Division(A=A, B=2)
division_4 = Division(A="12", B=2)
division_5 = Division(A="12", B=2)
merge = Merge(Data1=division, Data2=division)
dom = ConstructDomain(DomainStart=expr("-x", division_2), DomainEnd=division_3)
dom_2 = ConstructDomain(DomainStart=expr("-x", division_4), DomainEnd=division_5)
panel_2 = Panel("0 to 1")
rectangle = Rectangle(Plane=pt_2, XSize=dom_2, YSize=dom, Radius=0)  # -> Rectangle, Length
lng = ListLength(List=merge)
Z = UnitZ(Factor=A_2)
extr = Extrude(Base=rectangle.Rectangle, Direction=Z)
cap = CapHoles(Brep=extr)
edges = BrepEdges(Brep=cap)  # -> Naked, Interior, NonManifold
item = ListItem(List=edges.Interior, Index=Slider(5, range=0..10), Wrap=True)
filedge = FilletEdge(Shape=cap, Blend=1, Metric=0, Edges=["3", "5"], Radii=expr("x/2", "12"))
mesh_2 = MeshBrep(
    Brep=filedge,
    Settings={GridMaxCount=0, GridMinCount=16, JaggedSeams=False, MaxEdgeLength=0, MinEdgeLength=0.0001, MinTolerance=0, Refine=True, RefineAngle=0, RelativeTolerance=0.65, SimplePlanes=True, Tolerance=0})  # -> flatten(Mesh)
munion = MeshUnion(Meshes=[mesh, mesh_2])
xy = XYPlane(Origin=pt)
rot3d = Rotate3D(Geometry=xy, Angle=3.141592654, Center=Point(0, 0, 0), Axis=Vector(0, 0, 1))  # -> Geometry, Transform
R_2 = ClusterOutput(munion)
P = ClusterOutput(xy)
