# Grasshopper definition Branch Node Jayden.gh (Grasshopper 1.0.8)
# plug-ins: Pufferfish, KUKA|prc - parametric robot control

# ---- group: CNC DISC
end_connector = Brep(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)

# ----
end_connector_2 = Brep([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])

# ---- group: BASE
brep = Brep(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)

# ----
initial_layer_height = Slider(0.8, range=0..10)

# ---- group: BASE CONTOUR SETTINGS
section_number = Slider(4, range=1..10)
splitter_rotation = Slider(45, range=0..180)
path_end_gap_offset = Slider(2, range=0..10)

# ----
square_lower_height = Slider(30, range=0..50)
bbox = BoundingBox(Content=end_connector, Plane=PlaneXY(0, 0, 0), UnionBox=True)  # -> Box, Box_2

# ----
# RECTREATES THE BASE MODEL TO
# SIMPLIFY THE SHAPE AND REDUCES
# THE NUMBER OF POINTS IN THE
# CONTOURS
bbox_2 = BoundingBox(Content=brep, Plane=PlaneXY(0, 0, 0))  # -> Box, Box_2
debrep = DeconstructBrep(Brep=bbox_2.Box)  # -> Faces, Edges, Vertices
area = Area(Geometry=debrep.Faces)  # -> Area, Centroid
pdecon = Deconstruct(Point=area.Centroid)  # -> XComponent, YComponent, ZComponent
sort = SortList(Keys=pdecon.ZComponent, ValuesA=debrep.Faces)  # -> Keys, ValuesA
sort_2 = SortList(Keys=pdecon.XComponent, ValuesA=area.Centroid)  # -> Keys, ValuesA
sort_3 = SortList(Keys=pdecon.YComponent, ValuesA=area.Centroid)  # -> Keys, ValuesA
item = ListItem(List=sort.ValuesA, Index=0, Wrap=True)  # -> Item1, Item
item_2 = ListItem(List=sort_2.ValuesA, Index=0, Wrap=True)  # -> Item1, Item
item_3 = ListItem(List=sort_3.ValuesA, Index=0, Wrap=True)  # -> Item1, Item
ln = Line(StartPoint=item_2.Item1, EndPoint=item_2.Item)
ln_2 = Line(StartPoint=item_3.Item1, EndPoint=item_3.Item)
bbx = BrepBrep(BrepA=item.Item1, BrepB=brep)  # -> Curves, Points
bbx_2 = BrepBrep(BrepA=item.Item, BrepB=brep)  # -> Curves, Points
len = Length(Curve=bbx.Curves)
merge = Merge(Data1=ln, Data2=ln_2)
len_2 = Length(Curve=bbx_2.Curves)
sort_4 = SortList(Keys=len_2, ValuesA=bbx_2.Curves)  # -> Keys, ValuesA
len_3 = Length(Curve=merge)
sort_5 = SortList(Keys=len, ValuesA=bbx.Curves)  # -> Keys, ValuesA
sort_6 = SortList(Keys=len_3, ValuesA=merge)  # -> Keys, ValuesA
item_4 = ListItem(List=sort_5.ValuesA, Index=0, Wrap=True)  # -> Item1, Item
item_5 = ListItem(List=sort_4.ValuesA, Index=0, Wrap=True)  # -> Item1, Item
item_6 = ListItem(List=sort_6.ValuesA, Index=0, Wrap=True)  # -> Item1, Item
crv = Curve(item_4.Item1)
pcol = PolylineCollapse(Polyline=item_5.Item1, Tolerance=Slider(0.75, range=0..1))  # -> Polyline, Count
crv_2 = Curve(item_4.Item)
cp = ControlPoints(Curve=pcol.Polyline)  # -> Points, Weights, Knots
boundary = BoundarySurfaces(Edges=crv_2)
crv_3 = Curve(item_5.Item)
area_2 = Area(Geometry=crv_3)  # -> Area, Centroid
area_3 = Area(Geometry=boundary)  # -> Area, Centroid
lng = ListLength(List=cp.Points)
vec2pt = Vector2Pt(PointA=area_3.Centroid, PointB=area_2.Centroid, Unitize=False)  # -> Vector, Length
divide = DivideCurve(Curve=crv, Count=lng, Kinks=False)  # -> Points, Tangents, Parameters
pline = PolyLine(Vertices=divide.Points, Closed=True)
move = Move(Geometry=crv_2, Motion=vec2pt.Vector)  # -> Geometry, Transform
loft = Loft(
    Curves=flatten([pcol.Polyline, pline]),
    Options={Adjust=True, Closed=False, LoftEnds=0, LoftSimp=2, LoftType=3, Rebuild=10, Refit=0.01})
merge_2 = Merge(Data1=move.Geometry, Data2=crv_2)
loft_2 = Loft(
    Curves=flatten(merge_2),
    Options={Adjust=False, Closed=False, LoftEnds=0, LoftSimp=2, LoftType=3, Rebuild=10, Refit=0.01})
bbox_3 = BoundingBox(Content=loft, Plane=PlaneXY(0, 0, 0), UnionBox=True)  # -> Box, Box_2
debrep_2 = DeconstructBrep(Brep=bbox_3.Box)  # -> Faces, Edges, Vertices
bbox_4 = BoundingBox(Content=loft_2, Plane=PlaneXY(0, 0, 0), UnionBox=True)  # -> Box, Box_2
area_4 = Area(Geometry=debrep_2.Faces)  # -> Area, Centroid
debrep_3 = DeconstructBrep(Brep=bbox_4.Box)  # -> Faces, Edges, Vertices
pdecon_2 = Deconstruct(Point=area_4.Centroid)  # -> XComponent, YComponent, ZComponent
area_5 = Area(Geometry=debrep_3.Faces)  # -> Area, Centroid
sort_7 = SortList(Keys=pdecon_2.ZComponent, ValuesA=debrep_2.Faces)  # -> Keys, ValuesA
sort_8 = SortList(Keys=pdecon_2.ZComponent, ValuesA=area_4.Centroid)  # -> Keys, ValuesA
pdecon_3 = Deconstruct(Point=area_5.Centroid)  # -> XComponent, YComponent, ZComponent
item_7 = ListItem(List=sort_8.ValuesA, Index=0, Wrap=True)  # -> Item1, Item
item_8 = ListItem(List=sort_7.ValuesA, Index=0, Wrap=True)
sort_9 = SortList(Keys=pdecon_3.ZComponent, ValuesA=debrep_3.Faces)  # -> Keys, ValuesA
sort_10 = SortList(Keys=pdecon_3.ZComponent, ValuesA=area_5.Centroid)  # -> Keys, ValuesA
initial_layer_height_2 = Number(initial_layer_height)
item_9 = ListItem(List=sort_10.ValuesA, Index=0, Wrap=True)  # -> Item1, Item
item_10 = ListItem(List=sort_9.ValuesA, Index=0, Wrap=True)
Z = UnitZ(Factor=initial_layer_height_2)
initial_layer_height_3 = Number(initial_layer_height)
move_2 = Move(Geometry=item_7.Item, Motion=Z)  # -> Geometry, Transform
Z_2 = UnitZ(Factor=initial_layer_height_3)
layer_height = Number()
ln_3 = Line(StartPoint=move_2.Geometry, EndPoint=item_7.Item1)
move_3 = Move(Geometry=item_9.Item, Motion=Z_2)  # -> Geometry, Transform
divlength = DivideLength(Curve=ln_3, Length=layer_height)  # -> Points, Tangents, Parameters
layer_height_2 = Number()
ln_4 = Line(StartPoint=move_3.Geometry, EndPoint=item_9.Item1)
vec2pt_2 = Vector2Pt(PointA=item_7.Item, PointB=divlength.Points, Unitize=False)  # -> Vector, Length
divlength_2 = DivideLength(Curve=ln_4, Length=layer_height_2)  # -> Points, Tangents, Parameters
vec2pt_3 = Vector2Pt(PointA=item_9.Item, PointB=divlength_2.Points, Unitize=False)  # -> Vector, Length
move_4 = Move(Geometry=item_8, Motion=vec2pt_2.Vector)  # -> Geometry, Transform
bbx_3 = BrepBrep(BrepA=loft, BrepB=move_4.Geometry)  # -> simplify(Curves), Points
move_5 = Move(Geometry=item_10, Motion=vec2pt_3.Vector)  # -> Geometry, Transform
bbx_4 = BrepBrep(BrepA=loft_2, BrepB=move_5.Geometry)  # -> simplify(Curves), Points
cp_2 = ControlPoints(Curve=bbx_4.Curves)  # -> simplify(Points), Weights, Knots
pline_2 = PolyLine(Vertices=cp_2.Points, Closed=True)  # -> flatten(Polyline)
pcol_2 = PolylineCollapse(Polyline=pline_2, Tolerance=Slider(1.106, range=0..3))  # -> Polyline, Count

debrep_4 = DeconstructBrep(Brep=bbox.Box)  # -> Faces, Edges, Vertices
area_6 = Area(Geometry=debrep_4.Faces)  # -> Area, Centroid
pdecon_4 = Deconstruct(Point=area_6.Centroid)  # -> XComponent, YComponent, ZComponent
sort_11 = SortList(Keys=pdecon_4.ZComponent, ValuesA=debrep_4.Faces)  # -> Keys, ValuesA
sort_12 = SortList(Keys=pdecon_4.ZComponent, ValuesA=area_6.Centroid)  # -> Keys, ValuesA
item_11 = ListItem(List=sort_12.ValuesA, Index=0, Wrap=True)  # -> Item1, Item
item_12 = ListItem(List=sort_11.ValuesA, Index=0, Wrap=True)
initial_layer_height_4 = Number(initial_layer_height)
Z_3 = UnitZ(Factor=initial_layer_height_4)
move_6 = Move(Geometry=item_11.Item, Motion=Z_3)  # -> Geometry, Transform
middle_disc_height = Distance(PointA=item_11.Item1, PointB=item_11.Item)
layer_height_3 = Number()
ln_5 = Line(StartPoint=move_6.Geometry, EndPoint=item_11.Item1)
divlength_3 = DivideLength(Curve=ln_5, Length=layer_height_3)  # -> Points, Tangents, Parameters
item_13 = ListItem(List=divlength_3.Points, Index=0, Wrap=True)  # -> Item1, Item
vec2pt_4 = Vector2Pt(PointA=item_11.Item, PointB=divlength_3.Points, Unitize=False)  # -> Vector, Length
pt = Point(item_11.Item)
dist = Distance(PointA=pt, PointB=item_13.Item1)  # -> flatten(Distance)
move_7 = Move(Geometry=item_12, Motion=vec2pt_4.Vector)  # -> Geometry, Transform
bbx_5 = BrepBrep(BrepA=end_connector, BrepB=move_7.Geometry)  # -> simplify(Curves), Points

# ---- group: BEAD WIDTH
num = Number()

# ----
offset = OffsetCurve(Curve=bbx_5.Curves, Distance=expr("-X/2", num), Corners=1)  # -> simplify(Curve)

# ---- group: BEAD WIDTH
num_2 = Number()

num_3 = Number()

num_4 = Number()

# ----
# INFILL FOR DISC
offset_2 = OffsetCurve(Curve=offset, Distance=expr("-X", num_2), Corners=1)  # -> simplify(Curve)
tstat = TreeStatistics(Tree=offset_2)  # -> Paths, Length, Count
dispatch = Dispatch(List=tstat.Paths, DispatchPattern=[True, False])  # -> ListA, ListB
split = SplitTree(Data=offset_2, Masks=flatten(dispatch.ListA))  # -> Positive, Negative
area_7 = Area(Geometry=split.Positive)  # -> Area, Centroid
area_8 = Area(Geometry=split.Negative)  # -> Area, Centroid
number_slider = Slider(500, range=0..1000)
number_slider_2 = Slider(500, range=0..1000)
X = UnitX(Factor=1)
Y = UnitY(Factor=1)
line = LineSDL(Start=area_7.Centroid, Direction=X, Length=number_slider)
line_2 = LineSDL(Start=area_8.Centroid, Direction=Y, Length=number_slider_2)
division = Division(A=number_slider, B=-2)
division_2 = Division(A=number_slider_2, B=-2)
X_2 = UnitX(Factor=division)
Y_2 = UnitY(Factor=division_2)
move_8 = Move(Geometry=line, Motion=X_2)  # -> simplify(Geometry), Transform
move_9 = Move(Geometry=line_2, Motion=Y_2)  # -> simplify(Geometry), Transform
ccx = CurveCurve(CurveA=move_8.Geometry, CurveB=split.Positive)  # -> simplify(Points), ParamsA, ParamsB
ccx_2 = CurveCurve(CurveA=move_9.Geometry, CurveB=split.Negative)  # -> simplify(Points), ParamsA, ParamsB
pline_3 = PolyLine(Vertices=ccx.Points, Closed=False)
pline_4 = PolyLine(Vertices=ccx_2.Points, Closed=False)
divlength_4 = DivideLength(Curve=pline_3, Length=num_3)  # -> simplify(Points), Tangents, Parameters
number_slider_3 = Slider(500, range=0..1000)
divlength_5 = DivideLength(Curve=pline_4, Length=num_4)  # -> Points, Tangents, Parameters
number_slider_4 = Slider(500, range=0..1000)
Y_3 = UnitY(Factor=1)
X_3 = UnitX(Factor=1)
line_3 = LineSDL(Start=divlength_4.Points, Direction=Y_3, Length=number_slider_3)
division_3 = Division(A=number_slider_3, B=-2)
line_4 = LineSDL(Start=divlength_5.Points, Direction=X_3, Length=number_slider_4)  # -> simplify(Line)
division_4 = Division(A=number_slider_4, B=-2)
Y_4 = UnitY(Factor=division_3)
X_4 = UnitX(Factor=division_4)
move_10 = Move(Geometry=line_3, Motion=Y_4)  # -> simplify(Geometry), Transform
move_11 = Move(Geometry=line_4, Motion=X_4)  # -> simplify(Geometry), Transform
path_mapper = PathMapper(move_11.Geometry, source="{A;B;C}", target="{A}")
merge_3 = Merge(Data1=move_10.Geometry, Data2=move_11.Geometry)
boundary_2 = BoundarySurfaces(Edges=offset_2)
scx = SurfaceCurve(Surface=boundary_2, Curve=merge_3)  # -> simplify(Curves), Points, UVPoints, Normals, Parameters, Tangents
trim = TrimTree(Tree=scx.Curves, Depth=1)
dispatch_2 = Dispatch(List=trim, DispatchPattern=[True, False])  # -> ListA, ListB
flip = FlipCurve(Curve=dispatch_2.ListB)  # -> Curve, Flag
end = EndPoints(Curve=dispatch_2.ListA)  # -> Start, End
end_2 = EndPoints(Curve=flip.Curve)  # -> Start, End
pt_2 = Point(end.Start)
pt_3 = Point(end.End)
pt_4 = Point(end_2.Start)
pt_5 = Point(end_2.End)
cull_i = CullIndex(List=pt_3, Indices="-1", Wrap=True)
cull_i_2 = CullIndex(List=pt_2, Indices="0", Wrap=True)
ln_6 = Line(StartPoint=cull_i, EndPoint=pt_4)  # -> simplify(Line)
ln_7 = Line(StartPoint=pt_5, EndPoint=cull_i_2)  # -> simplify(Line)
relay = Relay([ln_6, ln_7])
join = JoinCurves(Curves=[relay, trim], Preserve=False)  # -> simplify(Curves)

# ---- group: BEAD WIDTH
num_5 = Number()

# ----
# RECREATES END CONNECTOR BECAUSE
# ORIGINAL MODEL CREATES SOME ISSUES
# WHEN SLICING
buffer = Slider(0.5, range=0..5)
disc_height = Panel(dist)
bbox_5 = BoundingBox(Content=end_connector_2, Plane=PlaneXY(0, 0, 0), UnionBox=True)  # -> Box, Box_2
addition = Addition(A=disc_height, B=buffer)
debrep_5 = DeconstructBrep(Brep=bbox_5.Box)  # -> Faces, Edges, Vertices
roundd = RoundToDecimalPlace(NumberX=addition, DecimalPlace="0", RoundType=0)  # -> Rounded, Difference
area_9 = Area(Geometry=debrep_5.Faces)  # -> Area, Centroid
pdecon_5 = Deconstruct(Point=area_9.Centroid)  # -> XComponent, YComponent, ZComponent
sort_13 = SortList(Keys=pdecon_5.ZComponent, ValuesA=debrep_5.Faces)  # -> Keys, ValuesA
item_14 = ListItem(List=sort_13.ValuesA, Index=0, Wrap=True)  # -> Item1, Item
bbx_6 = BrepBrep(BrepA=simplify(flatten(end_connector_2)), BrepB=graft([item_14.Item, item_14.Item1]))  # -> simplify(Curves), Points
trim_2 = TrimTree(Tree=bbx_6.Curves, Depth=1)
tstat_2 = TreeStatistics(Tree=trim_2)  # -> Paths, Length, Count
item_15 = ListItem(List=tstat_2.Paths, Index=0, Wrap=True)  # -> Item1, Item
branch = TreeBranch(Tree=trim_2, Path=[item_15.Item1, item_15.Item], MaintainPaths=True)  # -> flatten(Branch)
boundary_3 = BoundarySurfaces(Edges=branch)
sunion = SolidUnion(Breps=boundary_3)
fmerge = MergeFaces(Brep=sunion)  # -> Breps, Before, After
edges = BrepEdges(Brep=fmerge.Breps)  # -> Naked, Interior, NonManifold
join_2 = JoinCurves(Curves=edges.Naked, Preserve=False)  # -> simplify(Curves)
len_4 = Length(Curve=join_2)
sort_14 = SortList(Keys=len_4, ValuesA=join_2)  # -> Keys, ValuesA
item_16 = ListItem(List=sort_14.ValuesA, Index=0, Wrap=True)  # -> Item1, Item
crv_4 = Curve(item_16.Item1)
item_17 = ListItem(List=flatten(crv_4), Index=0, Wrap=True)  # -> Item1, Item
simplify = SimplifyCurve(Curve=item_17.Item1)  # -> Curve, Simplified
explode = Explode(Curve=simplify.Curve, Recursive=True)  # -> Segments, Vertices
divide_2 = DivideCurve(Curve=explode.Segments, Count=10, Kinks=False)  # -> simplify(Points), Tangents, Parameters
pline_5 = PolyLine(Vertices=divide_2.Points, Closed=False)  # -> flatten(Polyline)
join_3 = JoinCurves(Curves=pline_5, Preserve=False)
cp_3 = ControlPoints(Curve=join_3)  # -> Points, Weights, Knots
lng_2 = ListLength(List=cp_3.Points)
item_18 = ListItem(List=cp_3.Points, Index=Slider(35, range=0..100), Wrap=True)
divide_3 = DivideCurve(Curve=item_17.Item, Count=lng_2, Kinks=False)  # -> Points, Tangents, Parameters
pline_6 = PolyLine(Vertices=divide_3.Points, Closed=True)
crv_5 = Curve(flatten(pline_6))
crv_6 = Curve(flatten(join_3))
layer_height_4 = Number(square_lower_height)
Z_4 = UnitZ(Factor=roundd.Rounded)
Z_5 = UnitZ(Factor=layer_height_4)
move_12 = Move(Geometry=crv_6, Motion=expr("-x", Z_5))  # -> Geometry, Transform
move_13 = Move(Geometry=crv_5, Motion=Z_4)  # -> Geometry, Transform
merge_4 = Merge(Data1=crv_6, Data2=move_12.Geometry, Data3=move_13.Geometry, Data4=crv_5)
item_19 = ListItem(List=merge_4, Index=0, Wrap=True)
pt_6 = Point(item_18)
flip_2 = FlipCurve(Curve=merge_4, Guide=item_19)  # -> Curve, Flag
alicrvseams = AlignCurveSeams(Curves=flip_2.Curve, Guide=pt_6, Snap=False, Iterative=True)  # -> Aligned, Points, R
loft_3 = Loft(
    Curves=alicrvseams.Aligned,
    Options={Adjust=True, Closed=False, LoftEnds=0, LoftSimp=0, LoftType=3, Rebuild=10, Refit=0.01})
bbox_6 = BoundingBox(Content=loft_3, Plane=PlaneXY(0, 0, 0), UnionBox=True)  # -> Box, Box_2
debrep_6 = DeconstructBrep(Brep=bbox_6.Box)  # -> Faces, Edges, Vertices
area_10 = Area(Geometry=debrep_6.Faces)  # -> Area, Centroid
pdecon_6 = Deconstruct(Point=area_10.Centroid)  # -> XComponent, YComponent, ZComponent
sort_15 = SortList(Keys=pdecon_6.ZComponent, ValuesA=debrep_6.Faces)  # -> Keys, ValuesA
sort_16 = SortList(Keys=pdecon_6.ZComponent, ValuesA=area_10.Centroid)  # -> Keys, ValuesA
item_20 = ListItem(List=sort_16.ValuesA, Index=0, Wrap=True)  # -> Item1, Item
item_21 = ListItem(List=sort_15.ValuesA, Index=0, Wrap=True)
initial_layer_height_5 = Number(initial_layer_height)
Z_6 = UnitZ(Factor=initial_layer_height_5)
move_14 = Move(Geometry=item_20.Item, Motion=Z_6)  # -> Geometry, Transform
layer_height_5 = Number()
ln_8 = Line(StartPoint=move_14.Geometry, EndPoint=item_20.Item1)
divlength_6 = DivideLength(Curve=ln_8, Length=layer_height_5)  # -> Points, Tangents, Parameters
vec2pt_5 = Vector2Pt(PointA=item_20.Item, PointB=divlength_6.Points, Unitize=False)  # -> Vector, Length
move_15 = Move(Geometry=item_21, Motion=vec2pt_5.Vector)  # -> Geometry, Transform
bbx_7 = BrepBrep(BrepA=loft_3, BrepB=move_15.Geometry)  # -> simplify(Curves), Points
division_5 = Division(A=num_5, B="2")
offset_3 = OffsetCurve(Curve=bbx_7.Curves, Distance=expr("-X", division_5), Corners=1)  # -> simplify(Curve)

merge_5 = Merge(Data1=offset, Data2=join)  # -> flatten(Result)

# ---- group: BASE OUTER CONTOUR
crv_7 = Curve(flatten(bbx_3.Curves))

# ---- group: END CONNECTOR CONTOURS
crv_8 = Curve(offset_3)

# ---- group: BASE INNER CONTOUR
crv_9 = Curve(pcol_2.Polyline)

# ----
# SEPERATES THE FIRST FEW LAYERS OF THE
# END CONNECTOR TOOLPATHS SO THAT IT CAN
# CREATE A LIP TO SET THE DISC INTO ONCE THE
# BASE WAS DONE PRINTING.
# 
# AFTER THE REST OF THE END CONNECTOR
# TOOLPATH CAN BE PRINTED.
item_22 = ListItem(List=flatten(crv_8), Index=0, Wrap=True)  # -> Item1, Item
item_23 = ListItem(List=crv_7, Index=0, Wrap=True)  # -> Item1, Item
area_11 = Area(Geometry=item_22.Item)  # -> Area, Centroid
area_12 = Area(Geometry=item_23.Item1)  # -> Area, Centroid
bbox_7 = BoundingBox(Content=item_23.Item1, Plane=PlaneXY(0, 0, 0), UnionBox=True)  # -> Box, Box_2
middle_disc_height_2 = Panel(middle_disc_height)
vec2pt_6 = Vector2Pt(PointA=area_11.Centroid, PointB=area_12.Centroid, Unitize=False)  # -> Vector, Length
Z_7 = UnitZ(Factor=middle_disc_height_2)
move_16 = Move(Geometry=crv_8, Motion=vec2pt_6.Vector)  # -> Geometry, Transform
extr = Extrude(Base=bbox_7.Box, Direction=Z_7)
initial_layer_height_6 = Number(initial_layer_height)
Z_8 = UnitZ(Factor=initial_layer_height_6)
move_17 = Move(Geometry=move_16.Geometry, Motion=Z_8)  # -> Geometry, Transform
shapein = ShapeInBrep(Brep=extr, Shape=flatten(move_17.Geometry))
smaller = SmallerThan(FirstNumber=shapein, SecondNumber="2")  # -> SmallerThan, OrEqualTo
invbool = InvertBoolean(Boolean=smaller.SmallerThan)  # -> Inverted, Number
crv_10 = Curve([move_12.Geometry, crv_6])
bbox_8 = BoundingBox(Content=crv_10, Plane=PlaneXY(0, 0, 0), UnionBox=True)  # -> Box, Box_2
cull = CullPattern(List=flatten(move_17.Geometry), CullPattern=invbool.Inverted)
cull_2 = CullPattern(List=flatten(move_17.Geometry), CullPattern=smaller.SmallerThan)
volume = Volume(Geometry=bbox_8.Box)  # -> Volume, Centroid
cp_4 = ControlPoints(Curve=cull_2)  # -> simplify(Points), Weights, Knots
scale = Scale(Geometry=bbox_8.Box, Center=volume.Centroid, Factor="1.1")  # -> Geometry, Transform
shapein_2 = ShapeInBrep(Brep=scale.Geometry, Shape=flatten(cull))
cull_i_3 = CullIndex(List=cp_4.Points, Indices="-1", Wrap=True)  # -> flatten(List)
invbool_2 = InvertBoolean(Boolean=shapein_2)  # -> Inverted, Number
pline_7 = PolyLine(Vertices=cull_i_3, Closed=False)
cull_3 = CullPattern(List=flatten(cull), CullPattern=invbool_2.Inverted)
cull_4 = CullPattern(List=flatten(cull), CullPattern=shapein_2)
num_6 = Number(lng_2)
divide_4 = DivideCurve(Curve=cull_3, Count=expr("X-1", num_6), Kinks=False)  # -> simplify(Points), Tangents, Parameters
pline_8 = PolyLine(Vertices=divide_4.Points, Closed=True)  # -> flatten(Polyline)
merge_6 = Merge(Data1=cull_4, Data2=pline_8)
cp_5 = ControlPoints(Curve=merge_6)  # -> simplify(Points), Weights, Knots
cull_i_4 = CullIndex(List=cp_5.Points, Indices="-1", Wrap=True)  # -> flatten(List)
pline_9 = PolyLine(Vertices=cull_i_4, Closed=False)

# ---- group: SPLITTER ROTATION
num_7 = Number(splitter_rotation)

# ---- group: SECTION NUMBER
num_8 = Number(section_number)

# ---- group: BASE INNER CONTOUR
crv_11 = Curve(simplify(graft(crv_9)))

# ---- group: BASE OUTER CONTOUR
crv_12 = Curve(simplify(graft(crv_7)))

# ---- group: BEAD WIDTH
num_9 = Number()

# ---- group: PATH END GAP OFFSET
num_10 = Number(path_end_gap_offset)

# ----
# TAKES THE OUTSIDE AND INSIDE CONTOURS
# AND SPLITS THEM INTO SECTIONS TO CONNECT
# THEM AND MAKE THE FINAL PRINT STRONGER
crv_13 = Curve(item_6.Item1)
midpt = CurveMiddle(Curve=crv_13)
merge_7 = Merge(Data1=graft(crv_9), Data2=graft(crv_7))  # -> simplify(Result)
item_24 = ListItem(List=crv_9, Index=0, Wrap=True)
devec = DeconstructVector(Vector=midpt)  # -> XComponent, YComponent, ZComponent
Z_9 = UnitZ(Factor=devec.ZComponent)
flip_3 = FlipCurve(Curve=merge_7, Guide=item_24)  # -> Curve, Flag
neg = Negative(Value=Z_9)
boundary_4 = BoundarySurfaces(Edges=flip_3.Curve)
move_18 = Move(Geometry=crv_13, Motion=neg)  # -> Geometry, Transform
midpt_2 = CurveMiddle(Curve=move_18.Geometry)
scale_2 = Scale(Geometry=move_18.Geometry, Center=midpt_2, Factor=Slider(1.01, range=0..10))  # -> Geometry, Transform
len_5 = Length(Curve=scale_2.Geometry)
cir = Circle(Plane=midpt_2, Radius=expr("x/2", len_5))
rot3d = Rotate3D(Geometry=cir, Angle=degrees(num_7), Center=midpt_2, Axis=Vector(0, 0, 1))  # -> Geometry, Transform
divide_5 = DivideCurve(Curve=rot3d.Geometry, Count=num_8, Kinks=False)  # -> Points, Tangents, Parameters
expression = Expression(x=num_8, Expression="(360/x)/2")
ln_9 = Line(StartPoint=midpt_2, EndPoint=divide_5.Points)
pt_7 = Point(midpt_2)
vec = Vector(vec2pt_2.Vector)
rot3d_2 = Rotate3D(Geometry=ln_9, Angle=degrees(expression), Center=pt_7, Axis=Vector(0, 0, 1))  # -> Geometry, Transform
devec_2 = DeconstructVector(Vector=vec)  # -> XComponent, YComponent, ZComponent
Z_10 = UnitZ(Factor=devec_2.ZComponent)
move_19 = Move(Geometry=simplify(graft(ln_9)), Motion=Z_10)  # -> simplify(Geometry), Transform
flip_4 = FlipMatrix(Data=move_19.Geometry)
scx_2 = SurfaceCurve(Surface=boundary_4, Curve=flip_4)  # -> Curves, Points, UVPoints, Normals, Parameters, Tangents
trim_3 = TrimTree(Tree=scx_2.Curves, Depth=1)
trim_4 = TrimTree(Tree=scx_2.Curves, Depth=1)
eval = EvaluateCurve(Curve=reparameterize(trim_4), Parameter="0.5")  # -> Point, Tangent, Angle
merge_8 = Merge(Data1=crv_11, Data2=trim_3)
merge_9 = Merge(Data1=crv_12, Data2=trim_4)
mcx = MultipleCurves(Curves=merge_8)  # -> Points, IndexA, IndexB, ParamA, ParamB
mcx_2 = MultipleCurves(Curves=merge_9)  # -> Points, IndexA, IndexB, ParamA, ParamB
flip_5 = FlipMatrix(Data=eval.Point)
shatter = Shatter(Curve=crv_11, Parameters=mcx.ParamA)  # -> simplify(Segments)
shatter_2 = Shatter(Curve=crv_12, Parameters=mcx_2.ParamA)  # -> simplify(Segments)
item_25 = ListItem(List=flip_5, Index=0, Wrap=True)  # -> Item1, Item
ln_10 = Line(StartPoint=item_25.Item1, EndPoint=item_25.Item)
flip_6 = FlipMatrix(Data=shatter_2)
flip_7 = FlipMatrix(Data=shatter)
group = Group(Geometry=flip_6)  # -> flatten(Group)
group_2 = Group(Geometry=flip_7)  # -> flatten(Group)
bbox_9 = BoundingBox(Content=group_2, Plane=PlaneXY(0, 0, 0))  # -> Box, Box_2
bbox_10 = BoundingBox(Content=group, Plane=PlaneXY(0, 0, 0))  # -> Box, Box_2
volume_2 = Volume(Geometry=bbox_9.Box)  # -> Volume, Centroid
volume_3 = Volume(Geometry=bbox_10.Box)  # -> Volume, Centroid
polar = ToPolar(Point=volume_2.Centroid, System=PlaneXY(0, 0, 0))  # -> Phi, Theta, Radius
polar_2 = ToPolar(Point=volume_3.Centroid, System=PlaneXY(0, 0, 0))  # -> Phi, Theta, Radius
sort_17 = SortList(Keys=polar.Phi, ValuesA=group_2)  # -> Keys, ValuesA
sort_18 = SortList(Keys=polar_2.Phi, ValuesA=group)  # -> Keys, ValuesA
ungroup = Ungroup(Group=sort_18.ValuesA)  # -> simplify(Geometry)
ungroup_2 = Ungroup(Group=sort_17.ValuesA)  # -> simplify(Geometry)
flip_8 = FlipMatrix(Data=ungroup_2)
flip_9 = FlipMatrix(Data=ungroup)
graft = GraftTree(Tree=trim_3, IncludeEmptyLists=True, IncludeNullItems=True)
graft_2 = GraftTree(Tree=flip_8, IncludeEmptyLists=True, IncludeNullItems=True)
graft_3 = GraftTree(Tree=flip_9, IncludeEmptyLists=True, IncludeNullItems=True)
join_4 = JoinCurves(Curves=[graft, graft_2], Preserve=False)  # -> simplify(Curves)
join_5 = JoinCurves(Curves=[join_4, graft_3], Preserve=False)  # -> simplify(Curves)
trim_5 = TrimTree(Tree=join_5, Depth=1)
clscrv = CloseCurve(Curve=trim_5, CloseType=0, Bulge=0.5, Tolerance=0)  # -> Closed, R
division_6 = Division(A=num_9, B="2")
offset_4 = OffsetCurve(Curve=clscrv.Closed, Distance=expr("-X", division_6), Corners=1)
trim_6 = TrimTree(Tree=offset_4, Depth=1)
len_6 = Length(Curve=flatten(trim_6))
len_7 = Length(Curve=trim_6)
avr = Average(Input=len_6)
smaller_2 = SmallerThan(FirstNumber=expr("X/5", avr), SecondNumber=len_7)  # -> SmallerThan, OrEqualTo
cull_5 = CullPattern(List=trim_6, CullPattern=smaller_2.SmallerThan)
flip_10 = FlipMatrix(Data=cull_5)
group_3 = Group(Geometry=flip_10)  # -> flatten(Group)
bbox_11 = BoundingBox(Content=group_3, Plane=PlaneXY(0, 0, 0))  # -> Box, Box_2
volume_4 = Volume(Geometry=bbox_11.Box)  # -> Volume, Centroid
polar_3 = ToPolar(Point=volume_4.Centroid, System=PlaneXY(0, 0, 0))  # -> Phi, Theta, Radius
sort_19 = SortList(Keys=polar_3.Phi, ValuesA=group_3)  # -> Keys, ValuesA
ungroup_3 = Ungroup(Group=sort_19.ValuesA)  # -> simplify(Geometry)
crvalicrvseams = CurveAlignCurveSeams(Curves=ungroup_3, Guide=ln_10, Snap=False)  # -> simplify(Aligned), simplify(Points), R
pt_8 = Point(crvalicrvseams.Points)
ext = ExtendCurve(Curve=crvalicrvseams.Aligned, Type=0, Start=expr("-x/2", num_10), End=expr("-x/2", num_10))
flip_11 = FlipMatrix(Data=ext)

end_connector_part_a_contour = Curve(pline_7)

# ---- group: BASE CONTOURS
crv_14 = Curve(flatten(flip_11))

# ---- group: DISC CONTOURS
crv_15 = Curve(merge_5)

# ---- group: END CONNECTOR PART [B] CONTOUR
crv_16 = Curve(pline_9)

# ----
merge_10 = Merge(Data1=crv_14, Data2=crv_15, Data3=crv_16, Data4=end_connector_part_a_contour)
merge_11 = Merge(Data1=crv_14, Data2=end_connector_part_a_contour)
bbox_12 = BoundingBox(Content=merge_10, Plane=PlaneXY(0, 0, 0), UnionBox=True)  # -> Box, Box_2
debrep_7 = DeconstructBrep(Brep=bbox_12.Box)  # -> Faces, Edges, Vertices
bbox_13 = BoundingBox(Content=crv_15, Plane=PlaneXY(0, 0, 0), UnionBox=True)  # -> Box, Box_2
md_slider = MDSlider(
    SliderMode=0,
    slider_value=Point(0.717356612, 0.4273015464, 0.5),
    x_domain=Domain(0, 1),
    y_domain=Domain(0, 1),
    z_domain=Domain(0, 1))
debrep_8 = DeconstructBrep(Brep=bbox_13.Box)  # -> Faces, Edges, Vertices
area_13 = Area(Geometry=debrep_7.Faces)  # -> Area, Centroid
pdecon_7 = Deconstruct(Point=area_13.Centroid)  # -> XComponent, YComponent, ZComponent
area_14 = Area(Geometry=debrep_8.Faces)  # -> Area, Centroid
number_slider_5 = Slider(569, range=0..1000)
sort_20 = SortList(Keys=pdecon_7.ZComponent, ValuesA=area_13.Centroid)  # -> Keys, ValuesA
pdecon_8 = Deconstruct(Point=area_14.Centroid)  # -> XComponent, YComponent, ZComponent
item_26 = ListItem(List=sort_20.ValuesA, Index=0, Wrap=True)
sort_21 = SortList(Keys=pdecon_8.ZComponent, ValuesA=area_14.Centroid)  # -> Keys, ValuesA
dom = ConstructDomain(DomainStart=expr("X/2", number_slider_5), DomainEnd=expr("-X/2", number_slider_5))
item_27 = ListItem(List=sort_21.ValuesA, Index=0, Wrap=True)
box = DomainBox(Base=item_26, X=dom, Y=dom, Z="0")
srf = Surface(box)
evalsrf = EvaluateSurface(Surface=reparameterize(srf), Point=md_slider)  # -> Point, Normal, UDirection, VDirection, Frame
pt_9 = Point(evalsrf.Point)
vec2pt_7 = Vector2Pt(PointA=item_27, PointB=pt_9, Unitize=False)  # -> Vector, Length
move_20 = Move(Geometry=crv_15, Motion=vec2pt_7.Vector)  # -> Geometry, Transform

# ---- group: TOOLPATH PART 1
# FABRICATE DISC FIRST
# THEN PRINT PART 1
# PLACE DISC
# THEN PRINT PART 2
crv_17 = Curve(merge_11)

# ---- group: TOOLPATH PART 2
crv_18 = Curve(crv_16)

# ---- group: DISC TOOLPATH
crv_19 = Curve(move_20.Geometry)

# ----
linear_movement_kuka_prc = LINearMovementKUKAPrc(TargetAsPlane=<missing>, Speed=<missing>, extaxenabled=False, interpolation="C_DIS")
krl_code_kuka_prc = KRLCodeKUKAPrc(KRLAsText=<missing>)
linear_movement_kuka_prc_2 = LINearMovementKUKAPrc(TargetAsPlane=<missing>, Speed=<missing>, extaxenabled=False, interpolation="C_DIS")
krl_code_kuka_prc_2 = KRLCodeKUKAPrc(KRLAsText=<missing>)
extract_command_kuka_prc = ExtractCommandKUKAPrc(KUKAPrcCommand=<missing>)  # -> PlaneOutput, AxisValues, SpeedValues
linear_movement_kuka_prc_3 = LINearMovementKUKAPrc(TargetAsPlane=<missing>, extaxenabled=False, interpolation="C_DIS")
krl_code_kuka_prc_3 = KRLCodeKUKAPrc(KRLAsText=<missing>)
linear_movement_kuka_prc_4 = LINearMovementKUKAPrc(TargetAsPlane=<missing>, extaxenabled=False, interpolation="C_DIS")
iontec_kr30_70_r2100_robot = IontecKR3070R2100Robot(infiniterot=False)
base_8_core = KUKAPrcCORE(
    SimulationSlider=<missing>,
    KUKAPrcCommands=<missing>,
    Tool=<missing>,
    Robot=iontec_kr30_70_r2100_robot,
    SaveToggle=<missing>,
    Filename=<missing>,
    RobotBase=<missing>,
    PRC_BaseExpose=True,
    PRC_SaveNameExpose=True,
    PRCsettings="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")  # -> RobotGeometry, AnalysisOutput
# 5: Simulate and Save
analysis_kuka_prc = AnalysisKUKAPrc(KUKAPrcAnalysisData=base_8_core.AnalysisOutput)  # -> RobotAxisValues, RobotCollisionCheck, RobotReachabilityCheck, CommandID, TimeValue, Planes, CommandTags, IOState, Index, KRL
