# Grasshopper definition test.gh (Grasshopper 1.0.8)

# ---- group: TEST
series = Series(Start="1", Step="1", Count="100")
pt = Point(Point(0, 0, 1))
pt_2 = Point(Point(0, 0, 100))
Y = UnitY(Factor=series)
ln = Line(StartPoint=pt, EndPoint=pt_2)
move = Move(Geometry=ln, Motion=Y)  # -> Geometry, Transform

# ---- group: // TEST
bbox = BoundingBox(Content=move.Geometry, Plane=PlaneXY(0, 0, 0))  # -> Box, Box_2
area = Area(Geometry=bbox.Box_2)  # -> Area, Centroid
